# Grasshopper definition cluster.gh (Grasshopper 1.0.8)
# plug-ins: treesloth01, Pufferfish, Rhino.Inside for Autodesk Revit

model_object = ModelObject()
model_object_2 = ModelObject(model_object)

# ---- group: PARAMETRY BEZ PRZEROBEK
panel = Panel("""PIG_Nr Klatki
PIG_Nr Lokalu""")
user_text = UserText(Content=model_object_2, UserTextMode=1)  # -> Content, Keys, Values
panel_2 = Panel("""Klatka
Numer lokalu""")
query_parameters = QueryParameters(Name=panel_2)
member_index = MemberIndex(Set=user_text.Keys, Member=panel)  # -> Index, Count
shift_paths = ShiftPaths(Data=member_index.Index, Offset=-1)
list_item = ListItem(List=user_text.Values, Index=shift_paths, Wrap=True)
list_length = ListLength(List=list_item)
duplicate_data = DuplicateData(Data=<missing>, Number=list_length, Order=True)

# ---- group: LISTA POMIESZCZEN WEWNETRZNYCH
user_text_2 = UserText(Content=model_object_2, Keys="RHI_Lista pomieszczen wewnetrznych", UserTextMode=1)  # -> Content, Keys, Values
query_parameters_2 = QueryParameters(Name=":POM ?")  # -> flatten(Parameter)
text_split = TextSplit(Text=user_text_2.Values, Separators=";")
shortest_list = ShortestList(ListListA=text_split, ListListB=<missing>, TrimMode=2)  # -> ListListA, ListListB

# ---- group: PIETRO
user_text_3 = UserText(Content=model_object_2, Keys="PIG_Nr Piętra", UserTextMode=1)  # -> Content, Keys, Values
query_parameters_3 = QueryParameters(Name="Pietro")
panel_3 = Panel("""PIĘTRO 1
PIĘTRO 2
PIĘTRO 3
PIĘTRO 4""")
panel_4 = Panel("""I
II
III
IV""")
key_value_search = KeyValueSearch(Keys=panel_4, Values=panel_3, Search=user_text_3.Values)
list_length_2 = ListLength(List=key_value_search)
duplicate_data_2 = DuplicateData(Data=<missing>, Number=list_length_2, Order=True)

# ----
user_text_4 = UserText(Content=model_object_2, Keys="RHI_Lista pomieszczen zewnetrznych", UserTextMode=1)  # -> Content, Keys, Values
query_parameters_4 = QueryParameters(Name=":POM zew ?")  # -> flatten(Parameter)
text_split_2 = TextSplit(Text=user_text_4.Values, Separators=";")
shortest_list_2 = ShortestList(ListListA=text_split_2, ListListB=<missing>, TrimMode=2)  # -> ListListA, ListListB
parameter = Parameter(simplify(shortest_list_2.ListListB))
value = Data(simplify(shortest_list_2.ListListA))

user_text_5 = UserText(Content=model_object_2, Keys="RHI_Lista pomieszczen zewnetrznych Unique ID", UserTextMode=1)  # -> Content, Keys, Values
query_parameters_5 = QueryParameters(Name=":POM zew POW ?")  # -> flatten(Parameter)
text_split_3 = TextSplit(Text=user_text_5.Values, Separators=";")
query_element = QueryElement(Id=text_split_3)
spatial_element_identity = SpatialElementIdentity(SpatialElement=query_element)
shortest_list_3 = ShortestList(ListListA=text_split_3, ListListB=<missing>, TrimMode=2)  # -> ListListA, ListListB
division = Division(A=<missing>, B="10000")
round_to_decimal_place = RoundToDecimalPlace(NumberX=division, DecimalPlace=2, RoundType=0)  # -> Rounded, Difference
format = Format(Format="{0:0.00}", Culture=127, Data0=round_to_decimal_place.Rounded)
parameter_2 = Parameter(simplify(shortest_list_3.ListListB))
replace_text = ReplaceText(Text=format, Find=".", Replace=",", RecursiveReplace=False)
value_2 = Data(simplify(replace_text))

sheet = Sheet()
internalised_sheets = Sheet(sheet)

# ---- group: LISTA POMIESZCZEN WEWNETRZNYCH
parameter_3 = Parameter(simplify(shortest_list.ListListB))
value_3 = Data(simplify(shortest_list.ListListA))

# ---- group: PIETRO
parameter_4 = Parameter(simplify(duplicate_data_2))
value_4 = Data(simplify(key_value_search))

# ----
panel_5 = Panel(shortest_list.ListListA)
panel_6 = Panel(text_split_3)
list_length_3 = ListLength(List=value_3)  # -> flatten(Length)
create_set = CreateSet(List=list_length_3)  # -> Set, Map

# ---- group: PARAMETRY BEZ PRZEROBEK
parameter_5 = Parameter(simplify(duplicate_data))
value_5 = Data(simplify(list_item))

# ----
element = Element(internalised_sheets)
element_2 = Element(element)

# ---- group: POMIESZCZENIA WEWNETRZNE AREA
user_text_6 = UserText(Content=model_object_2, Keys="RHI_Lista pomieszczen wewnetrznych Unique ID", UserTextMode=1)  # -> Content, Keys, Values
query_parameters_6 = QueryParameters(Name=":POM POW ?")  # -> flatten(Parameter)
text_split_4 = TextSplit(Text=user_text_6.Values, Separators=";")
query_element_2 = QueryElement(Id=text_split_4)
spatial_element_identity_2 = SpatialElementIdentity(SpatialElement=query_element_2)
shortest_list_4 = ShortestList(ListListA=text_split_4, ListListB=<missing>, TrimMode=2)  # -> ListListA, ListListB
division_2 = Division(A=<missing>, B="10000")
round_to_decimal_place_2 = RoundToDecimalPlace(NumberX=division_2, DecimalPlace=2, RoundType=0)  # -> Rounded, Difference
format_2 = Format(Format="{0:0.00}", Culture=127, Data0=round_to_decimal_place_2.Rounded)
parameter_6 = Parameter(simplify(shortest_list_4.ListListB))

# ----
room = Room(query_element_2)
room_2 = Room(room)
replace_text_2 = ReplaceText(Text=format_2, Find=".", Replace=",", RecursiveReplace=False)

# ---- group: POMIESZCZENIA WEWNETRZNE AREA (continued)
value_6 = Data(simplify(replace_text_2))

# ----
panel_7 = Panel(parameter_6)

# ---- group: VALUES
merge = Merge(Data1=value_5, Data2=value_4, Data3=value_3, Data4=value_6, Data5=value, Data6=value_2)

# ---- group: PARAMETRY
merge_2 = Merge(Data1=parameter_5, Data2=parameter_4, Data3=parameter_3, Data4=parameter_6, Data5=parameter, Data6=parameter_2)

# ----
panel_8 = Panel(format_2)
panel_9 = Panel(merge)
value_7 = Data(merge)
parameter_7 = Parameter(merge_2)
parameter_8 = Parameter(parameter_7)
value_8 = Data(value_7)
panel_10 = Panel(parameter_7)
panel_11 = Panel(value_7)
