# Grasshopper definition karty_mieszkan.gh (Grasshopper 1.0.8)
# plug-ins: Heteroptera, PythonEmbeddedPlugin, MeshEdit Components, treesloth01, Pufferfish, Rhino.Inside for Autodesk Revit, GhVa30, Human, LunchBox, LadybugGrasshopper, Pancake, Wombat, Nautilus, Clipper2
# Uniwersalny skrypt do tworzenia kart mieszkan. Data scrapping z Revita do Rhino

query_rooms = QueryRooms(Placed=True)
room = Room(query_rooms)

# ---- group: MANKOWSKA
room_2 = Room(room)
inspect_element = InspectElement(Element=room_2)  # -> GeneralPIG_NrBudynku, GeneralPIG_NrKlatki, GeneralPIG_NrPiętra, GeneralPIG_NrLokalu, GeneralPIG_NrZbiorczy, GeneralPIG_NrKomercyjny
text = Text(inspect_element.GeneralPIG_NrBudynku)
text_2 = Text(inspect_element.GeneralPIG_NrKomercyjny)
text_3 = Text(inspect_element.GeneralPIG_NrLokalu)
text_4 = Text(inspect_element.GeneralPIG_NrZbiorczy)
text_5 = Text(inspect_element.GeneralPIG_NrZbiorczy)
clean_tree = CleanTree(RemoveNulls=True, RemoveInvalid=True, RemoveEmpty=True, Tree=text_5, SynchronousTree1=room_2)  # -> Tree, SynchronousTree1

# ---- group: LODZ
room_3 = Room(simplify(graft(room)))
inspect_element_2 = InspectElement(Element=room_3)
text_6 = Text(inspect_element_2)
clean_tree_2 = CleanTree(RemoveNulls=True, RemoveInvalid=True, RemoveEmpty=False, Tree=text_6)
panel = Panel(inspect_element_2)
text_split = TextSplit(Text=clean_tree_2, Separators=" ")  # -> simplify(Result)
tree_statistics = TreeStatistics(Tree=text_split)  # -> graft(Paths), Length, Count
list_length = ListLength(List=text_split)
equality = Equality(FirstNumber=list_length, SecondNumber="0")  # -> Equality, Inequality
dispatch = Dispatch(List=tree_statistics.Paths, DispatchPattern=equality.Inequality)  # -> ListA, ListB
split_tree = SplitTree(Data=text_split, Masks=flatten(dispatch.ListA))  # -> Positive, Negative
split_tree_2 = SplitTree(Data=room_3, Masks=flatten(dispatch.ListA))  # -> Positive, Negative
text_7 = Text(split_tree.Positive)
list_item = ListItem(List=text_7, Index="2", Wrap=True)
room_4 = Room(flatten(split_tree_2.Positive))
numer_mieszkania = Text(flatten(list_item))
sort_numbers_and_text = GhPythonScript(Keys=numer_mieszkania, Values=room_4)  # -> out, SortedKeys, SortedValues; inputs Keys: list, Values: list
# ---------- sort_numbers_and_text: Python ----------
"""Sorts a list of key strings containing numeric elements 
    (Strings contain none or more numeric characters, followed
    by none or more non-numeric characters).
    
    Inputs:
        Keys: A list of keys to be sorted. Keys need not be unique,
            but must not be longer than 2048 characters.
        Values: A list of associated values to be sorted using keys
    Output:
        SortedKeys: Keys sorted using an intelligent interpretation
        of numbers.
        SortedValues: Values reordered according to sorted Keys"""

__author__ = "Jeremy Swift"
__version__ = "2023.10.14"

import re

sentinel = "aaaaaaaaaaaaaaaa"

pattern = re.compile("(\d*)(\D*)")
ksplits = [pattern.match(k).groups() for k in Keys]
paddedNums = []
for i in range(len(Keys)):
    if not ksplits[i][0]:
        paddedNums.append(sentinel + ksplits[i][1].ljust(2048) + str(i).rjust(16))
    else:
        paddedNums.append(ksplits[i][0].rjust(16) + ksplits[i][1].ljust(2048) + str(i).rjust(16))

dic = dict(zip(paddedNums, range(len(Keys))))

SortedKeys = []
SortedValues = []
for k in sorted(paddedNums):
    i = dic[k]
    SortedKeys.append(Keys[i])
    SortedValues.append(Values[i])

if len(SortedKeys) != len(Keys):
    out = "Sort error (Value(s) probably not conforming to expected pattern)."
# ---------- end sort_numbers_and_text ----------
create_set = CreateSet(List=sort_numbers_and_text.SortedKeys)  # -> Set, Map
member_index = MemberIndex(Set=sort_numbers_and_text.SortedKeys, Member=create_set.Set)  # -> Index, Count
list_item_2 = ListItem(List=sort_numbers_and_text.SortedKeys, Index=member_index.Index, Wrap=True)
list_item_3 = ListItem(List=sort_numbers_and_text.SortedValues, Index=member_index.Index, Wrap=True)
create_set_2 = CreateSet(List=list_item_2)  # -> Set, Map
mieszkania_grouped = Room(simplify(list_item_3))  # disabled
nazwa_grupujaca_mieszkania = Text(simplify(create_set_2.Set))  # disabled

# ---- group: Scroll named Panels
panel_2 = Panel("""elo
320""")
python = GhPythonScript(Scroll=Slider(0, range=0..1), Panels=panel_2)  # inputs Panels: list
# ---------- python: Python ----------
""" Scroll named Panels. Author: Anders Holden Deleuran """

import Grasshopper as gh

for obj in ghenv.Component.OnPingDocument().Objects:
    if type(obj) is gh.Kernel.Special.GH_Panel and obj.NickName in Panels:
        obj.ScrollRatio = Scroll
        obj.ExpireSolution(True)
# ---------- end python ----------

# ----
final = Data(text_2)
initial = Data(text_4)
elo = Panel(initial)
_320 = Panel(final)

# ---- group: STWORZ LEVELE VISUAL ARQ W RHINO
spatial_element_identity = SpatialElementIdentity(SpatialElement=room_3)  # -> Location, Placed, Number, Name, Level
create_set_3 = CreateSet(List=flatten(spatial_element_identity.Level))  # -> Set, Map
level_identity = LevelIdentity(Level=create_set_3.Set)  # -> Name, Elevation
sort_list = SortList(Keys=level_identity.Elevation, ValuesValuesA=create_set_3.Set, ValuesA=level_identity.Name)  # -> Keys, ValuesValuesA, ValuesA
number = Number(sort_list.Keys)
list_item_4 = ListItem(List=sort_list.ValuesValuesA, Index=Slider(8, range=0..10), Wrap=True)
level = Level(Name=sort_list.ValuesA, Elevation=number, CutPlane=140, TopOffset=-35, BottomOffset=-5)
level_2 = Level(list_item_4)
level_3 = Level(level)
building = Building(Name="Budynek", Elevation=0, Levels=level_3)

# ---- group: MANKOWSKA / odrzuc puste
text_8 = Text(graft(clean_tree.Tree))
text_length = TextLength(Text=text_8)
room_5 = Room(graft(clean_tree.SynchronousTree1))
tree_statistics_2 = TreeStatistics(Tree=text_8)  # -> graft(Paths), Length, Count
equality_2 = Equality(FirstNumber=text_length, SecondNumber="0")  # -> Equality, Inequality
dispatch_2 = Dispatch(List=tree_statistics_2.Paths, DispatchPattern=equality_2.Inequality)  # -> ListA, ListB
split_tree_3 = SplitTree(Data=text_8, Masks=flatten(dispatch_2.ListA))  # -> Positive, Negative
split_tree_4 = SplitTree(Data=room_5, Masks=flatten(dispatch_2.ListA))  # -> Positive, Negative
room_6 = Room(flatten(split_tree_4.Positive))
text_9 = Text(flatten(split_tree_3.Positive))

# ----
number_slider = Slider(44, range=0..100)  # disabled
mieszkania_grouped_2 = Room(mieszkania_grouped)  # disabled
nazwa_grupujaca_mieszkania_2 = Text(nazwa_grupujaca_mieszkania)  # disabled
tree_statistics_3 = TreeStatistics(Tree=mieszkania_grouped_2)  # -> Paths, Length, Count; disabled
list_item_5 = ListItem(List=flatten(nazwa_grupujaca_mieszkania_2), Index=number_slider, Wrap=True)  # disabled
list_item_6 = ListItem(List=tree_statistics_3.Paths, Index=number_slider, Wrap=True)  # disabled
panel_3 = Panel(list_item_5)  # disabled
split_tree_5 = SplitTree(Data=mieszkania_grouped_2, Masks=flatten(list_item_6))  # -> Positive, Negative; disabled
spatial_element_boundary = SpatialElementBoundary(SpatialElement=split_tree_5.Positive, BoundaryLocation=0)  # -> Boundary, Segments, Elements; disabled
level_4 = Level(split_tree_5.Positive)  # disabled
list_item_7 = ListItem(List=level_4, Index=0, Wrap=True)  # disabled
category_filter = CategoryFilter(Categories=<geometry referenced from the Revit model>, Inverted=False)  # disabled
graphical_element = GraphicalElement(spatial_element_boundary.Elements)  # disabled
level_5 = Level(list_item_7)  # disabled
filter_elements = FilterElements(Elements=graphical_element, Filter=category_filter)  # disabled
number_slider_2 = Slider(0, range=0..1)  # disabled
level_identity_2 = LevelIdentity(Level=level_5)  # -> Name, Elevation, Structural, BuildingStory, PlanView; disabled
number_slider_3 = Slider(0, range=0..1)  # disabled
swatch = ColourSwatch(SwatchColor=RGB(187, 189, 255))  # disabled
dispatch_3 = Dispatch(List=graphical_element, DispatchPattern=filter_elements)  # -> ListA, ListB; disabled
floor_plan = FloorPlan(level_identity_2.PlanView)  # disabled
boolean_toggle = BooleanToggle(False)  # disabled
number_slider_4 = Slider(4, range=0.1..10)  # disabled
export_view_image = ExportViewImage(View=floor_plan, Overwrite=True)  # -> View, ImageFile, Outline, Texture; disabled
analyze_wall = AnalyzeWall(Wall=dispatch_3.ListA)  # -> WallSystemFamily, WallType, ParentStackedWall, BaseLevel, BaseLevelOffset, BottomIsAttached, TopLevel, TopLevelOffset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; disabled
open_view = OpenView(View=floor_plan, Open=boolean_toggle)  # -> View, Open; disabled
scale = Scale(Center=Point(0, 0, 0), Factor=number_slider_4)  # -> Geometry, Transform; disabled
path = FilePath(export_view_image.ImageFile)  # disabled
material = MaterialShiny(Colour=swatch, Reflection=number_slider_3, Smoothness=number_slider_2, filename=path, transform=scale.Transform)  # -> out, Mat; inputs Colour: Color, Reflection: Double, Smoothness: Double, filename: String, transform: Transform; disabled
# ---------- material: C# usings ----------
using System.Drawing;
# ---------- material: C# ----------
    Reflection = Math.Min(Math.Max(Reflection, 0), 1);
    Smoothness = Math.Min(Math.Max(Smoothness, 0), 1);
    Rhino.DocObjects.Material material = new  Rhino.DocObjects.Material();
    //material.SetBitmapTexture(fileName);
    material.ReflectionColor = Colour;
    material.DiffuseColor = Colour;
    material.AmbientColor = System.Drawing.Color.Black;
    material.EmissionColor = System.Drawing.Color.Black;
    material.Reflectivity = Reflection;
    material.ReflectionGlossiness = Smoothness;

    Rhino.DocObjects.Texture text = new Rhino.DocObjects.Texture();
    text.ApplyUvwTransform = true;
    text.UvwTransform = transform;
    text.FileName = filename;
    material.SetTexture(text, Rhino.DocObjects.TextureType.Diffuse);


    var renderMaterial = Rhino.Render.RenderMaterial.CreateBasicMaterial(material);
    Mat = new GH_Material(renderMaterial);
# ---------- end material ----------
surface = Surface(floor_plan)  # disabled
custom_preview = CustomPreview(Geometry=surface, Material=material.Mat)  # disabled

# ---- group: GENERAL QUERY OF ELEMENTS / QUERY DOORS METODA MARINA 1
query_categories = QueryCategories(Type=1, Name="Doors", IsVisibleUI=True, IsSubcategory=False)
query_types = QueryTypes(Kind=3, Category=query_categories, FamilyName="PIG_DOR_WOOD")
element_name = ElementName(Element=query_types)  # -> Element, Name
panel_4 = Panel("*enclosing*")
match_text = MatchText(Text=element_name.Name, Pattern="*internal*", Case=False)
dispatch_4 = Dispatch(List=element_name.Element, DispatchPattern=match_text)  # -> ListA, ListB
_3d_view = _3DView(<3d view referenced from the Revit model>)
type_filter = TypeFilter(Types=dispatch_4.ListA, Inverted=False)
visible_in_view_filter = VisibleInViewFilter(View=_3d_view, Inverted=False)
logical_and_filter = LogicalAndFilter(FilterA=type_filter, FilterB=visible_in_view_filter)
query_elements = QueryElements(Filter=type_filter, Limit="500")  # -> Elements, Count
query_elements_2 = QueryElements(Filter=logical_and_filter, Limit="500")  # -> Elements, Count
drzwiwyszukane = Element(query_elements.Elements)

# ---- group: GENERAL QUERY OF ELEMENTS
project_location = ProjectLocation()  # -> SiteLocation, SharedSite, SurveyPoint, ProjectBasePoint, InternalOrigin
plane = Plane(project_location.SurveyPoint)
plane_2 = Plane(project_location.InternalOrigin)
line = Line(StartPoint=plane, EndPoint=plane_2)
move = Move(Geometry=plane, Motion=line)  # -> Geometry, Transform
internal_origin = BasePoint(project_location.InternalOrigin)
revit_project_internal_origin_plane = Plane(internal_origin)

# ---- group: MANKOWSKA / posortuj
python_3_script = Python3Script(Keys=text_9, Values=room_6)  # -> out, SortedKeys, SortedValues; inputs Keys: list, Values: list; same code as sort_numbers_and_text

# ---- group: MANKOWSKA / odfiltruj
room_7 = Room(python_3_script.SortedValues)
text_10 = Text(python_3_script.SortedKeys)
match_text_2 = MatchText(Text=text_10, RegEx="^.\/", Case=True)
dispatch_5 = Dispatch(List=room_7, DispatchPattern=match_text_2)  # -> ListA, ListB
dispatch_6 = Dispatch(List=text_10, DispatchPattern=match_text_2)  # -> ListA, ListB
text_11 = Text(dispatch_6.ListA)
room_8 = Room(dispatch_5.ListA)

# ---- group: GENERAL QUERY OF ELEMENTS / QUERY DOORS METODA MARINA 2
graphical_element_2 = GraphicalElement(<familyinstance referenced from the Revit model>)
graphical_element_3 = GraphicalElement(<familyinstance referenced from the Revit model>)
graphical_element_4 = GraphicalElement(<familyinstance referenced from the Revit model>)
merge = Merge(Data1=graphical_element_4, Data2=graphical_element_2, Data3=graphical_element_3)
clean_tree_3 = CleanTree(RemoveNulls=True, RemoveInvalid=True, RemoveEmpty=False, Tree=merge)
element_type = ElementType(Element=clean_tree_3)  # -> Element, Type
type_filter_2 = TypeFilter(Types=element_type.Type, Inverted=False)
query_elements_3 = QueryElements(Filter=type_filter_2, Limit="1000")  # -> Elements, Count
graphical_element_5 = GraphicalElement(query_elements_3.Elements)

# ----
panel_5 = Panel(text_10)

# ---- group: GENERAL QUERY OF ELEMENTS
query_categories_2 = QueryCategories(Type=1, Name="Walls", IsVisibleUI=True, IsSubcategory=False)
category_filter_2 = CategoryFilter(Categories=query_categories_2, Inverted=False)
query_elements_4 = QueryElements(Filter=category_filter_2, Limit=Slider(5000, range=0..5000))  # -> Elements, Count
element_geometry = ElementGeometry(Elements=query_elements_4.Elements, DetailLevel=1)  # -> simplify(Geometry)
walls_geometry = Geometry(flatten(element_geometry))

plane_3 = Plane(move.Geometry)
plane_4 = Plane(plane_2)
deconstruct_plane = DeconstructPlane(Plane=plane_3)  # -> Origin, XAxis, YAxis, ZAxis
deconstruct_plane_2 = DeconstructPlane(Plane=plane_4)  # -> Origin, XAxis, YAxis, ZAxis
line_sdl = LineSDL(Start=deconstruct_plane_2.Origin, Direction=deconstruct_plane_2.XAxis, Length=25)
line_sdl_2 = LineSDL(Start=deconstruct_plane.Origin, Direction=deconstruct_plane.XAxis, Length=25)
panel_6 = Panel("RHI_rotacja (clockwise) wejscia do mieskzania wzgledem polnocy")
vector_display = VectorDisplay(Anchor=deconstruct_plane_2.Origin, Vector=line_sdl)
vector_display_2 = VectorDisplay(Anchor=deconstruct_plane.Origin, Vector=line_sdl_2)
xy_plane = XYPlane(Origin=Point(0, 0, 0))
vector_polnocy = Vector(line_sdl)
angle = Angle(VectorA=line_sdl_2, VectorB=vector_polnocy, Plane=xy_plane)  # -> Angle, Reflex
degrees = Degrees(Radians=angle.Angle)
user_text = UserText(Keys=panel_6, Values=degrees, UserTextMode=1)  # -> Content, Keys, Values
panel_7 = Panel(degrees)

# ---- group: MANKOWSKA / zgrupuj
text_12 = Text(text_11)
room_9 = Room(room_8)
create_set_4 = CreateSet(List=text_12)  # -> Set, Map
member_index_2 = MemberIndex(Set=text_12, Member=create_set_4.Set)  # -> Index, Count
list_item_8 = ListItem(List=room_9, Index=member_index_2.Index, Wrap=True)
list_item_9 = ListItem(List=text_12, Index=member_index_2.Index, Wrap=True)
mieszkaniagrouped = Room(simplify(list_item_8))
nazwa_grupujaca_mieszkania_3 = Text(simplify(list_item_9))

# ---- group: PREVIEW
group_wrapper = GroupWrapper(
    AutoJumpToLocation=False,
    AutoWidth=False,
    ColumnRowsSpacing=50,
    CurrentState="Wrapped",
    CustomColor=RGB(255, 255, 255),
    CustomUnwrapLocationX=4633.5,
    CustomUnwrapLocationY=1557.5,
    CustomWrapLocationX=3005,
    CustomWrapLocationY=1390.878906,
    InheritGroupColor=True,
    LeftColumnOffset=250,
    LeftComponentGuid_0=mieszkania_grouped_3,
    OffsetGuid_0=list_item_10,
    OffsetGuid_1=tree_statistics_4,
    OffsetGuid_2=list_length_2,
    OffsetGuid_3=random_color,
    OffsetGuid_4=series,
    OffsetGuid_5=custom_preview_2,
    OffsetGuid_6=room_10,
    OffsetX_0=-249,
    OffsetX_1=-158,
    OffsetX_2=-59,
    OffsetX_3=145,
    OffsetX_4=39,
    OffsetX_5=273,
    OffsetX_6=-166.4941406,
    OffsetX_7=-5.9765625,
    OffsetY_0=-27.0881958,
    OffsetY_1=2.911804199,
    OffsetY_2=-17.0881958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)
list_item_10 = ListItem(List=room_7, Index=member_index_2.Index, Wrap=True)
tree_statistics_4 = TreeStatistics(Tree=list_item_10)  # -> Paths, Length, Count
list_length_2 = ListLength(List=tree_statistics_4.Paths)
series = Series(Start=0, Step=1, Count=list_length_2)
random_color = RandomColor(Data=series, Seed=2, FastMode=False)  # -> graft(Colors)
room_10 = Room(list_item_10)
custom_preview_2 = CustomPreview(Geometry=room_10, Material=random_color)

# ---- group: FILTR ROBOCZY - OGRANICZENIE ZAKRESU
# SET TO TRUE AFTER GH OPEN!
lb_falsestarttoggle = LBFalseStartToggle(False)

# INFO: ograniczenie zakresu w celach roboczych
value_list = ValueList({"Filtr roboczy": 1, "Wszystko": 0}, selected="Wszystko")
p_size = Slider(20, range=0..50)
tree_number = Slider(0, range=0..50)
ogranicz_zakres = OgraniczZakres(gate=value_list, data=nazwa_grupujaca_mieszkania_3, partition_size=p_size, tree_number=tree_number)
ogranicz_zakres_2 = OgraniczZakres(gate=value_list, data=mieszkaniagrouped, partition_size=p_size, tree_number=tree_number)
stream_gate = StreamGate(Stream=ogranicz_zakres_2, Gate=lb_falsestarttoggle)  # -> Target0, Target1
stream_gate_2 = StreamGate(Stream=ogranicz_zakres, Gate=lb_falsestarttoggle)  # -> Target0, Target1
nazwa_grupujaca_mieszkania_4 = Text(simplify(stream_gate_2.Target1))
mieszkaniagrouped_2 = Room(simplify(stream_gate.Target1))

# ---- group: POMIESZCZENIA
mieszkaniagrouped_3 = Room(mieszkaniagrouped_2)
group_wrapper_2 = GroupWrapper(
    AutoJumpToLocation=False,
    AutoWidth=False,
    ColumnRowsSpacing=50,
    CurrentState="Wrapped",
    CustomColor=RGB(255, 255, 255),
    CustomUnwrapLocationX=4633.5,
    CustomUnwrapLocationY=1557.5,
    CustomWrapLocationX=3005,
    CustomWrapLocationY=1390.878906,
    InheritGroupColor=False,
    LeftColumnOffset=150,
    LeftComponentGuid_0=mieszkaniagrouped_3,
    OffsetGuid_0=mieszkaniagrouped_3,
    OffsetGuid_1=mieszkaniagrouped_cleaned,
    OffsetGuid_10=merge_2,
    OffsetGuid_11=clean_tree_4,
    OffsetGuid_13=infopanel,
    OffsetGuid_2=python_3_script_2,
    OffsetGuid_3=element_parameter,
    OffsetGuid_4=query_parameters,
    OffsetGuid_5=panel_8,
    OffsetGuid_6=text_13,
    OffsetGuid_7=room_11,
    OffsetGuid_8=null_item,
    OffsetGuid_9=dispatch_7,
    OffsetX_0=-467.6462402,
    OffsetX_1=647.0795898,
    OffsetX_10=451,
    OffsetX_11=538,
    OffsetX_12=-562.9482422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)
panel_8 = Panel(":PIG_Nr Pom")
query_parameters = QueryParameters(Name=panel_8)
element_parameter = ElementParameter(Element=mieszkaniagrouped_3, Parameter=query_parameters)  # -> Element, Value
text_13 = Text(element_parameter.Value)
python_3_script_2 = Python3Script(Keys=text_13, Values=mieszkaniagrouped_3)  # -> out, SortedKeys, SortedValues; inputs Keys: list, Values: list; same code as sort_numbers_and_text
room_11 = Room(python_3_script_2.SortedValues)
null_item = NullItem(Item=room_11)  # -> NullFlags, InvalidFlags, Description
dispatch_7 = Dispatch(List=mieszkaniagrouped_3, DispatchPattern=null_item.NullFlags)  # -> ListA, ListB
merge_2 = Merge(Data1=dispatch_7.ListA, Data2=room_11)
clean_tree_4 = CleanTree(RemoveNulls=True, RemoveInvalid=True, RemoveEmpty=False, Tree=merge_2)
mieszkaniagrouped_cleaned = Room(simplify(clean_tree_4))

# ----
kolejnosc = Panel("""1
2
3
4
5
6
7
8
9
10
11""")  # disabled
nazwy_pomieszczen = Panel("""Pokój 1
Pokój 2
Pokój 3
Pokój 4
Pokój 5
Łazienka
Łazienka 1
Łazienka 2
Przedpokój
Korytarz
WC""")  # disabled

# ---- group: LODZ CUSTOM CUSTOM SORT
custom_room_sort = CustomRoomSort(nazwy_pomieszczen=nazwy_pomieszczen, kolejnosc=kolejnosc, room=mieszkaniagrouped_2)  # disabled
rooms_grouped_custom_sort = Room(custom_room_sort)  # disabled

# ----
mieszkaniagrouped_cleaned_2 = Room(mieszkaniagrouped_cleaned)
element_geometry_2 = ElementGeometry(Elements=mieszkaniagrouped_cleaned_2, DetailLevel=1)
shift_paths = ShiftPaths(Data=element_geometry_2, Offset=Slider(-2, range=-3..3))
room_brep = Brep(shift_paths)

# ---- group: ROZNE LEVELE
group_wrapper_3 = GroupWrapper(
    AutoJumpToLocation=False,
    AutoWidth=False,
    ColumnRowsSpacing=50,
    CurrentState="Wrapped",
    CustomColor=RGB(255, 255, 255),
    CustomUnwrapLocationX=4692,
    CustomUnwrapLocationY=4089.5,
    CustomWrapLocationX=4460,
    CustomWrapLocationY=1691.297729,
    InheritGroupColor=False,
    LeftColumnOffset=150,
    LeftComponentGuid_0=mieszkania_grouped_3,
    OffsetGuid_0=mieszkania_grouped_3,
    OffsetGuid_1=floor_plan_5,
    OffsetGuid_10=larger_than,
    OffsetGuid_11=panel_30,
    OffsetGuid_12=tree_statistics_5,
    OffsetGuid_13=dispatch_11,
    OffsetGuid_14=split_tree_6,
    OffsetGuid_15=mieszkania_grouped_5,
    OffsetGuid_16=spatial_element_identity_3,
    OffsetGuid_17=level_10,
    OffsetGuid_18=spatial_element_identity_4,
    OffsetGuid_19=replace_items,
    OffsetGuid_2=level_11,
    OffsetGuid_20=panel_31,
    OffsetGuid_21=list_indices,
    OffsetGuid_22=list_item_11,
    OffsetGuid_23=create_set_7,
    OffsetGuid_24=merge_4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)

# ----
graphical_element_6 = GraphicalElement(<annotationsymbol referenced from the Revit model>)  # disabled
element_location = ElementLocation(Element=graphical_element_6)  # -> Element, Location, Hand, Facing, WorkPlane; disabled
number_slider_5 = Slider(4.25, range=0..10)  # disabled
xy_plane_2 = XYPlane(Origin=element_location.Location)  # disabled
element_location_2 = ElementLocation(Element=graphical_element_6, Location=xy_plane_2)  # -> Element, Location, Hand, Facing, WorkPlane; disabled
rotate = Rotate(Geometry=xy_plane_2, Angle=degrees(number_slider_5), Plane=xy_plane_2)  # -> Geometry, Transform; disabled
plane_5 = Plane(xy_plane_2)  # disabled
number_slider_6 = Slider(270, range=0..360)  # disabled
rotate_2 = Rotate(Geometry=rotate.Geometry, Angle=degrees(number_slider_6), Plane=rotate.Geometry)  # -> Geometry, Transform; disabled
merge_3 = Merge(Data1=rotate.Transform, Data2=rotate_2.Transform)  # disabled
compound = Compound(Transforms=merge_3)  # disabled
transform = Transform(Geometry=plane_5, Transform=compound)  # disabled
element_location_3 = ElementLocation(Element=element_location_2.Element, Location=transform)  # -> Element, Location, Hand, Facing, WorkPlane; disabled

panel_9 = Panel("""kot
panda
pies
kot
kot
orka
zuraw
kot""")
panel_10 = Panel("""pies
kot
panda
pies
kot
kot
orka""")
panel_11 = Panel("""pies
kot
chomik""")
panel_12 = Panel("""kot
panda
pies
kot
kot
orka
zuraw
kot""")
panel_13 = Panel("""pies
kot
panda
pies
kot
kot
orka""")
entwine = Entwine(Branch00=panel_10, Branch01=panel_9, FlattenInputs=True)
panel_14 = Panel("""pies
kot
chomik""")
entwine_2 = Entwine(Branch00=panel_13, Branch01=panel_12, FlattenInputs=True)
data = Data(panel_11)
data_2 = Data()
data_3 = Data(flatten(data))
data_4 = Data(flatten(data_2))
set_intersection = SetIntersection(SetA=panel_11, SetB=panel_12)
match_text_3 = MatchText(Text=graft(data_4), Case=True)
set_difference = SetDifference(SetA=entwine_2, SetB=data)
match_text_4 = MatchText(Text=graft(data_3), Pattern=entwine_2, Case=True)
mass_addition = MassAddition(Input=match_text_3)  # -> Result, PartialResults
mass_addition_2 = MassAddition(Input=match_text_4)  # -> Result, PartialResults
panel_15 = Panel(set_intersection)
boolean = Boolean(flatten(mass_addition.Result))
boolean_2 = Boolean(flatten(mass_addition_2.Result))
unflatten_tree = UnflattenTree(Tree=boolean, Guide=data_2)
unflatten_tree_2 = UnflattenTree(Tree=boolean_2, Guide=data)
dispatch_8 = Dispatch(List=data_2, DispatchPattern=unflatten_tree)  # -> ListA, ListB
panel_16 = Panel(data_3)
panel_17 = Panel(dispatch_8.ListA)
panel_18 = Panel(match_text_4)
panel_19 = Panel(mass_addition_2.Result)
panel_20 = Panel(data_4)
panel_21 = Panel(data)
panel_22 = Panel(match_text_3)
panel_23 = Panel(unflatten_tree_2)
panel_24 = Panel(mass_addition.Result)
panel_25 = Panel(data_2)
panel_26 = Panel(unflatten_tree)

# ---- group: GENERAL QUERY OF ELEMENTS
# INFO: okna do stworzenia obrysow mieszkan
panel_27 = Panel("Windows")
query_categories_3 = QueryCategories(Type=1, Name=panel_27, IsVisibleUI=True, IsSubcategory=False)
category_filter_3 = CategoryFilter(Categories=query_categories_3, Inverted=False)
query_elements_5 = QueryElements(Filter=category_filter_3, Limit=Slider(5000, range=0..5000))  # -> Elements, Count

# ---- group: GENERAL QUERY OF ELEMENTS / exclude
query_types_2 = QueryTypes(Kind=3, Category=query_categories_3)
match_text_5 = MatchText(Text=query_types_2, Pattern="*Otwór*", Case=True)
dispatch_9 = Dispatch(List=query_types_2, DispatchPattern=match_text_5)  # -> ListA, ListB
type_filter_3 = TypeFilter(Types=dispatch_9.ListA, Inverted=False)

# ---- group: GENERAL QUERY OF ELEMENTS (continued)
filter_elements_2 = FilterElements(Elements=query_elements_5.Elements, Filter=type_filter_3)
dispatch_10 = Dispatch(List=query_elements_5.Elements, DispatchPattern=filter_elements_2)  # -> ListA, ListB
windows_unordered_query = Element(dispatch_10.ListB)

# ---- group: ROZNE LEVELE
mieszkania_grouped_3 = Room(mieszkaniagrouped_2)
spatial_element_identity_2 = SpatialElementIdentity(SpatialElement=mieszkania_grouped_3)
level_6 = Level(flatten(spatial_element_identity_2))
create_set_5 = CreateSet(List=level_6)  # -> Set, Map
level_7 = Level(spatial_element_identity_2)
mieszkania_grouped_4 = Room(mieszkania_grouped_3)
level_set = Level(create_set_5.Set)
level_identity_3 = LevelIdentity(Level=level_set)  # -> Name, Elevation, PlanView
level_8 = Level(flatten(level_set))
panel_28 = Panel(" - START")
concatenate = Concatenate(FragmentA=level_identity_3.Name, FragmentB=panel_28)
panel_29 = Panel(concatenate)

# ---- group: ROZNE LEVELE / QUERY LEVELS JESLI ISTNIEJA LUB STWORZ LVL
level_name_extension = Text(concatenate)
query_views = QueryViews(ViewName=graft(level_name_extension), IsDependent=False, IsTemplate=False)  # -> flatten(Views)
list_length_3 = ListLength(List=level_name_extension)
list_length_4 = ListLength(List=query_views)
equality_3 = Equality(FirstNumber=list_length_3, SecondNumber=list_length_4)  # -> Equality, Inequality
stream_gate_3 = StreamGate(Stream=level_name_extension, Gate=equality_3.Equality)  # -> Target0, Target1
level_set_2 = Level(create_set_5.Set)
add_floor_plan = AddFloorPlan(Level=level_set_2, Name=stream_gate_3.Target0, FailureProcessingMode=1)
stream_filter = StreamFilter(Gate=equality_3.Equality, Stream0=add_floor_plan, Stream1=query_views)

# ---- group: ROZNE LEVELE (continued)
floor_plan_2 = FloorPlan(stream_filter)

# ---- group: ROZNE LEVELE / PICK CORRESPONDING LEVELS
level_9 = Level(level_8)
floor_plan_3 = FloorPlan(floor_plan_2)
mieszkania_grouped_5 = Room(mieszkania_grouped_4)
level_10 = Level(level_7)
key_value_search = KeyValueSearch(Keys=level_9, Values=floor_plan_3, Search=level_10)
floor_plan_4 = FloorPlan(key_value_search)
create_set_6 = CreateSet(List=floor_plan_4)  # -> Set, Map
list_length_5 = ListLength(List=create_set_6.Set)
tree_statistics_5 = TreeStatistics(Tree=list_length_5)  # -> Paths, Length, Count
panel_30 = Panel("1")
larger_than = LargerThan(FirstNumber=list_length_5, SecondNumber=panel_30)  # -> LargerThan, OrEqualTo
dispatch_11 = Dispatch(List=tree_statistics_5.Paths, DispatchPattern=flatten(larger_than.LargerThan))  # -> ListA, ListB
floor_plan_5 = FloorPlan(floor_plan_4)
level_11 = Level(mieszkania_grouped_5)

split_tree_6 = SplitTree(Data=mieszkania_grouped_5, Masks=flatten(dispatch_11.ListA))  # -> Positive, Negative

room_12 = Room(split_tree_6.Positive)
spatial_element_identity_3 = SpatialElementIdentity(SpatialElement=room_12)
list_indices = ListIndices(List=spatial_element_identity_3)
panel_31 = Panel(" < multiple >")
replace_items = ReplaceItems(List=spatial_element_identity_3, Item=panel_31, Indices=list_indices, Wrap=False)
list_item_11 = ListItem(List=replace_items, Index=0, Wrap=True)
shift_paths_2 = ShiftPaths(Data=list_item_11, Offset=-1)

room_13 = Room(split_tree_6.Negative)
spatial_element_identity_4 = SpatialElementIdentity(SpatialElement=room_13)
create_set_7 = CreateSet(List=spatial_element_identity_4)  # -> Set, Map

merge_4 = Merge(Data1=shift_paths_2, Data2=create_set_7.Set)
flat_level = Text(merge_4)

split_tree_7 = SplitTree(Data=floor_plan_4, Masks=flatten(dispatch_11.ListA))  # -> Positive, Negative

floor_plan_6 = FloorPlan(split_tree_7.Negative)
create_set_8 = CreateSet(List=floor_plan_6)  # -> Set, Map

floor_plan_7 = FloorPlan(split_tree_7.Positive)
list_indices_2 = ListIndices(List=floor_plan_7)
panel_32 = Panel(" < multiple >")
replace_items_2 = ReplaceItems(List=floor_plan_7, Item=panel_32, Indices=list_indices_2, Wrap=False)
list_item_12 = ListItem(List=replace_items_2, Index=0, Wrap=True)
shift_paths_3 = ShiftPaths(Data=list_item_12, Offset=-1)

merge_5 = Merge(Data1=shift_paths_3, Data2=create_set_8.Set)
flat_floor_plan = Text(merge_5)

# ---- group: TWORZENIE GEOMETRII ROZNYCH
mieszkaniagrouped_cleaned_3 = Room(mieszkaniagrouped_cleaned)
room_brep_2 = Brep(room_brep)
nazwa_grupujaca_mieszkania_5 = Text(nazwa_grupujaca_mieszkania_4)
walls_geometry_2 = Geometry(walls_geometry)
windows_unordered_query_2 = Element(windows_unordered_query)
group_wrapper_4 = GroupWrapper(
    AutoJumpToLocation=False,
    AutoWidth=False,
    ColumnRowsSpacing=50,
    CurrentState="Wrapped",
    CustomColor=RGB(255, 255, 255),
    CustomUnwrapLocationX=3854.141357,
    CustomUnwrapLocationY=4086.858643,
    CustomWrapLocationX=5637.141113,
    CustomWrapLocationY=1878,
    InheritGroupColor=False,
    LeftColumnOffset=250,
    LeftComponentGuid_0=nazwa_grupujaca_mieszkania_5,
    LeftComponentGuid_1=room_brep_2,
    LeftComponentGuid_10=drzwiwyszukane_2,
    LeftComponentGuid_2=mieszkaniagrouped_cleaned_3,
    LeftComponentGuid_6=windows_unordered_query_2,
    LeftComponentGuid_8=walls_geometry_2,
    OffsetGuid_10=walls_geometry_2,
    OffsetGuid_100=construct_domain,
    OffsetGuid_101=number_slider_11,
    OffsetGuid_102=construct_domain_2,
    OffsetGuid_103=region_union_7,
    OffsetGuid_104=merge_7,
    OffsetGuid_105=colour_per_flat_4,
    OffsetGuid_106=crop_region,
    OffsetGuid_107=drzwiwyszukane_geofiltered_4,
    OffsetGuid_108=curve_18,
    OffsetGuid_11=windows_unordered_query_2,
    OffsetGuid_110=curve_2,
    OffsetGuid_111=panel_44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)

_3d_convex_hull = _3DConvexHull(SplitPoints=False, Tolerance=0.1)  # disabled
nazwa_grupujaca_mieszkania_6 = Text(nazwa_grupujaca_mieszkania_5)
room_brep_3 = Brep(room_brep_2)
mesh_brep = MeshBrep(
    Brep=room_brep_3,
    Settings={GridMaxCount=0, GridMinCount=16, JaggedSeams=False, MaxEdgeLength=0, MinEdgeLength=0.0001, MinTolerance=0, Refine=True, RefineAngle=0, RelativeTolerance=0.65, SimplePlanes=True, Tolerance=0})
mesh_join = MeshJoin(Meshes=mesh_brep)
deconstruct_mesh = DeconstructMesh(Mesh=mesh_join)  # -> Vertices, Faces, Colours, Normals
_3d_convexhull = _3DConvexHull(Points=deconstruct_mesh.Vertices)

# ---- group: TWORZENIE GEOMETRII ROZNYCH / MIESZKANIE NAME ANNOTATION DOT
mesh_volume = MeshVolume(Mesh=_3d_convexhull)  # -> Volume, Centroid
create_set_9 = CreateSet(List=nazwa_grupujaca_mieszkania_6)  # -> Set, Map
annotation_dot = AnnotationDot(Location=mesh_volume.Centroid, PrimaryText=create_set_9.Set)  # -> AnnotationDot, Location, PrimaryText, TextHeight
panel_33 = Panel("INFO::Dot")
query_or_create_layer = QueryOrCreateLayer(layer_path=panel_33)
model_object = ModelObject(Object=annotation_dot.AnnotationDot, Layer=query_or_create_layer)  # -> simplify(Object)
dot = ModelObject(model_object)

# ---- group: TWORZENIE GEOMETRII ROZNYCH / 3D CONVEX HULL
mesh = Mesh(_3d_convexhull)
panel_34 = Panel("INFO::Convex Hull")
query_or_create_layer_2 = QueryOrCreateLayer(layer_path=panel_34)
model_object_2 = ModelObject(Object=mesh, Layer=query_or_create_layer_2)  # -> simplify(Object)
convex_hull = ModelObject(model_object_2)

# ---- group: TWORZENIE GEOMETRII ROZNYCH / RANDOM COLOR
nazwa_grupujaca_mieszkania_7 = Text(nazwa_grupujaca_mieszkania_5)
tree_statistics_6 = TreeStatistics(Tree=nazwa_grupujaca_mieszkania_7)  # -> Paths, Length, Count
random_color_2 = RandomColor(Data=tree_statistics_6.Paths, Seed=2, FastMode=False)  # -> simplify(graft(Colors))

# ---- group: TWORZENIE GEOMETRII ROZNYCH (continued)
colour_per_flat = Colour(random_color_2)

# ---- group: TWORZENIE GEOMETRII ROZNYCH / ROOM AREA SURFACES
drzwiwyszukane_2 = Element(drzwiwyszukane)
room_14 = Room(mieszkaniagrouped_cleaned_3)
spatial_element_boundary_2 = SpatialElementBoundary(SpatialElement=room_14, BoundaryLocation=0)
inspect_element_3 = InspectElement(Element=room_14)
close_curve = CloseCurve(Curve=spatial_element_boundary_2, CloseType=0, Bulge=0.5, Tolerance=0)  # -> Closed, ReBo
colour_per_flat_2 = Colour(colour_per_flat)
display_attributes = DisplayAttributes(DisplayColour=colour_per_flat_2)  # -> Display, DisplayColour, DisplayMode
room_name = Text(inspect_element_3)
curve = Curve(close_curve.Closed)
boundary_surfaces = BoundarySurfaces(Edges=curve)
panel_35 = Panel("Rooms geometry::Surfaces")
query_or_create_layer_3 = QueryOrCreateLayer(layer_path=panel_35)
panel_36 = Panel(query_or_create_layer_3)
panel_37 = Panel("1")
shift_to_depth_native_cluster = ShiftToDepthNativeCluster(data=boundary_surfaces, depth=panel_37)
model_object_3 = ModelObject(Object=shift_to_depth_native_cluster, Name=room_name, Layer=query_or_create_layer_3, Display=display_attributes.Display)  # -> simplify(Object), Geometry, Name, Layer, Visibility, Display, Drafting, Render
room_area_geometry = ModelObject(model_object_3.Object)
colour_per_flat_3 = Colour(colour_per_flat)

# ---- group: TWORZENIE GEOMETRII ROZNYCH / ROOM BREP
room_brep_4 = Brep(room_brep_2)
room_15 = Room(mieszkaniagrouped_cleaned_3)
spatial_element_identity_5 = SpatialElementIdentity(SpatialElement=room_15)
random_colour = Colour(colour_per_flat)
display_colour = DisplayColour(Source=1, Colour=random_colour)  # -> DisplayColour, Source, Colour
display_attributes_2 = DisplayAttributes(DisplayColour=display_colour.DisplayColour)
panel_38 = Panel("Number")
panel_39 = Panel("Rooms geometry::Brep")
query_or_create_layer_4 = QueryOrCreateLayer(layer_path=panel_39)
model_object_4 = ModelObject(Geometry=room_brep_4, Layer=query_or_create_layer_4, Display=display_attributes_2)  # -> simplify(Object)
user_text_2 = UserText(Content=graft(model_object_4), Keys=panel_38, Values=simplify(graft(spatial_element_identity_5)), UserTextMode=1)  # -> Content, Keys, Values
panel_40 = Panel("1")
shift_to_depth_native_cluster_2 = ShiftToDepthNativeCluster(data=user_text_2.Content, depth=panel_40)
room_brep_5 = ModelObject(shift_to_depth_native_cluster_2)

# ---- group: TWORZENIE GEOMETRII ROZNYCH / ROOM AREA SURFACES
room_boundaries = Curve(curve)
walls_geometry_3 = Geometry(walls_geometry_2)
element = Element(windows_unordered_query_2)

# ----
deconstruct_mesh_2 = DeconstructMesh(Mesh=mesh_join)  # -> Vertices, Faces, Colours, Normals
list_length_6 = ListLength(List=deconstruct_mesh_2.Vertices)
smaller_than = SmallerThan(FirstNumber=list_length_6, SecondNumber="4")  # -> SmallerThan, OrEqualTo
dispatch_12 = Dispatch(List=mesh_join, DispatchPattern=smaller_than.SmallerThan)  # -> ListA, ListB
panel_41 = Panel(dispatch_12.ListA)

# ---- group: TWORZENIE GEOMETRII ROZNYCH / ROOM AREA SURFACES
colour_per_flat_4 = Colour(colour_per_flat)
display_attributes_3 = DisplayAttributes(DisplayColour=colour_per_flat_4)  # -> graft(Display), DisplayColour, DisplayMode
panel_42 = Panel("Rooms geometry::Crop Region")
query_or_create_layer_5 = QueryOrCreateLayer(layer_path=panel_42)
panel_43 = Panel("kontur")
query_model_linetypes = QueryModelLinetypes(Name=panel_43, AutoUpdateState=True)
drafting_attributes = DraftingAttributes(Linetype=query_model_linetypes)  # -> Drafting, Linetype, LinetypeScale

colour_per_flat_5 = Colour(colour_per_flat)

# ---- group: TWORZENIE GEOMETRII ROZNYCH / ROOM AREA SURFACES / CROP - METODA 1
curve_2 = Curve(curve)
number_slider_7 = Slider(3, range=0..10)
colour_swatch = ColourSwatch(SwatchColor=RGB(255, 255, 255))
number_slider_8 = Slider(6, range=-100..1000)
number_slider_9 = Slider(56, range=-200..2000)
panel_44 = Panel("1")
shift_to_depth_native_cluster_3 = ShiftToDepthNativeCluster(data=curve_2, depth=panel_44)

# ---- group: TWORZENIE GEOMETRII ROZNYCH
curve_3 = Curve(shift_to_depth_native_cluster_3)
explode = Explode(Curve=curve_3, Recursive=True)  # -> Segments, Vertices
rebuild_curve = RebuildCurve(Curve=explode.Segments, Degree=1, Count=10, Tangents=False)
join_curves = JoinCurves(Curves=rebuild_curve, Preserve=False)
shift_paths_4 = ShiftPaths(Data=join_curves, Offset=-2)
curve_4 = Curve(shift_paths_4)

# ---- group: TWORZENIE GEOMETRII ROZNYCH / ROOM AREA SURFACES / CROP - METODA 1 (continued)
bounding_rectangle = BoundingRectangle(Geometry=curve_4, Plane=PlaneXY(0, 0, 0), Axis=0, Slide=0, Union=True)  # -> Bounding, DimensionX, DimensionY
clipper2_offset = Clipper2Offset(Polylines=curve_4, Distance=number_slider_9, JoinType=0, EndType=0, MiterLimit=2, Precision=4)  # -> Holes, Outer, ClipperPaths
region_union = RegionUnion(Curves=clipper2_offset.Outer)
clipper2_offset_2 = Clipper2Offset(Polylines=region_union, Distance=number_slider_8, JoinType=0, EndType=0, MiterLimit=2, Precision=4)  # -> Holes, Outer, ClipperPaths
area = Area(Geometry=bounding_rectangle.Bounding)
plane_6 = Plane(area)
project = Project(Geometry=clipper2_offset_2.Holes, Plane=plane_6)  # -> Geometry, Transform
curve_5 = Curve(simplify(project.Geometry))
custom_preview_lineweights = CustomPreviewLineweights(Geometry=curve_5, Shader=colour_swatch, Thickness=number_slider_7, Absolute=False)
area_2 = Area(Geometry=curve_5)  # -> Area, Centroid
sort_list_2 = SortList(Keys=area_2.Area, ValuesValuesA=curve_5)  # -> Keys, ValuesValuesA
list_item_13 = ListItem(List=sort_list_2.ValuesValuesA, Index=0, Wrap=True)
crop_region = Curve(list_item_13)

# ---- group: TWORZENIE GEOMETRII ROZNYCH / ROOM AREA SURFACES / ENTRANCE DOOR PLANES
drzwiwyszukane_3 = GraphicalElement(drzwiwyszukane_2)
crop_region_2 = Curve(crop_region)
filtrowanie_drzwi_i_przypisanie_do_miesz = FILTROWANIEDRZWIIPRZYPISANIEDOMIESZKANIA(crop_region=crop_region_2, drzwiwyszukane=drzwiwyszukane_3)  # -> plane_drzwiwyszukane_geofiltered_2, drzwiwyszukane_geofiltered_4; "FILTROWANIE DRZWI I PRZYPISANIE DO MIESZKANIA"
drzwiwyszukane_geofiltered = GraphicalElement(filtrowanie_drzwi_i_przypisanie_do_miesz.drzwiwyszukane_geofiltered_4)
drzwiwyszukane_geofiltered_2 = Plane(filtrowanie_drzwi_i_przypisanie_do_miesz.plane_drzwiwyszukane_geofiltered_2)
drzwiwyszukane_geofiltered_3 = Plane(drzwiwyszukane_geofiltered_2)
panel_45 = Panel("INFO::Entrance Door Planes")
query_or_create_layer_6 = QueryOrCreateLayer(layer_path=panel_45)
model_object_5 = ModelObject(Object=drzwiwyszukane_geofiltered_2, Layer=query_or_create_layer_6)  # -> simplify(Object)
door_planes = ModelObject(model_object_5)

# ---- group: TWORZENIE GEOMETRII ROZNYCH / ROOM AREA SURFACES
drzwiwyszukane_geofiltered_4 = Plane(drzwiwyszukane_geofiltered_3)
number_slider_10 = Slider(40, range=0..400)
construct_domain = ConstructDomain(DomainStart=expr("(x/2)*(-1)", number_slider_10), DomainEnd=expr("(x/2)", number_slider_10))
number_slider_11 = Slider(120, range=0..200)
construct_domain_2 = ConstructDomain(DomainStart=expr("(x/2)*(-1)", number_slider_11), DomainEnd=expr("(x/2)", number_slider_11))
rectangle = Rectangle(Plane=drzwiwyszukane_geofiltered_4, XSize=construct_domain, YSize=construct_domain_2, Radius=0)  # -> Rectangle, Length
pole_wokol_drzwi = Curve(rectangle.Rectangle)

drzwiwyszukane_geofiltered_5 = Plane(drzwiwyszukane_geofiltered_3)

# ---- group: TWORZENIE GEOMETRII ROZNYCH / ROOM AREA SURFACES / CROP - METODA 1
room_boundaries_2 = Curve(room_boundaries)
number_slider_12 = Slider(3, range=0..10)
colour_swatch_2 = ColourSwatch(SwatchColor=RGB(255, 255, 255))
number_slider_13 = Slider(6, range=-100..1000)
number_slider_14 = Slider(56, range=-200..2000)
panel_46 = Panel("1")
shift_to_depth_native_cluster_4 = ShiftToDepthNativeCluster(data=room_boundaries_2, depth=panel_46)
curve_6 = Curve(shift_to_depth_native_cluster_4)
bounding_rectangle_2 = BoundingRectangle(Geometry=curve_6, Plane=PlaneXY(0, 0, 0), Axis=0, Slide=0, Union=True)  # -> Bounding, DimensionX, DimensionY
area_3 = Area(Geometry=bounding_rectangle_2.Bounding)
plane_7 = Plane(area_3)

# ---- group: TWORZENIE GEOMETRII ROZNYCH
curve_7 = Curve(shift_to_depth_native_cluster_4)
explode_2 = Explode(Curve=curve_7, Recursive=True)  # -> Segments, Vertices
rebuild_curve_2 = RebuildCurve(Curve=explode_2.Segments, Degree=1, Count=10, Tangents=False)
join_curves_2 = JoinCurves(Curves=rebuild_curve_2, Preserve=False)
shift_paths_5 = ShiftPaths(Data=join_curves_2, Offset=-2)
curve_8 = Curve(shift_paths_5)

# ---- group: TWORZENIE GEOMETRII ROZNYCH / ROOM AREA SURFACES / CROP - METODA 1 (continued)
clipper2_offset_3 = Clipper2Offset(Polylines=curve_8, Distance=number_slider_14, JoinType=0, EndType=0, MiterLimit=2, Precision=4)  # -> Holes, Outer, ClipperPaths
region_union_2 = RegionUnion(Curves=clipper2_offset_3.Outer)
clipper2_offset_4 = Clipper2Offset(Polylines=region_union_2, Distance=number_slider_13, JoinType=0, EndType=0, MiterLimit=2, Precision=4)  # -> Holes, Outer, ClipperPaths
project_2 = Project(Geometry=clipper2_offset_4.Holes, Plane=plane_7)  # -> Geometry, Transform
curve_9 = Curve(simplify(project_2.Geometry))
custom_preview_lineweights_2 = CustomPreviewLineweights(Geometry=curve_9, Shader=colour_swatch_2, Thickness=number_slider_12, Absolute=False)
area_4 = Area(Geometry=curve_9)  # -> Area, Centroid
sort_list_3 = SortList(Keys=area_4.Area, ValuesValuesA=curve_9)  # -> Keys, ValuesValuesA
list_item_14 = ListItem(List=sort_list_3.ValuesValuesA, Index=0, Wrap=True)
curve_10 = Curve(list_item_14)
szeroki_zarkes_cropa = Surface(curve_10)

# ---- group: TWORZENIE GEOMETRII ROZNYCH / ROOM AREA SURFACES
element_2 = Element(element)
szeroki_zarkes_cropa_2 = Surface(szeroki_zarkes_cropa)
kontur_okna_na_rzucie = KONTUROKNANARZUCIE(szeroki_zarkes_cropa=szeroki_zarkes_cropa_2, graphical_element=element_2)  # -> kontur_okna_na_rzucie_2, box_2, graphical_element_3
kontur_okna_na_rzucie_2 = Curve(kontur_okna_na_rzucie.kontur_okna_na_rzucie_2)

szeroki_zarkes_cropa_3 = Surface(szeroki_zarkes_cropa)
walls_geometry_4 = Geometry(walls_geometry_3)

room_boundaries_3 = Curve(room_boundaries)
number_slider_15 = Slider(10, range=-20..50)
panel_47 = Panel("1")
shift_to_depth_native_cluster_5 = ShiftToDepthNativeCluster(data=room_boundaries_3, depth=panel_47)

# ---- group: TWORZENIE GEOMETRII ROZNYCH / laczenie roznych obrysow
pole_wokol_okien = Curve(kontur_okna_na_rzucie_2)
pole_wokol_drzwi_2 = Curve(pole_wokol_drzwi)

# ---- group: TWORZENIE GEOMETRII ROZNYCH / ROOM AREA SURFACES
brep = Brep(walls_geometry_4)
panel_48 = Panel(";")
panel_49 = Panel("*")

number_slider_16 = Slider(40, range=0..1000)

unit_z = UnitZ(Factor=number_slider_16)
move_2 = Move(Geometry=szeroki_zarkes_cropa_3, Motion=unit_z)  # -> Geometry, Transform
area_5 = Area(Geometry=move_2.Geometry)  # -> Area, Centroid
plane_8 = Plane(area_5.Centroid)
brep_plane = BrepPlane(Brep=walls_geometry_4, Plane=plane_8)  # -> Curves, Points; disabled
surface_2 = Surface(move_2.Geometry)
curve_11 = Curve(surface_2)

plane_9 = Plane(flatten(plane_8))
deconstruct = Deconstruct(Point=plane_9)  # -> XComponent, YComponent, ZComponent
create_set_10 = CreateSet(List=deconstruct.ZComponent)  # -> Set, Map
construct_point = ConstructPoint(XCoordinate=0, YCoordinate=0, ZCoordinate=create_set_10.Set)
plane_10 = Plane(graft(construct_point))
brep_plane_2 = BrepPlane(Brep=brep, Plane=plane_10)  # -> Curves, Points
shift_paths_6 = ShiftPaths(Data=brep_plane_2.Curves, Offset=-1)
tree_statistics_7 = TreeStatistics(Tree=shift_paths_6)  # -> Paths, Length, Count
set = Number(create_set_10.Set)
search = Number(deconstruct.ZComponent)
key_value_search_2 = KeyValueSearch(Keys=set, Values=tree_statistics_7.Paths, Search=search)
deconstruct_path = DeconstructPath(Branch=key_value_search_2)
list_item_15 = ListItem(List=deconstruct_path, Index=0, Wrap=True)  # -> Item, Item1
concatenate_2 = Concatenate(
    FragmentC="{",
    FragmentA=list_item_15.Item,
    FragmentD=panel_48,
    FragmentB=list_item_15.Item1,
    FragmentE=panel_48,
    FragmentF=panel_49,
    FragmentG="}")
split_tree_8 = SplitTree(Data=brep_plane_2.Curves, Masks=flatten(concatenate_2))  # -> Positive, Negative
curve_12 = Curve(split_tree_8.Positive)

surface_3 = Surface(curve_12)
curve_13 = Curve(surface_3)
shift_paths_7 = ShiftPaths(Data=curve_13, Offset=-1)
region_union_3 = RegionUnion(Curves=shift_paths_7)
surface_4 = Surface(region_union_3)
curve_14 = Curve(surface_4)
region_intersection = RegionIntersection(CurvesA=curve_14, CurvesB=curve_11)
region_union_4 = RegionUnion(Curves=region_intersection)
surface_5 = Surface(region_union_4)

unit_z_2 = UnitZ(Factor=number_slider_16)
move_3 = Move(Geometry=shift_to_depth_native_cluster_5, Motion=unit_z_2)  # -> Geometry, Transform
surface_6 = Surface(move_3.Geometry)

curve_15 = Curve(surface_6)
explode_3 = Explode(Curve=curve_15, Recursive=True)  # -> Segments, Vertices
rebuild_curve_3 = RebuildCurve(Curve=explode_3.Segments, Degree=1, Count=10, Tangents=False)
join_curves_3 = JoinCurves(Curves=rebuild_curve_3, Preserve=False)
shift_paths_8 = ShiftPaths(Data=join_curves_3, Offset=-2)
curve_16 = Curve(shift_paths_8)

clipper2_offset_5 = Clipper2Offset(Polylines=curve_16, Distance=number_slider_15, JoinType=0, EndType=0, MiterLimit=2, Precision=4)  # -> Holes, Outer, ClipperPaths
project_3 = Project(Geometry=clipper2_offset_5.Outer, Plane=plane_8)  # -> Geometry, Transform
curve_17 = Curve(project_3.Geometry)
shift_paths_9 = ShiftPaths(Data=curve_17, Offset=-1)
explode_4 = Explode(Curve=shift_paths_9, Recursive=True)  # -> Segments, Vertices
join_curves_4 = JoinCurves(Curves=explode_4.Segments, Preserve=False)
surface_7 = Surface(shift_paths_9)

merge_6 = Merge(Data1=simplify(surface_7), Data2=simplify(surface_5))
region_union_5 = RegionUnion(Curves=merge_6)
region_union_6 = RegionUnion(Curves=region_union_5)
surface_8 = Surface(region_union_6)
area_6 = Area(Geometry=surface_8)  # -> Area, Centroid
sort_list_4 = SortList(Keys=area_6.Area, ValuesVaA=surface_8)  # -> Keys, reverse(ValuesVaA)
list_item_16 = ListItem(List=sort_list_4.ValuesVaA, Index=0, Wrap=True)
tylko_najwiekszy_obszar = Surface(list_item_16)
surface_9 = Surface(surface_8)  # disabled
metoda_naprawienia_konturu_do_rozwinieci = METODANAPRAWIENIAKONTURUDOROZWINIECIA(surface=surface_9)  # "METODA NAPRAWIENIA KONTURU (DO ROZWINIECIA)"

# ---- group: TWORZENIE GEOMETRII ROZNYCH / laczenie roznych obrysow (continued)
surface_10 = Surface(tylko_najwiekszy_obszar)
area_7 = Area(Geometry=surface_10)
curve_18 = Curve(surface_10)
merge_7 = Merge(Data1=simplify(curve_18), Data2=simplify(pole_wokol_drzwi_2), Data3=simplify(pole_wokol_okien))
plane_11 = Plane(area_7)
project_4 = Project(Geometry=merge_7, Plane=plane_11)  # -> Geometry, Transform
region_union_7 = RegionUnion(Curves=project_4.Geometry)

# ---- group: TWORZENIE GEOMETRII ROZNYCH / ROOM AREA SURFACES
# TODO: tymczasowe wziecie najwiekszego obrysu (okna dachowe tutaj tworza niepotrzebne obrysy)
curve_19 = Curve(region_union_7)
area_8 = Area(Geometry=curve_19)  # -> Area, Centroid
sort_list_5 = SortList(Keys=area_8.Area, ValuesValuesA=curve_19)  # -> reverse(Keys), reverse(ValuesValuesA)
list_item_17 = ListItem(List=sort_list_5.ValuesValuesA, Index=0, Wrap=True)
curve_20 = Curve(list_item_17)

# ---- group: TWORZENIE GEOMETRII ROZNYCH / ROOM AREA SURFACES / QUAD REMESH CROP REGION SIMPLIFY
surface_11 = Surface(curve_20)
area_9 = Area(Geometry=surface_11)  # -> Area, Centroid
xy_plane_3 = XYPlane(Origin=area_9.Centroid)
curve_21 = Curve(surface_11)
boolean_toggle_2 = BooleanToggle(False)
number_slider_17 = Slider(-37, range=-100..100)
number_slider_18 = Slider(35, range=-100..100)
number_slider_19 = Slider(9, range=0..100)
panel_50 = Panel("1")
panel_51 = Panel("0")
panel_52 = Panel("0")
quad_remesh_parameters = QuadRemeshParameters(
    TargetQuadCount=1000,
    UseAdaptiveQuads=boolean_toggle_2,
    AdaptiveQuadSize=panel_52,
    DetectHardEdges=True,
    PreserveMeshArrayHardEdges=panel_51,
    SymmetryAxis=0,
    GuideCurveInfluence=0,
    TargetEdgeLength=number_slider_19)
quad_remesh = QuadRemesh(MeshOrBrep=surface_11, QuadRemeshParameters=quad_remesh_parameters)
mesh_explode = MeshExplode(Mesh=quad_remesh, Interpolate=False)
shift_to_depth_native_cluster_6 = ShiftToDepthNativeCluster(data=mesh_explode, depth=panel_50)
mesh_faces = Mesh(shift_to_depth_native_cluster_6)
mesh_faces_2 = Mesh(mesh_faces)

curve_22 = Curve(curve_21)
explode_5 = Explode(Curve=curve_22, Recursive=True)  # -> Segments, Vertices
rebuild_curve_4 = RebuildCurve(Curve=explode_5.Segments, Degree=1, Count=10, Tangents=False)
join_curves_5 = JoinCurves(Curves=rebuild_curve_4, Preserve=False)
shift_paths_10 = ShiftPaths(Data=join_curves_5, Offset=-2)
curve_23 = Curve(shift_paths_10)

clipper2_offset_6 = Clipper2Offset(Polylines=curve_23, Distance=number_slider_17, JoinType=0, EndType=0, MiterLimit=2, Precision=4)  # -> Holes, Outer, ClipperPaths
curve_24 = Curve(clipper2_offset_6.Holes)
clipper2_offset_7 = Clipper2Offset(Polylines=curve_24, Distance=number_slider_18, JoinType=0, EndType=0, MiterLimit=2, Precision=4)  # -> Holes, Outer, ClipperPaths
project_5 = Project(Geometry=clipper2_offset_7.Outer, Plane=xy_plane_3)  # -> Geometry, Transform
curve_25 = Curve(simplify(project_5.Geometry))
fast_sweep = FastSweep(Rail=curve_25, X=0.5, Y=0.5)
clash = Clash(FirstSet=fast_sweep, SecondSet=mesh_faces, Distance=0, ResultLimit=20000)  # -> ClashCount, ClashPoints, ClashRadii, FirstIndex, SecondIndex
list_item_18 = ListItem(List=mesh_faces_2, Index=clash.SecondIndex, Wrap=True)
cull_index = CullIndex(List=mesh_faces_2, Indices=clash.SecondIndex, Wrap=True)
mesh_join_2 = MeshJoin(Meshes=cull_index)
disjoint_mesh = DisjointMesh(Mesh=mesh_join_2)
mesh_area = MeshArea(Mesh=disjoint_mesh)  # -> Area, Centroid
sort_list_6 = SortList(Keys=mesh_area.Area, ValuesVaA=disjoint_mesh)  # -> reverse(Keys), reverse(ValuesVaA)
list_item_19 = ListItem(List=sort_list_6.ValuesVaA, Index=0, Wrap=True)
najwiekszy_mesh_po_podzieleniu = Mesh(simplify(list_item_19))
mesh_faces_strip = Mesh(list_item_18)
suirify = Suirify(najwiekszy_mesh_po_podzieleniu)
suirify_2 = Suirify(mesh_faces_strip)
merge_8 = Merge(Data1=simplify(suirify), Data2=simplify(suirify_2))
mesh_join_3 = MeshJoin(Meshes=merge_8)
mesh_edges = MeshEdges(Mesh=mesh_join_3)  # -> NakedEdges, InteriorEdges, NonManifoldEdges
join_curves_6 = JoinCurves(Curves=mesh_edges.NakedEdges, Preserve=False)
curve_26 = Curve(join_curves_6)
suirify_3 = Suirify(curve_26)
simplify_curve = SimplifyCurve(Curve=suirify_3)  # -> Curve, Simplified
curve_27 = Curve(simplify_curve.Curve)

# ---- group: TWORZENIE GEOMETRII ROZNYCH / ROOM AREA SURFACES (continued)
model_object_6 = ModelObject(
    Object=curve_27,
    Layer=query_or_create_layer_5,
    Display=display_attributes_3.Display,
    Drafting=drafting_attributes.Drafting)  # -> simplify(Object)
cropp_region = ModelObject(model_object_6)

# ---- group: ROTACJA MIESZKANIA
drzwiwyszukane_geofiltered_6 = Plane(drzwiwyszukane_geofiltered_5)
revit_project_internal_origin_plane_2 = Plane(revit_project_internal_origin_plane)
group_wrapper_5 = GroupWrapper(
    AutoJumpToLocation=False,
    AutoWidth=False,
    ColumnRowsSpacing=50,
    CurrentState="Wrapped",
    CustomColor=RGB(255, 255, 255),
    CustomUnwrapLocationX=4802.5,
    CustomUnwrapLocationY=2930.765381,
    CustomWrapLocationX=5561,
    CustomWrapLocationY=1343.152466,
    InheritGroupColor=False,
    LeftColumnOffset=250,
    LeftComponentGuid_0=drzwiwyszukane_geofiltered_6,
    LeftComponentGuid_1=revit_project_internal_origin_plane_2,
    OffsetGuid_0=drzwiwyszukane_geofiltered_6,
    OffsetGuid_1=revit_project_internal_origin_plane_2,
    OffsetGuid_10=line_sdl_4,
    OffsetGuid_11=degrees_2,
    OffsetGuid_12=project_north_2,
    OffsetGuid_14=xy_plane_4,
    OffsetGuid_15=project_north,
    OffsetGuid_16=project_north_3,
    OffsetGuid_17=cluster,
    OffsetGuid_18=panel_53,
    OffsetGuid_19=drzwiwyszukane_geofiltered_8,
    OffsetGuid_2=value_rotacja_mieszkania,
    OffsetGuid_21=project_north_4,
    OffsetGuid_22=kierunek_wejscia_3,
    OffsetGuid_24=move_4,
    OffsetGuid_25=line_2,
    OffsetGuid_26=plane_13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)

xy_plane_4 = XYPlane(Origin=Point(0, 0, 0))
plane_12 = Plane(drzwiwyszukane_geofiltered_6)
deconstruct_plane_3 = DeconstructPlane(Plane=plane_12)  # -> Origin, XAxis, YAxis, ZAxis
line_sdl_3 = LineSDL(Start=deconstruct_plane_3.Origin, Direction=deconstruct_plane_3.XAxis, Length=25)
drzwiwyszukane_geofiltered_7 = Plane(drzwiwyszukane_geofiltered_6)
line_2 = Line(StartPoint=revit_project_internal_origin_plane_2, EndPoint=drzwiwyszukane_geofiltered_7)
move_4 = Move(Geometry=revit_project_internal_origin_plane_2, Motion=line_2)  # -> Geometry, Transform
plane_13 = Plane(move_4.Geometry)
deconstruct_plane_4 = DeconstructPlane(Plane=plane_13)  # -> Origin, XAxis, YAxis, ZAxis
line_sdl_4 = LineSDL(Start=plane_13, Direction=deconstruct_plane_4.YAxis, Length=25)
line_3 = Line(line_sdl_3)
kierunek_wejscia = VectorDisplay(Anchor=deconstruct_plane_3.Origin, Vector=line_3)
kierunek_wejscia_2 = Line(line_3)
project_north = Line(line_sdl_4)
angle_2 = Angle(VectorA=line_3, VectorB=project_north, Plane=xy_plane_4)  # -> Angle, Reflex
degrees_2 = Degrees(Radians=angle_2.Angle)
project_north_2 = VectorDisplay(Anchor=deconstruct_plane_4.Origin, Vector=project_north)  # disabled
project_north_3 = Line(project_north)

drzwiwyszukane_geofiltered_8 = Plane(drzwiwyszukane_geofiltered_6)
project_north_4 = Line(project_north_3)
kierunek_wejscia_3 = Line(kierunek_wejscia_2)
panel_53 = Panel("INFO::Entrance Rotation")
cluster = Cluster(
    drzwiwyszukane_geofiltered=drzwiwyszukane_geofiltered_8,
    kierunek_wejscia=kierunek_wejscia_3,
    project_north=project_north_4,
    layer_path=panel_53)  # -> angle_dimension, model_object_5, angle_dimension_2

value_rotacja_mieszkania = Number(degrees_2)
model_object_7 = ModelObject(cluster.model_object_5)

# ---- group: GEOMETRIA + ATRYBUTY
mieszkaniagrouped_cleaned_4 = Room(mieszkaniagrouped_cleaned)
room_area_geometry_2 = ModelObject(room_area_geometry)
room_floor_plan_text = Text(floor_plan_5)
room_level_text = Text(level_11)
group_wrapper_6 = GroupWrapper(
    AutoJumpToLocation=False,
    AutoWidth=False,
    ColumnRowsSpacing=50,
    CurrentState="Wrapped",
    CustomColor=RGB(255, 255, 255),
    CustomUnwrapLocationX=5270.134766,
    CustomUnwrapLocationY=3648,
    CustomWrapLocationX=5465.641602,
    CustomWrapLocationY=1995,
    InheritGroupColor=False,
    LeftColumnOffset=250,
    LeftComponentGuid_0=room_area_geometry_2,
    LeftComponentGuid_2=mieszkaniagrouped_cleaned_4,
    LeftComponentGuid_4=room_level_text,
    LeftComponentGuid_5=room_floor_plan_text,
    OffsetGuid_1=mieszkaniagrouped_cleaned_4,
    OffsetGuid_10=mieszkaniagrouped_cleaned_wewnetrzne,
    OffsetGuid_101=keys_pojedynczo,
    OffsetGuid_103=mieszkaniagrouped_cleaned_6,
    OffsetGuid_104=mieszkaniagrouped_cleaned_8,
    OffsetGuid_105=panel_55,
    OffsetGuid_11=room_area_geometry_wewnetrzne_2,
    OffsetGuid_111=keys_3,
    OffsetGuid_112=room_area_geometry_10,
    OffsetGuid_113=user_text_12,
    OffsetGuid_114=values_2,
    OffsetGuid_115=shift_paths_14,
    OffsetGuid_117=query_parameters_3,
    OffsetGuid_118=parametry_znalezione,
    OffsetGuid_119=nulls_in_empty_branches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)

# ---- group: GEOMETRIA + ATRYBUTY / oddziel przestrzenie zewnetrzne
mieszkaniagrouped_cleaned_5 = Room(graft(mieszkaniagrouped_cleaned_4))
room_area_geometry_3 = ModelObject(room_area_geometry_2)
model_object_8 = ModelObject(Object=graft(room_area_geometry_3))  # -> Object, Name
data_5 = Data(model_object_8.Name)
data_6 = Data(flatten(data_5))
panel_54 = Panel("""BALKON
TARAS
LOGGIA
BALKON 2
OGRÓDEK""")
match_text_6 = MatchText(Text=graft(data_6), Pattern=panel_54, Case=False)
mass_addition_3 = MassAddition(Input=match_text_6)  # -> Result, PartialResults
boolean_3 = Boolean(flatten(mass_addition_3.Result))
unflatten_tree_3 = UnflattenTree(Tree=boolean_3, Guide=data_5)
dispatch_13 = Dispatch(List=model_object_8.Object, DispatchPattern=unflatten_tree_3)  # -> ListA, ListB
dispatch_14 = Dispatch(List=mieszkaniagrouped_cleaned_5, DispatchPattern=unflatten_tree_3)  # -> ListA, ListB
room_area_geometry_zewnetrzne = ModelObject(dispatch_13.ListA)
room_area_geometry_wewnetrzne = ModelObject(dispatch_13.ListB)
panel_55 = Panel("""LOGGIA
BALKON
OGRÓDEK
PIWNICA""")

# ---- group: GEOMETRIA + ATRYBUTY
mieszkaniagrouped_cleaned_6 = Room(graft(mieszkaniagrouped_cleaned_4))
room_area_geometry_4 = ModelObject(room_area_geometry_2)
panel_56 = Panel("-null-")
empty = Panel("")
empty_2 = Panel("-empty-")
panel_57 = Panel("""PIG_Nr Etapu
PIG_Nr Budynku
PIG_Nr Klatki
PIG_Nr Piętra
PIG_Nr Lokalu
PIG_Nr Pom
PIG_Nr Zbiorczy
PIG_Nr Komercyjny
PIG_Area Factor
PIG_Pow Lokalu
PIG_Pow Balkonu
PIG_Direction""")
text_14 = Text(graft(panel_57))
query_parameters_2 = QueryParameters(Name=text_14)  # -> flatten(Parameter)
query_parameters_3 = QueryParameters(Name=text_14)
nulls_in_empty_branches = NullsInEmptyBranches(DataWithEmptyBranches=query_parameters_3)
null_item_2 = NullItem(Item=nulls_in_empty_branches)  # -> NullFlags, InvalidFlags, Description
dispatch_15 = Dispatch(List=text_14, DispatchPattern=null_item_2.NullFlags)  # -> ListA, flatten(ListB)
text_15 = Text(dispatch_15.ListB)
element_parameter_2 = ElementParameter(Element=mieszkaniagrouped_cleaned_6, Parameter=text_15)  # -> Element, Value
replace_nulls = ReplaceNulls(Items=element_parameter_2.Value, Replacements=panel_56)  # -> Items, Count
replace_members = ReplaceMembers(Set=replace_nulls.Items, Find=empty, Replace=empty_2)
user_text_3 = UserText(Content=graft(room_area_geometry_4), Keys=text_15, Values=replace_members, UserTextMode=1)  # -> simplify(Content), simplify(Keys), simplify(Values)
keys_pojedynczo = Text(text_15)
parametry_znalezione = Panel(replace_members)

data_7 = Data(flatten(data_5))
data_8 = Data(data_5)
panel_58 = Panel("""SALON Z ANEKSEM
SYPIALNIA 1
SYPIALNIA 2
SALON  Z ANEKSEM
SYPIALNIA""")
match_text_7 = MatchText(Text=graft(data_7), Pattern=panel_58, Case=False)
mass_addition_4 = MassAddition(Input=match_text_7)  # -> Result, PartialResults
boolean_4 = Boolean(flatten(mass_addition_4.Result))
unflatten_tree_4 = UnflattenTree(Tree=boolean_4, Guide=data_8)
dispatch_16 = Dispatch(List=data_8, DispatchPattern=unflatten_tree_4)  # -> ListA, ListB
text_16 = Text(dispatch_16.ListA)
shift_paths_11 = ShiftPaths(Data=text_16, Offset=-1)
panel_59 = Panel(";")
text_join = TextJoin(Text=shift_paths_11, Join=panel_59)
lista_pokojow = Text(text_join)

# ---- group: GEOMETRIA + ATRYBUTY / ATTRIBUTES - ROOM AREA GEOMETRY
room_level_text_2 = Text(room_level_text)
room_floor_plan_text_2 = Text(room_floor_plan_text)
merge_9 = Merge(Data1=room_floor_plan_text_2, Data2=room_level_text_2)
room_area_geometry_5 = ModelObject(room_area_geometry_2)
panel_60 = Panel("""REV_Room Floor Plan
REV_Room Level""")
user_text_4 = UserText(Content=graft(room_area_geometry_5), Keys=panel_60, Values=merge_9, UserTextMode=1)  # -> Content, simplify(Keys), simplify(Values)

mieszkaniagrouped_cleaned_7 = Room(mieszkaniagrouped_cleaned_4)
inspect_element_4 = InspectElement(Element=graft(mieszkaniagrouped_cleaned_7))  # -> DimensionsArea, IdentityDataDepartment, IdentityDataName, IdentityDataNumber, IdentityDataOccupancy
merge_10 = Merge(
    Data1=inspect_element_4.IdentityDataName,
    Data2=inspect_element_4.DimensionsArea,
    Data3=inspect_element_4.IdentityDataOccupancy,
    Data4=inspect_element_4.IdentityDataDepartment)
room_area_geometry_6 = ModelObject(room_area_geometry_2)
panel_61 = Panel("""REV_Room Name
REV_Room Area
REV_Occupancy
REV_Department""")
user_text_5 = UserText(Content=graft(room_area_geometry_6), Keys=panel_61, Values=merge_10, UserTextMode=1)  # -> Content, simplify(Keys), simplify(Values)

room_area_geometry_7 = ModelObject(room_area_geometry_2)
item_index = ItemIndex(List=room_area_geometry_7, Item=room_area_geometry_7)
panel_62 = Panel("RHI_Custom Sort Number")
user_text_6 = UserText(Content=graft(room_area_geometry_7), Keys=panel_62, Values=graft(item_index), UserTextMode=1)  # -> simplify(Content), simplify(Keys), simplify(Values)

room_area_geometry_8 = ModelObject(room_area_geometry_2)
document_units = DocumentUnits()
unit_system = UnitSystem(UnitSystem=document_units)  # -> UnitSystem, Name, Meters
square = Square(Value=unit_system.Meters)
panel_63 = Panel("REV_Room Area")
user_text_7 = UserText(Content=graft(room_area_geometry_8), Keys=panel_63, UserTextMode=1)  # -> Content, Keys, Values
multiplication = Multiplication(A=user_text_7.Values, B=square)
expression = Expression(x=multiplication, Expression="Format(\"{0:0.00} m²\", x)")
round_to_decimal_place = RoundToDecimalPlace(NumberX=multiplication, DecimalPlace=2, RoundType=0)  # -> Rounded, Difference; disabled
panel_64 = Panel(",")
panel_65 = Panel(".")
replace_text = ReplaceText(Text=expression, Find=panel_65, Replace=panel_64, RecursiveReplace=False)
panel_66 = Panel("RHI_Room Area Text")
user_text_8 = UserText(Content=user_text_7.Content, Keys=panel_66, Values=replace_text, UserTextMode=1)  # -> Content, simplify(Keys), simplify(Values)

# ---- group: GEOMETRIA + ATRYBUTY
room_area_geometry_9 = ModelObject(room_area_geometry_2)
mieszkaniagrouped_cleaned_8 = Room(mieszkaniagrouped_cleaned_4)
element_passport = ElementPassport(Element=mieszkaniagrouped_cleaned_8)  # -> DocumentGUID, Document, UniqueID, Id
panel_67 = Panel("REV_Unique ID")
user_text_9 = UserText(Content=graft(room_area_geometry_9), Keys=panel_67, Values=graft(element_passport.UniqueID), UserTextMode=1)  # -> simplify(Content), simplify(Keys), simplify(Values)

# ---- group: GEOMETRIA + ATRYBUTY / oddziel przestrzenie zewnetrzne
panel_68 = Panel("Grupa pomieszczen")
panel_69 = Panel("zewnetrzne")
user_text_10 = UserText(Content=room_area_geometry_zewnetrzne, Keys=panel_68, Values=panel_69, UserTextMode=1)  # -> Content, Keys, Values
panel_70 = Panel("Grupa pomieszczen")
panel_71 = Panel("wewnetrzne")
user_text_11 = UserText(Content=room_area_geometry_wewnetrzne, Keys=panel_70, Values=panel_71, UserTextMode=1)  # -> Content, Keys, Values
merge_11 = Merge(Data1=user_text_10.Content, Data2=user_text_11.Content)
keys = Data(simplify(merge_11))
merge_12 = Merge(Data1=user_text_10.Keys, Data2=user_text_11.Keys)
merge_13 = Merge(Data1=user_text_10.Values, Data2=user_text_11.Values)
shift_paths_12 = ShiftPaths(Data=merge_13, Offset=-1)
values = Data(simplify(graft(shift_paths_12)))
shift_paths_13 = ShiftPaths(Data=merge_12, Offset=-1)
keys_2 = Data(simplify(graft(shift_paths_13)))

# ---- group: GEOMETRIA + ATRYBUTY
keys_3 = Merge(
    Data1=user_text_9.Keys,
    Data2=user_text_6.Keys,
    Data3=user_text_5.Keys,
    Data4=user_text_8.Keys,
    Data5=user_text_4.Keys,
    Data6=keys_2,
    Data7=user_text_3.Keys)
values_2 = Merge(
    Data1=user_text_9.Values,
    Data2=user_text_6.Values,
    Data3=user_text_5.Values,
    Data4=user_text_8.Values,
    Data5=user_text_4.Values,
    Data6=values,
    Data7=user_text_3.Values)
room_area_geometry_10 = ModelObject(room_area_geometry_2)
user_text_12 = UserText(Content=graft(room_area_geometry_10), Keys=keys_3, Values=values_2, UserTextMode=1)  # -> Content, Keys, Values
shift_paths_14 = ShiftPaths(Data=user_text_12.Content, Offset=-1)
room_area_geometry_attributes = ModelObject(shift_paths_14)

keys_4 = Text(user_text_3.Keys)
values_3 = Text(user_text_3.Values)
keys_pojedynczo_2 = Text(keys_pojedynczo)
mieszkaniagrouped_cleaned_zewnetrzne = Room(dispatch_14.ListA)
mieszkaniagrouped_cleaned_wewnetrzne = Room(dispatch_14.ListB)
room_area_geometry_wewnetrzne_2 = ModelObject(room_area_geometry_wewnetrzne)
room_area_geometry_zewnetrzne_2 = ModelObject(dispatch_13.ListA)

# ----
keys_5 = Text(keys_4)
keys_pojedynczo_3 = Text(keys_pojedynczo_2)
values_4 = Text(values_3)
shift_paths_15 = ShiftPaths(Data=keys_5, Offset=-1)
shift_paths_16 = ShiftPaths(Data=values_4, Offset=-1)
member_index_3 = MemberIndex(Set=shift_paths_15, Member=keys_pojedynczo_3)  # -> Index, Count
shift_paths_17 = ShiftPaths(Data=member_index_3.Index, Offset=-1)
list_item_20 = ListItem(List=shift_paths_16, Index=shift_paths_17, Wrap=True)
unflatten_tree_5 = UnflattenTree(Tree=flatten(list_item_20), Guide=member_index_3.Index)
count_unique = CountUnique(Key=unflatten_tree_5, SortIfPossible=False, LastSaveLocalization="neutral,N")  # -> KeyList, Count
sort_list_7 = SortList(Keys=count_unique.Count, ValuesValuesA=count_unique.KeyList)  # -> reverse(Keys), reverse(ValuesValuesA)
list_item_21 = ListItem(List=sort_list_7.ValuesValuesA, Index=0, Wrap=True)
shift_paths_18 = ShiftPaths(Data=list_item_21, Offset=-1)
values_per_flat = Text(shift_paths_18)

# ---- group: LISTY POMIESZCZEN
mieszkaniagrouped_cleaned_zewnetrzne_2 = Room(mieszkaniagrouped_cleaned_zewnetrzne)
room_area_geometry_zewnetrzne_3 = ModelObject(room_area_geometry_zewnetrzne_2)
room_16 = Room(mieszkaniagrouped_cleaned_wewnetrzne)
room_area_geometry_wewnetrzne_3 = ModelObject(dispatch_13.ListB)
group_wrapper_7 = GroupWrapper(
    AutoJumpToLocation=False,
    AutoWidth=False,
    ColumnRowsSpacing=50,
    CurrentState="Wrapped",
    CustomColor=RGB(255, 255, 255),
    CustomUnwrapLocationX=4633.5,
    CustomUnwrapLocationY=1557.5,
    CustomWrapLocationX=3005,
    CustomWrapLocationY=1390.878906,
    InheritGroupColor=False,
    LeftColumnOffset=250,
    LeftComponentGuid_0=room_16,
    LeftComponentGuid_1=room_area_geometry_wewnetrzne_3,
    LeftComponentGuid_2=mieszkaniagrouped_cleaned_zewnetrzne_2,
    LeftComponentGuid_3=room_area_geometry_zewnetrzne_3,
    OffsetGuid_0=mieszkaniagrouped_cleaned_zewnetrzne_2,
    OffsetGuid_1=room_area_geometry_zewnetrzne_3,
    OffsetGuid_10=model_object_11,
    OffsetGuid_11=text_join_6,
    OffsetGuid_12=text_join_7,
    OffsetGuid_13=text_17,
    OffsetGuid_14=integer,
    OffsetGuid_15=number_2,
    OffsetGuid_16=number_4,
    OffsetGuid_17=text_split_2,
    OffsetGuid_18=format,
    OffsetGuid_19=panel_73,
    OffsetGuid_2=room_16,
    OffsetGuid_20=panel_74,
    OffsetGuid_21=number_3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)
shift_paths_19 = ShiftPaths(Data=room_area_geometry_zewnetrzne_3, Offset=-1)
model_object_9 = ModelObject(Object=shift_paths_19)  # -> Object, Name
text_join_2 = TextJoin(Text=model_object_9.Name, Join=";")
shift_paths_20 = ShiftPaths(Data=room_16, Offset=-1)
spatial_element_identity_6 = SpatialElementIdentity(SpatialElement=shift_paths_20)
element_passport_2 = ElementPassport(Element=shift_paths_20)  # -> DocumentGUID, Document, UniqueID, Id
text_join_3 = TextJoin(Text=element_passport_2.UniqueID, Join=";")
shift_paths_21 = ShiftPaths(Data=mieszkaniagrouped_cleaned_zewnetrzne_2, Offset=-1)
element_passport_3 = ElementPassport(Element=shift_paths_21)  # -> DocumentGUID, Document, UniqueID, Id
text_join_4 = TextJoin(Text=element_passport_3.UniqueID, Join=";")
shift_paths_22 = ShiftPaths(Data=room_area_geometry_wewnetrzne_3, Offset=-1)
model_object_10 = ModelObject(Object=shift_paths_22)  # -> Object, Name
model_object_11 = ModelObject(Object=shift_paths_22)  # -> Object, Name
text_join_5 = TextJoin(Text=model_object_10.Name, Join=";")
text_join_6 = TextJoin(Text=model_object_11.Name, Join=";")
merge_14 = Merge(Data1=text_join_5, Data2=text_join_3, Data3=text_join_2, Data4=text_join_4)
data_9 = Data(spatial_element_identity_6)
text_17 = Text(data_9)
integer = Integer(text_17)
number_2 = Number(spatial_element_identity_6)
text_18 = Text(text_join_3)
panel_72 = Panel(number_2)
panel_73 = Panel("{0:0.000000}")
format = Format(Format=panel_73, Culture=127, Data0=number_2)
text_join_7 = TextJoin(Text=format, Join=";")
text_split_2 = TextSplit(Text=text_join_7, Separators=";")
number_3 = Number(text_split_2)
text_19 = Text(text_split_2)
number_4 = Number(text_19)
panel_74 = Panel(format)
value = Text(merge_14)

# ---- group: SFORMATOWANY STRING POWIERZCHNI MIESZKANIA
mieszkaniagrouped_cleaned_wewnetrzne_2 = Room(mieszkaniagrouped_cleaned_wewnetrzne)
inspect_element_5 = InspectElement(Element=mieszkaniagrouped_cleaned_wewnetrzne_2)
shift_paths_23 = ShiftPaths(Data=inspect_element_5, Offset=-1)
number_5 = Number(shift_paths_23)
document_units_2 = DocumentUnits()
unit_system_2 = UnitSystem(UnitSystem=document_units_2)  # -> UnitSystem, Name, Meters
square_2 = Square(Value=unit_system_2.Meters)
multiplication_2 = Multiplication(A=number_5, B=square_2)
round_to_decimal_place_2 = RoundToDecimalPlace(NumberX=multiplication_2, DecimalPlace=2, RoundType=0)  # -> Rounded, Difference
mass_addition_5 = MassAddition(Input=round_to_decimal_place_2.Rounded)  # -> Result, PartialResults

# TODO: - usunac to formatowanie i zostawic to w formie numeru, formatowanie powinno odbyc sie na ostatnim etapie
room_area_geometry_wewnetrzne_4 = ModelObject(room_area_geometry_wewnetrzne_2)
group_wrapper_8 = GroupWrapper(
    AutoJumpToLocation=False,
    AutoWidth=False,
    ColumnRowsSpacing=50,
    CurrentState="Wrapped",
    CustomColor=RGB(255, 255, 255),
    CustomUnwrapLocationX=4633.5,
    CustomUnwrapLocationY=1557.5,
    CustomWrapLocationX=3005,
    CustomWrapLocationY=1390.878906,
    InheritGroupColor=False,
    LeftColumnOffset=250,
    LeftComponentGuid_0=mieszkaniagrouped_cleaned_wewnetrzne_2,
    LeftComponentGuid_1=room_area_geometry_wewnetrzne_4,
    OffsetGuid_0=room_area_geometry_wewnetrzne_4,
    OffsetGuid_1=mieszkaniagrouped_cleaned_wewnetrzne_2,
    OffsetGuid_10=shift_paths_23,
    OffsetGuid_11=unit_system_2,
    OffsetGuid_12=document_units_2,
    OffsetGuid_13=multiplication_2,
    OffsetGuid_14=square_2,
    OffsetGuid_15=round_to_decimal_place_2,
    OffsetGuid_16=mass_addition_5,
    OffsetGuid_17=number_5,
    OffsetGuid_2=value_2,
    OffsetGuid_20=,
    OffsetGuid_3=user_text_13,
    OffsetGuid_4=panel_75,
    OffsetGuid_5=expression_2,
    OffsetGuid_6=replace_text_2,
    OffsetGuid_7=panel_76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)
expression_2 = Expression(x=mass_addition_5.Result, Expression="Format(\"{0:0.00} m²\", x)")
panel_75 = Panel("REV_Room Area")
user_text_13 = UserText(Content=graft(room_area_geometry_wewnetrzne_4), Keys=panel_75, Values=graft(mass_addition_5.Result), UserTextMode=1)  # -> Content, Keys, simplify(Values)
panel_76 = Panel(",")
panel_77 = Panel(".")
replace_text_2 = ReplaceText(Text=expression_2, Find=panel_77, Replace=panel_76, RecursiveReplace=False)
value_2 = Text(replace_text_2)

# ----
room_area_geometry_attributes_2 = ModelObject(room_area_geometry_attributes)
user_text_14 = UserText(Content=room_area_geometry_attributes_2, Keys="REV_Department", UserTextMode=1)  # -> Content, Keys, Values
shift_paths_24 = ShiftPaths(Data=user_text_14.Values, Offset=-1)
create_set_11 = CreateSet(List=shift_paths_24)  # -> Set, Map
list_item_22 = ListItem(List=create_set_11.Set, Index=0, Wrap=True)

# ---- group: FORMATOWANIE NAZW MIESZKAN
nazwa_grupujaca_mieszkania_8 = Text(nazwa_grupujaca_mieszkania_4)
group_wrapper_9 = GroupWrapper(
    AutoJumpToLocation=False,
    AutoWidth=False,
    ColumnRowsSpacing=50,
    CurrentState="Wrapped",
    CustomColor=RGB(255, 255, 255),
    CustomUnwrapLocationX=4633.5,
    CustomUnwrapLocationY=1557.5,
    CustomWrapLocationX=3005,
    CustomWrapLocationY=1390.878906,
    InheritGroupColor=False,
    LeftColumnOffset=250,
    LeftComponentGuid_0=nazwa_grupujaca_mieszkania_8,
    OffsetGuid_0=nazwa_grupujaca_mieszkania_8,
    OffsetGuid_1=nazwa_grupujaca_mieszkania_formatted,
    OffsetGuid_10=replace_members_2,
    OffsetGuid_11=panel_80,
    OffsetGuid_2=integer_2,
    OffsetGuid_3=format_2,
    OffsetGuid_4=panel_78,
    OffsetGuid_5=panel_79,
    OffsetGuid_6=match_text_8,
    OffsetGuid_7=dispatch_17,
    OffsetGuid_8=merge_15,
    OffsetGuid_9=clean_tree_5,
    OffsetX_0=-446.1621094,
    OffsetX_1=447.9316406,
    OffsetX_10=254,
    OffsetX_11=154.4150391,
    OffsetX_12=-6051,
    OffsetX_13=-214.3344727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)
panel_78 = Panel("{0:000}")
panel_79 = Panel("[A-Za-z]")
match_text_8 = MatchText(Text=nazwa_grupujaca_mieszkania_8, RegEx=panel_79, Case=False)
dispatch_17 = Dispatch(List=nazwa_grupujaca_mieszkania_8, DispatchPattern=match_text_8)  # -> ListA, ListB
clean_tree_5 = CleanTree(RemoveNulls=True, RemoveInvalid=True, RemoveEmpty=True, Tree=dispatch_17.ListB)
integer_2 = Integer(clean_tree_5)
format_2 = Format(Format=panel_78, Culture=127, Data0=integer_2)

# ---- group: FORMATOWANIE NAZW MIESZKAN / usun empty
panel_80 = Panel("")
replace_members_2 = ReplaceMembers(Set=format_2, Find=panel_80)

# ---- group: FORMATOWANIE NAZW MIESZKAN (continued)
merge_15 = Merge(Data1=dispatch_17.ListA, Data2=replace_members_2)
nazwa_grupujaca_mieszkania_formatted = Text(merge_15)

# ---- group: CONSTRUCT BLOCK DEFINITIONS
# TODO: difiniujemy tutaj block definitions, ale tez widze ze wstepne ustawienia block instances. Zastanowic sie czy zostawic te wstepne ustawienia block instances jako defaultowe w tym miejscu i pozniej je nadpisac, czy odrazu przeniesc w inne miejsce.
convex_hull_2 = ModelObject(convex_hull)
room_brep_6 = ModelObject(room_brep_5)
crop_region_3 = ModelObject(cropp_region)
entrance_rotation = ModelObject(model_object_7)
dot_2 = ModelObject(dot)
room_area_geometry_11 = ModelObject(room_area_geometry_attributes)
door_planes_2 = ModelObject(door_planes)
nazwa_grupujaca_mieszkania_formatted_2 = Text(nazwa_grupujaca_mieszkania_formatted)
colour = Colour(colour_per_flat_3)
merge_16 = Merge(
    Data1=room_brep_6,
    Data2=convex_hull_2,
    Data3=dot_2,
    Data4=room_area_geometry_11,
    Data5=door_planes_2,
    Data6=crop_region_3,
    Data7=entrance_rotation)
clean_tree_6 = CleanTree(RemoveNulls=True, RemoveInvalid=True, RemoveEmpty=False, Tree=merge_16)
create_set_12 = CreateSet(List=nazwa_grupujaca_mieszkania_formatted_2)  # -> Set, Map
model_block_definition = ModelBlockDefinition(Objects=clean_tree_6, Name=simplify(create_set_12.Set))  # -> flatten(BlockDefinition), Objects, Name
panel_81 = Panel("ROOMS::different color per flat")
display_attributes_4 = DisplayAttributes(DisplayColour=colour)  # -> Display, DisplayColour, DisplayMode
query_or_create_layer_7 = QueryOrCreateLayer(layer_path=panel_81)
group_wrapper_10 = GroupWrapper(
    AutoJumpToLocation=False,
    AutoWidth=False,
    ColumnRowsSpacing=40,
    CurrentState="Unwrapped",
    CustomColor=RGB(255, 255, 255),
    CustomUnwrapLocationX=4633.5,
    CustomUnwrapLocationY=1557.5,
    CustomWrapLocationX=3005,
    CustomWrapLocationY=1390.878906,
    InheritGroupColor=False,
    LeftColumnOffset=250,
    LeftComponentGuid_0=colour,
    LeftComponentGuid_1=door_planes_2,
    LeftComponentGuid_2=convex_hull_2,
    LeftComponentGuid_3=dot_2,
    LeftComponentGuid_4=crop_region_3,
    LeftComponentGuid_5=room_brep_6,
    LeftComponentGuid_6=room_area_geometry_11,
    LeftComponentGuid_7=nazwa_grupujaca_mieszkania_formatted_2,
    LeftComponentGuid_8=entrance_rotation,
    OffsetGuid_0=room_brep_6,
    OffsetGuid_1=convex_hull_2,
    OffsetGuid_10=content_cache,
    OffsetGuid_11=model_block_instance_2,
    OffsetGuid_12=model_block_definition,
    OffsetGuid_13=model_block_instance,
    OffsetGuid_14=model_object_12,
    OffsetGuid_15=display_attributes_4,
    OffsetGuid_16=merge_16,
    OffsetGuid_17=panel_81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)

# ---- group: CONSTRUCT BLOCK DEFINITIONS / PUSH BLOCK DEFINITIONS
content_cache = ContentCache(Content=model_block_definition.BlockDefinition, Action=1)

# ---- group: CONSTRUCT BLOCK DEFINITIONS (continued)
model_block_instance = ModelBlockInstance(BlockDefinition=content_cache)  # -> graft(BlockInstance), Transform, BlockDefinition
model_object_12 = ModelObject(
    Object=model_block_instance.BlockInstance,
    Name=create_set_12.Set,
    Layer=query_or_create_layer_7,
    Display=display_attributes_4.Display)
model_block_instance_2 = ModelObject(model_object_12)

# ---- group: ATTRIBUTES - BLOCK INSTANCES
model_block_instance_3 = ModelObject(model_block_instance_2)
group_wrapper_11 = GroupWrapper(
    AutoJumpToLocation=False,
    AutoWidth=False,
    ColumnRowsSpacing=50,
    CurrentState="Unwrapped",
    CustomColor=RGB(255, 255, 255),
    CustomUnwrapLocationX=4633.5,
    CustomUnwrapLocationY=1557.5,
    CustomWrapLocationX=3005,
    CustomWrapLocationY=1390.878906,
    InheritGroupColor=False,
    LeftColumnOffset=250,
    LeftComponentGuid_0=model_block_instance_3,
    OffsetGuid_0=model_block_instance_3,
    OffsetGuid_1=content_cache_2,
    OffsetGuid_10=user_text_18,
    OffsetGuid_11=keys_6,
    OffsetGuid_12=values_5,
    OffsetGuid_13=user_text_23,
    OffsetGuid_15=panel_85,
    OffsetGuid_16=value_5,
    OffsetGuid_17=user_text_15,
    OffsetGuid_19=nazwa_grupujaca_mieszkania_formatted_3,
    OffsetGuid_2=panel_83,
    OffsetGuid_20=panel_82,
    OffsetGuid_21=user_text_16,
    OffsetGuid_23=value_3,
    OffsetGuid_27=panel_86,
    OffsetGuid_28=user_text_19,
    OffsetGuid_3=user_text_20,
    OffsetGuid_30=value_6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)

panel_82 = Panel("nr mieszkania")
nazwa_grupujaca_mieszkania_formatted_3 = Text(nazwa_grupujaca_mieszkania_formatted)
model_block_instance_4 = ModelObject(model_block_instance_3)
user_text_15 = UserText(Content=model_block_instance_4, Keys=panel_82, Values=nazwa_grupujaca_mieszkania_formatted_3, UserTextMode=1)  # -> Content, simplify(Keys), simplify(Values)

panel_83 = Panel("RHI_Area pomieszczenia glowne Text")
value_3 = Text(value_2)
model_block_instance_5 = ModelObject(model_block_instance_3)
user_text_16 = UserText(Content=model_block_instance_5, Keys=panel_83, Values=value_3, UserTextMode=1)  # -> Content, simplify(Keys), simplify(Values)

panel_84 = Panel("""RHI_Lista pomieszczen wewnetrznych
RHI_Lista pomieszczen wewnetrznych Unique ID
RHI_Lista pomieszczen zewnetrznych
RHI_Lista pomieszczen zewnetrznych Unique ID""")
model_block_instance_6 = ModelObject(model_block_instance_3)
value_4 = Text(value)
user_text_17 = UserText(Content=model_block_instance_6, Keys=panel_84, Values=value_4, UserTextMode=1)  # -> Content, simplify(Keys), simplify(Values)

value_5 = Text(value_rotacja_mieszkania)
panel_85 = Panel("RHI_rotacja (clockwise) wejscia do mieskzania wzgledem Project North")
key = Text(panel_85)
model_block_instance_7 = ModelObject(model_block_instance_3)
user_text_18 = UserText(Content=model_block_instance_7, Keys=key, Values=value_5, UserTextMode=1)  # -> Content, simplify(Keys), simplify(Values)

keys_pojedynczo_4 = Text(keys_pojedynczo_2)
value_6 = Text(values_per_flat)
model_block_instance_8 = ModelObject(model_block_instance_3)
panel_86 = Panel(keys_pojedynczo_4)
user_text_19 = UserText(Content=model_block_instance_8, Keys=keys_pojedynczo_4, Values=value_6, UserTextMode=1)  # -> Content, simplify(Keys), simplify(Values)

panel_87 = Panel("""Flat Floor Plan
Flat Level""")
flat_level_2 = Text(flat_level)
flat_floor_plan_2 = Text(flat_floor_plan)
merge_17 = Merge(Data1=flat_floor_plan_2, Data2=flat_level_2)
model_block_instance_9 = ModelObject(model_block_instance_3)
user_text_20 = UserText(Content=model_block_instance_9, Keys=panel_87, Values=merge_17, UserTextMode=1)  # -> Content, simplify(Keys), simplify(Values)

text_20 = Text()
model_block_instance_10 = ModelObject(model_block_instance_3)
value_7 = Text(lista_pokojow)
user_text_21 = UserText(Content=model_block_instance_10, Keys="RHI_Lista pokojow", Values=value_7, UserTextMode=1)  # -> Content, simplify(Keys), simplify(Values)

text_21 = Text("REV_Department")
model_block_instance_11 = ModelObject(model_block_instance_3)
value_8 = Text(list_item_22)
panel_88 = Panel(text_21)
user_text_22 = UserText(Content=model_block_instance_11, Keys=panel_88, Values=value_8, UserTextMode=1)  # -> Content, simplify(Keys), simplify(Values)

keys_6 = Merge(
    Data1=user_text_15.Keys,
    Data2=user_text_18.Keys,
    Data3=user_text_16.Keys,
    Data4=user_text_20.Keys,
    Data5=user_text_17.Keys,
    Data6=user_text_19.Keys,
    Data7=user_text_22.Keys,
    Data8=user_text_21.Keys)
values_5 = Merge(
    Data1=user_text_15.Values,
    Data2=user_text_18.Values,
    Data3=user_text_16.Values,
    Data4=user_text_20.Values,
    Data5=user_text_17.Values,
    Data6=user_text_19.Values,
    Data7=user_text_22.Values,
    Data8=user_text_21.Values)
model_block_instance_12 = ModelObject(model_block_instance_3)
user_text_23 = UserText(Content=simplify(model_block_instance_12), Keys=simplify(keys_6), Values=simplify(values_5), UserTextMode=1)  # -> Content, Keys, Values
model_block_instance_attributes = ModelObject(user_text_23.Content)

# ----
panel_89 = Panel(user_text_19.Values)

# ---- group: ATTRIBUTES - BLOCK INSTANCES (continued)
list_item_23 = ListItem(List=flatten(model_block_instance_attributes), Index=0, Wrap=True)
model_object_13 = ModelObject(list_item_23)

# ---- group: ATTRIBUTES - BLOCK INSTANCES / PUSH BLOCK INSTANCES
content_cache_2 = ContentCache(Content=model_block_instance_attributes)

# ----
panel_90 = Panel(model_block_instance_attributes)

values_6 = Merge(
    Data1=user_text_15.Values,
    Data2=user_text_18.Values,
    Data3=user_text_16.Values,
    Data4=user_text_20.Values,
    Data5=user_text_17.Values,
    Data6=user_text_19.Values,
    Data7=user_text_22.Values,
    Data8=user_text_21.Values)
keys_7 = Merge(
    Data1=user_text_15.Keys,
    Data2=user_text_18.Keys,
    Data3=user_text_16.Keys,
    Data4=user_text_20.Keys,
    Data5=user_text_17.Keys,
    Data6=user_text_19.Keys,
    Data7=user_text_22.Keys,
    Data8=user_text_21.Keys)
model_block_instance_13 = ModelObject(model_block_instance_3)
user_text_24 = UserText(Content=simplify(model_block_instance_13), Keys=simplify(keys_7), Values=simplify(values_6), UserTextMode=1)  # -> Content, Keys, Values
model_block_instance_attributes_2 = ModelObject(user_text_24.Content)
content_cache_3 = ContentCache(Content=model_block_instance_attributes_2)

# ---- group: NR KLATKI
model_block_instance_attributes_3 = ModelObject(user_text_24.Content)
model_block_definition_2 = ModelBlockDefinition(BlockDefinition=model_block_instance_attributes_3)  # -> BlockDefinition, Objects
contains_text_filter = ContainsTextFilter(Text="Rooms geometry", Case=False, ContainsTextMode=1)
value_list_2 = ValueList({"By Layer": 0, "By Object": 1, "By Material": 2, "By Parent": 3}, selected="By Parent")
filter_content = FilterContent(Content=model_block_definition_2.Objects, Filter=contains_text_filter)  # -> Content, Pass
display_colour_2 = DisplayColour(Source=value_list_2)
dispatch_18 = Dispatch(List=model_block_definition_2.Objects, DispatchPattern=filter_content.Pass)  # -> ListA, ListB
display_attributes_5 = DisplayAttributes(DisplayColour=display_colour_2)
model_object_14 = ModelObject(Object=dispatch_18.ListA, Display=display_attributes_5)
merge_18 = Merge(Data1=model_object_14, Data2=dispatch_18.ListB)
model_block_definition_3 = ModelBlockDefinition(BlockDefinition=model_block_definition_2.BlockDefinition, Objects=merge_18)
model_block_instance_14 = ModelBlockInstance(BlockDefinition=model_block_definition_3)
value_list_3 = ValueList({"By Layer": 0, "By Object": 1, "By Material": 2, "By Parent": 3}, selected="By Layer")
display_colour_3 = DisplayColour(Source=value_list_3)
display_attributes_6 = DisplayAttributes(DisplayColour=display_colour_3)

# ---- group: NR KLATKI / default
user_text_25 = UserText(Content=model_block_instance_attributes_3, UserTextMode=1)  # -> Content, Keys, Values

# ---- group: NR KLATKI (continued)
user_text_26 = UserText(Content=model_block_instance_14, Keys=user_text_25.Keys, Values=user_text_25.Values, UserTextMode=1)  # -> Content, Keys, Values
model_object_15 = ModelObject(Object=user_text_26.Content, Display=display_attributes_6)
model_block_instance_attributes_4 = ModelObject(flatten(model_object_15))
group_content = GroupContent(Content=model_block_instance_attributes_4, Key="PIG_Nr Klatki")  # -> Content, graft(Values)
concatenate_3 = Concatenate(FragmentA="ROZNE PODZIALY::", FragmentB="PIG_Nr Klatki", FragmentD="::", FragmentC=group_content.Values)
query_or_create_layer_8 = QueryOrCreateLayer(layer_path=concatenate_3)
random_color_3 = RandomColor(Data=flatten(query_or_create_layer_8), Seed=2, FastMode=False)
model_layer = ModelLayer(Layer=query_or_create_layer_8, DisplayColour=graft(random_color_3))
model_object_16 = ModelObject(Object=group_content.Content, Layer=model_layer)  # -> Object, Layer
content_cache_4 = ContentCache(Content=model_object_16.Object)

# ---- group: NR KLATKI / default
model_object_17 = ModelObject(Object=model_block_instance_attributes_3)  # -> Object, Display

# ---- group: DEPARTMENT
model_block_instance_attributes_5 = ModelObject(user_text_24.Content)
model_block_definition_4 = ModelBlockDefinition(BlockDefinition=model_block_instance_attributes_5)  # -> BlockDefinition, Objects
contains_text_filter_2 = ContainsTextFilter(Text="Rooms geometry", Case=False, ContainsTextMode=1)
value_list_4 = ValueList({"By Layer": 0, "By Object": 1, "By Material": 2, "By Parent": 3}, selected="By Parent")
filter_content_2 = FilterContent(Content=model_block_definition_4.Objects, Filter=contains_text_filter_2)  # -> Content, Pass
display_colour_4 = DisplayColour(Source=value_list_4)
dispatch_19 = Dispatch(List=model_block_definition_4.Objects, DispatchPattern=filter_content_2.Pass)  # -> ListA, ListB
display_attributes_7 = DisplayAttributes(DisplayColour=display_colour_4)
model_object_18 = ModelObject(Object=dispatch_19.ListA, Display=display_attributes_7)
merge_19 = Merge(Data1=model_object_18, Data2=dispatch_19.ListB)
model_block_definition_5 = ModelBlockDefinition(BlockDefinition=model_block_definition_4.BlockDefinition, Objects=merge_19)
model_block_instance_15 = ModelBlockInstance(BlockDefinition=model_block_definition_5)
value_list_5 = ValueList({"By Layer": 0, "By Object": 1, "By Material": 2, "By Parent": 3}, selected="By Layer")
display_colour_5 = DisplayColour(Source=value_list_5)
display_attributes_8 = DisplayAttributes(DisplayColour=display_colour_5)

# ---- group: DEPARTMENT / default
user_text_27 = UserText(Content=model_block_instance_attributes_5, UserTextMode=1)  # -> Content, Keys, Values

model_object_19 = ModelObject(Object=model_block_instance_attributes_5)  # -> Object, Name, Display

# ---- group: DEPARTMENT (continued)
user_text_28 = UserText(Content=model_block_instance_15, Keys=user_text_27.Keys, Values=user_text_27.Values, UserTextMode=1)  # -> Content, Keys, Values
model_object_20 = ModelObject(Object=user_text_28.Content, Name=model_object_19.Name, Display=display_attributes_8)
model_block_instance_attributes_6 = ModelObject(flatten(model_object_20))
group_content_2 = GroupContent(Content=model_block_instance_attributes_6, Key="REV_Department")  # -> Content, graft(Values)
concatenate_4 = Concatenate(FragmentA="ROZNE PODZIALY::", FragmentB="REV_Department", FragmentD="::", FragmentC=group_content_2.Values)
query_or_create_layer_9 = QueryOrCreateLayer(layer_path=concatenate_4)
random_color_4 = RandomColor(Data=flatten(query_or_create_layer_9), Seed=2, FastMode=False)
model_layer_2 = ModelLayer(Layer=query_or_create_layer_9, DisplayColour=graft(random_color_4))
model_object_21 = ModelObject(Object=group_content_2.Content, Layer=model_layer_2)  # -> Object, Layer
content_cache_5 = ContentCache(Content=model_object_21.Object)

# ---- group: NR PIETRA
model_block_instance_attributes_7 = ModelObject(user_text_24.Content)
model_block_definition_6 = ModelBlockDefinition(BlockDefinition=model_block_instance_attributes_7)  # -> BlockDefinition, Objects
contains_text_filter_3 = ContainsTextFilter(Text="Rooms geometry", Case=False, ContainsTextMode=1)
value_list_6 = ValueList({"By Layer": 0, "By Object": 1, "By Material": 2, "By Parent": 3}, selected="By Parent")
filter_content_3 = FilterContent(Content=model_block_definition_6.Objects, Filter=contains_text_filter_3)  # -> Content, Pass
display_colour_6 = DisplayColour(Source=value_list_6)
dispatch_20 = Dispatch(List=model_block_definition_6.Objects, DispatchPattern=filter_content_3.Pass)  # -> ListA, ListB
display_attributes_9 = DisplayAttributes(DisplayColour=display_colour_6)
model_object_22 = ModelObject(Object=dispatch_20.ListA, Display=display_attributes_9)
merge_20 = Merge(Data1=model_object_22, Data2=dispatch_20.ListB)
model_block_definition_7 = ModelBlockDefinition(BlockDefinition=model_block_definition_6.BlockDefinition, Objects=merge_20)
model_block_instance_16 = ModelBlockInstance(BlockDefinition=model_block_definition_7)
value_list_7 = ValueList({"By Layer": 0, "By Object": 1, "By Material": 2, "By Parent": 3}, selected="By Layer")
display_colour_7 = DisplayColour(Source=value_list_7)
display_attributes_10 = DisplayAttributes(DisplayColour=display_colour_7)

# ---- group: NR PIETRA / default
user_text_29 = UserText(Content=model_block_instance_attributes_7, UserTextMode=1)  # -> Content, Keys, Values

# ---- group: NR PIETRA (continued)
user_text_30 = UserText(Content=model_block_instance_16, Keys=user_text_29.Keys, Values=user_text_29.Values, UserTextMode=1)  # -> Content, Keys, Values
model_object_23 = ModelObject(Object=user_text_30.Content, Display=display_attributes_10)
model_block_instance_attributes_8 = ModelObject(flatten(model_object_23))
group_content_3 = GroupContent(Content=model_block_instance_attributes_8, Key="PIG_Nr Piętra")  # -> Content, graft(Values)
concatenate_5 = Concatenate(FragmentA="ROZNE PODZIALY::", FragmentB="PIG_Nr Piętra", FragmentD="::", FragmentC=group_content_3.Values)
query_or_create_layer_10 = QueryOrCreateLayer(layer_path=concatenate_5)
random_color_5 = RandomColor(Data=flatten(query_or_create_layer_10), Seed=2, FastMode=False)
model_layer_3 = ModelLayer(Layer=query_or_create_layer_10, DisplayColour=graft(random_color_5))
model_object_24 = ModelObject(Object=group_content_3.Content, Layer=model_layer_3)  # -> Object, Layer
content_cache_6 = ContentCache(Content=model_object_24.Object)

# ---- group: NR PIETRA / default
model_object_25 = ModelObject(Object=model_block_instance_attributes_7)  # -> Object, Display

# ----
merge_21 = Merge(
    Data1=simplify(quad_remesh),
    Data2=simplify(clipper2_offset_7.Outer),
    Data3=simplify(clipper2_offset_6.Holes),
    Data4=simplify(fast_sweep))
custom_preview_3 = CustomPreview(Material=ColourSwatch(SwatchColor=RGBA(51, 62, 156, 146)))

data_10 = Data(merge_21)
tstat = TreeStatistics(Tree=data_10)  # -> Paths, Length, Count
item = ListItem(List=tstat.Paths, Index=Slider(44, range=0..200), Wrap=False)
split = SplitTree(Data=data_10, Masks=flatten(item))  # -> Positive, Negative
item_2 = ListItem(List=split.Positive, Index=Slider(1, range=0..200), Wrap=True)
data_11 = Data(item_2)

list_item_24 = ListItem(List=split.Positive, Index=Slider(3, range=0..10), Wrap=True)
custom_preview_lineweights_3 = CustomPreviewLineweights(
    Geometry=list_item_24,
    Shader=ColourSwatch(SwatchColor=RGB(255, 255, 255)),
    Thickness=Slider(4, range=0..10),
    Absolute=False)
custom_preview_4 = CustomPreview(Geometry=data_11, Material=ColourSwatch(SwatchColor=RGBA(51, 62, 156, 146)))

# ==== cluster CustomRoomSort
nazwy_pomieszczen = ClusterInput()
kolejnosc = ClusterInput()
room = ClusterInput()
room_2 = Room(room)
kolejnosc_2 = Text(kolejnosc)
nazwy_pomieszczen_2 = Text(nazwy_pomieszczen)
inspect_element = InspectElement(Element=room_2)  # -> DimensionsArea, IdentityDataName
text = Text(inspect_element.IdentityDataName)
text_2 = Text(flatten(text))
create_set = CreateSet(List=text_2)  # -> Set, Map
set_difference = SetDifference(SetA=create_set.Set, SetB=nazwy_pomieszczen_2)  # -> flatten(Union)
text_3 = Text()
list_length = ListLength(List=set_difference)
duplicate_data = DuplicateData(Data="99", Number=list_length, Order=True)  # -> flatten(Data)
panel = Panel(create_set.Set)
merge = Merge(Data1=nazwy_pomieszczen_2, Data2=set_difference)
merge_2 = Merge(Data1=kolejnosc_2, Data2=duplicate_data)
set_difference_2 = SetDifference(SetA=merge, SetB=create_set.Set)
key_value_search = KeyValueSearch(Keys=merge, Values=merge_2, Search=text)
number = Number(expr("X*(-1)", inspect_element.DimensionsArea))
numer_kolejnosci_na_karcie = Integer(key_value_search)
panel_2 = Panel(set_difference_2)
multi_sort = MultiSort(
    Key0=numer_kolejnosci_na_karcie,
    Key1=number,
    Data0=text,
    Data1=room_2,
    FirstValueIndex=2,
    LastSaveLocalization="neutral,N")  # -> Key0, Key1, Data0, Data1
rooms_grouped_custom_sort = Room(multi_sort.Data1)
rooms_grouped_custom_sort_2 = ClusterOutput(rooms_grouped_custom_sort)
panel_3 = Panel(rooms_grouped_custom_sort)

# ==== cluster QueryOrCreateLayer
layer_path = ClusterInput()
layer_path_2 = Text(layer_path)
panel = Panel(layer_path_2)
query_model_layers = QueryModelLayers(Name=layer_path_2, AutoUpdateState=True)
model_layer = ModelLayer(Layer=layer_path_2)
null_item = NullItem(Item=query_model_layers)  # -> NullFlags, InvalidFlags, Description
stream_filter = StreamFilter(Gate=null_item.NullFlags, Stream0=query_model_layers, Stream1=model_layer)
model_layer_2 = ModelLayer(stream_filter)
model_layer_3 = ClusterOutput(model_layer_2)

# ==== cluster ShiftToDepthNativeCluster
depth = ClusterInput()
data = ClusterInput()

data_2 = Data(data)
depth_2 = Integer(depth)
tree_statistics = TreeStatistics(Tree=data_2)  # -> Paths, Length, Count
deconstruct_path = DeconstructPath(Branch=tree_statistics.Paths)
list_length = ListLength(List=deconstruct_path)
subtraction = Subtraction(A=list_length, B=depth_2)  # -> flatten(Result)
list_item = ListItem(List=subtraction, Index=0, Wrap=True)
negative = Negative(Value=list_item)
shift_paths = ShiftPaths(Data=data_2, Offset=negative)
data_3 = Data(shift_paths)

data_4 = ClusterOutput(data_3)

# ==== cluster Cluster
global_anno_scale = Slider(2, range=0..20)
drzwiwyszukane_geofiltered = ClusterInput()
kierunek_wejscia = ClusterInput()
project_north = ClusterInput()
layer_path = ClusterInput()

project_location = ProjectLocation()
drzwiwyszukane_geofiltered_2 = Plane(drzwiwyszukane_geofiltered)
plane = Plane(project_location)
line = Line(StartPoint=plane, EndPoint=drzwiwyszukane_geofiltered_2)
move = Move(Geometry=plane, Motion=line)  # -> Geometry, Transform
deconstruct_plane = DeconstructPlane(Plane=move.Geometry)  # -> Origin, XAxis, YAxis, ZAxis
line_sdl = LineSDL(Start=deconstruct_plane.Origin, Direction=deconstruct_plane.YAxis, Length=25)
plane_2 = Plane(deconstruct_plane.Origin)
true_north = Line(line_sdl)

# ---- group: Annotation Text Settings
arrow_1 = Arrow1(6)
multiplication = Multiplication(A=Slider(0.19, range=0..5), B=global_anno_scale)
multiplication_2 = Multiplication(A=Slider(0.09, range=0..5), B=global_anno_scale)
multiplication_3 = Multiplication(A=Slider(0.17, range=0..5), B=global_anno_scale)
annotation_arrow_settings = AnnotationArrowSettings(Arrow1=arrow_1, Arrow2=arrow_1, ArrowSize=multiplication_2, FitArrow=Slider(1, range=0..5))  # -> ArrowSettings, Arrow1, Arrow2, ArrowSize, FitArrow, DimensionInline, LeaderArrow, LeaderArrowSize
annotation_text_settings = AnnotationTextSettings(TextHeight=multiplication, TextGap=multiplication_3, FitText=Slider(1, range=0..5))

# ---- group: Strzalka True North
true_north_2 = Line(true_north)
multiplication_4 = Multiplication(A=Slider(0.12, range=0..5), B=global_anno_scale)
leader_arrow = LeaderArrow(9)
annotation_arrow_settings_2 = AnnotationArrowSettings(
    ArrowSize=multiplication_4,
    FitArrow=Slider(1, range=0..5),
    LeaderArrow=leader_arrow,
    LeaderArrowSize=Slider(0.32, range=0..5))
flip_curve = FlipCurve(Curve=true_north_2)  # -> Curve, Flag
multiplication_5 = Multiplication(A=Slider(0.05, range=0..0.1), B=global_anno_scale)
curve_middle = CurveMiddle(Curve=flip_curve.Curve)
leader = Leader(Curve=flip_curve.Curve, ArrowSettings=annotation_arrow_settings_2)
annotation_text_settings_2 = AnnotationTextSettings(
    TextHeight=multiplication_5,
    MaskFrame=Slider(2, range=0..10),
    HorizontalAlignment=Slider(1, range=0..5),
    VerticalAlignment=Slider(3, range=0..5))
text_entity = TextEntity(Plane=curve_middle, Text="N", TextSettings=annotation_text_settings_2)
leader_2 = Leader(leader)

# ----
number_slider = Slider(10, range=0..10)

layer_path_2 = Text(layer_path)
project_north_2 = Line(project_north)
kierunek_wejscia_2 = Line(kierunek_wejscia)

query_or_create_layer = QueryOrCreateLayer(layer_path=layer_path_2)

number_slider_2 = Slider(16, range=0..100)
line_2 = Line(kierunek_wejscia_2)
line_3 = Line(project_north_2)
extend_curve = ExtendCurve(Curve=line_2, Type=0, Start=0, End=number_slider_2)
extend_curve_2 = ExtendCurve(Curve=line_3, Type=0, Start=0, End=number_slider_2)

# ---- group: Strzalka Project North
line_4 = Line(extend_curve_2)
flip_curve_2 = FlipCurve(Curve=line_4)  # -> Curve, Flag

line_5 = Line(extend_curve)
drzwiwyszukane_geofiltered_3 = Plane(drzwiwyszukane_geofiltered_2)
flip_curve_3 = FlipCurve(Curve=line_5)  # -> Curve, Flag

multiplication_6 = Multiplication(A=Slider(0.12, range=0..5), B=global_anno_scale)
leader_arrow_2 = LeaderArrow(5)
multiplication_7 = Multiplication(A=Slider(0.32, range=0..5), B=global_anno_scale)
annotation_arrow_settings_3 = AnnotationArrowSettings(ArrowSize=multiplication_6, FitArrow=Slider(1, range=0..5), LeaderArrow=leader_arrow_2, LeaderArrowSize=multiplication_7)
leader_3 = Leader(Plane=drzwiwyszukane_geofiltered_3, Curve=flip_curve_3.Curve, ArrowSettings=annotation_arrow_settings_3)

drzwiwyszukane_geofiltered_4 = Plane(drzwiwyszukane_geofiltered_2)
multiplication_8 = Multiplication(A=Slider(0.12, range=0..5), B=global_anno_scale)
multiplication_9 = Multiplication(A=Slider(0.32, range=0..5), B=global_anno_scale)
leader_arrow_3 = LeaderArrow(8)
annotation_arrow_settings_4 = AnnotationArrowSettings(ArrowSize=multiplication_8, FitArrow=Slider(1, range=0..5), LeaderArrow=leader_arrow_3, LeaderArrowSize=multiplication_9)
leader_4 = Leader(Plane=drzwiwyszukane_geofiltered_4, Curve=flip_curve_2.Curve, ArrowSettings=annotation_arrow_settings_4)

curve_middle_2 = CurveMiddle(Curve=flip_curve_2.Curve)
multiplication_10 = Multiplication(A=Slider(0.05, range=0..0.1), B=global_anno_scale)
annotation_text_settings_3 = AnnotationTextSettings(
    TextHeight=multiplication_10,
    MaskFrame=Slider(2, range=0..10),
    HorizontalAlignment=Slider(1, range=0..5),
    VerticalAlignment=Slider(3, range=0..5))
text_entity_2 = TextEntity(Plane=curve_middle_2, Text="Proj N", TextSettings=annotation_text_settings_3)

multiplication_11 = Multiplication(A=Slider(0.05, range=0..0.1), B=global_anno_scale)
curve_middle_3 = CurveMiddle(Curve=flip_curve_3.Curve)
annotation_text_settings_4 = AnnotationTextSettings(
    TextHeight=multiplication_11,
    MaskFrame=Slider(2, range=0..10),
    HorizontalAlignment=Slider(1, range=0..5),
    VerticalAlignment=Slider(3, range=0..5))
text_entity_3 = TextEntity(Plane=curve_middle_3, Text="WEJSCIE", TextSettings=annotation_text_settings_4)

# ----
true_north_3 = Line(true_north)
kierunek_wejscia_3 = Line(kierunek_wejscia_2)
end_points = EndPoints(Curve=kierunek_wejscia_3)  # -> Start, End
end_points_2 = EndPoints(Curve=true_north_3)  # -> Start, End

# ---- group: Strzalka Project North
end_points_3 = EndPoints(Curve=extend_curve_2)  # -> Start, End
end_points_4 = EndPoints(Curve=extend_curve)  # -> Start, End

# ---- group: kat miedzy true north a wejsciem
angle_dimension_points = AngleDimensionPoints(
    Center=plane_2,
    PointA=end_points.End,
    PointB=end_points_2.End,
    TextSettings=annotation_text_settings,
    ArrowSettings=annotation_arrow_settings.ArrowSettings)  # -> AngleDimension, Center, PointA, PointB, DimensionLocation

# ---- group: Strzalka Project North / kat miedzy project north a wejsciem
angle_dimension_points_2 = AngleDimensionPoints(
    Center=plane_2,
    PointA=end_points_4.End,
    PointB=end_points_3.End,
    TextSettings=annotation_text_settings,
    ArrowSettings=annotation_arrow_settings.ArrowSettings)  # -> AngleDimension, Center, PointA, PointB, DimensionLocation

# ----
merge = Merge(Data1=leader_3, Data2=text_entity_3)
annotation_style_overrides = AnnotationStyleOverrides(Annotation=merge, ModelScale=number_slider)  # -> Annotation, Style
colour_swatch = ColourSwatch(SwatchColor=RGB(255, 0, 0))
model_object = ModelObject(Object=annotation_style_overrides.Annotation, Layer=query_or_create_layer, Display=colour_swatch)
custom_preview = CustomPreview(Geometry=merge, Material=colour_swatch)

merge_2 = Merge(Data1=angle_dimension_points.AngleDimension, Data2=leader_2, Data3=text_entity)
annotation_style_overrides_2 = AnnotationStyleOverrides(Annotation=merge_2, ModelScale=number_slider)  # -> Annotation, Style
colour_swatch_2 = ColourSwatch(SwatchColor=RGB(0, 0, 255))
model_object_2 = ModelObject(Object=annotation_style_overrides_2.Annotation, Layer=query_or_create_layer, Display=colour_swatch_2)
custom_preview_2 = CustomPreview(Geometry=merge_2, Material=colour_swatch_2)

merge_3 = Merge(Data1=angle_dimension_points_2.AngleDimension, Data2=text_entity_2, Data3=leader_4)
colour_swatch_3 = ColourSwatch(SwatchColor=RGB(255, 255, 0))
annotation_style_overrides_3 = AnnotationStyleOverrides(Annotation=merge_3, ModelScale=number_slider)  # -> Annotation, Style
model_object_3 = ModelObject(Object=annotation_style_overrides_3.Annotation, Layer=query_or_create_layer, Display=colour_swatch_3)
custom_preview_3 = CustomPreview(Geometry=merge_3, Material=colour_swatch_3)

merge_4 = Merge(Data1=model_object, Data2=model_object_3, Data3=model_object_2)
model_object_4 = ModelObject(simplify(merge_4))

model_object_5 = ClusterOutput(model_object_4)
angle_dimension = ClusterOutput(angle_dimension_points_2.AngleDimension)
angle_dimension_2 = ClusterOutput(angle_dimension_points.AngleDimension)

# ==== cluster KONTUROKNANARZUCIE
graphical_element = ClusterInput()
szeroki_zarkes_cropa = ClusterInput()
graphical_element_2 = GraphicalElement(graphical_element)
szeroki_zarkes_cropa_2 = Curve(szeroki_zarkes_cropa)
graphical_element_3 = ClusterOutput(graphical_element_2)
element_geometry = ElementGeometry(Elements=graphical_element_2, DetailLevel=1)  # -> simplify(Geometry)
element_location = ElementLocation(Element=graphical_element_2)  # -> Element, Location, Facing
bounding_box = BoundingBox(Content=element_geometry, Plane=graft(element_location.Location), UnionBox=True)  # -> simplify(Box), Box_2
box = Box(bounding_box.Box)
box_2 = ClusterOutput(box)
element_location_2 = ElementLocation(Element=graphical_element_2)  # -> Element, Location, Facing
unit_z = UnitZ(Factor=Slider(50, range=0..100))
extrude = Extrude(Base=szeroki_zarkes_cropa_2, Direction=unit_z)
align_plane = AlignPlane(Plane=element_location.Location, Direction=element_location.Facing)  # -> Plane, Angle
cap_holes = CapHoles(Brep=extrude)
plane = Plane(graft(align_plane.Plane))
mesh_brep = MeshBrep(
    Brep=cap_holes,
    Settings={GridMaxCount=0, GridMinCount=16, JaggedSeams=False, MaxEdgeLength=0, MinEdgeLength=0.0001, MinTolerance=0, Refine=True, RefineAngle=0, RelativeTolerance=0.65, SimplePlanes=True, Tolerance=0})
box_3 = Box(box)
scale_nu = ScaleNU(Geometry=box_3, Plane=plane, ScaleX=Slider(4.1, range=0..5), ScaleY=1, ScaleZ=1)  # -> Geometry, Transform
mesh = Mesh(flatten(scale_nu.Geometry))
clash = Clash(FirstSet=mesh_brep, SecondSet=mesh, Distance=0, ResultLimit=100)  # -> ClashCount, ClashPoints, ClashRadii, FirstIndex, SecondIndex
list_item = ListItem(List=flatten(box_3), Index=clash.SecondIndex, Wrap=True)
deconstruct_brep = DeconstructBrep(Brep=list_item)  # -> Faces, Edges, Vertices
list_item_2 = ListItem(List=deconstruct_brep.Faces, Index=0, Wrap=True)  # -> Item1, Item
surface = Surface(list_item_2.Item1)
shift_paths = ShiftPaths(Data=surface, Offset=Slider(-2, range=-3..3))
kontur_okna_na_rzucie = Curve(shift_paths)
kontur_okna_na_rzucie_2 = ClusterOutput(kontur_okna_na_rzucie)

# ==== cluster OgraniczZakres
data = ClusterInput()
gate = ClusterInput()
data_2 = Data(data)
gate_2 = Integer(gate)
tree_number = ClusterInput()
partition_size = ClusterInput()
stream_gate = StreamGate(Stream=data_2, Gate=gate_2)  # -> Target0, Target1
data_3 = Data(stream_gate.Target1)
tree_number_2 = Integer(tree_number)
partition_size_2 = Integer(partition_size)
tree_statistics = TreeStatistics(Tree=data_3)  # -> Paths, Length, Count
partition_list = PartitionList(List=tree_statistics.Paths, Size=partition_size_2)
tree_statistics_2 = TreeStatistics(Tree=partition_list)  # -> simplify(Paths), Length, Count
list_item = ListItem(List=tree_statistics_2.Paths, Index=tree_number_2, Wrap=True)
split_tree = SplitTree(Data=partition_list, Masks=flatten(list_item))  # -> Positive, Negative
split_tree_2 = SplitTree(Data=data_3, Masks=flatten(split_tree.Positive))  # -> Positive, Negative
data_4 = Data(split_tree_2.Positive)
stream_filter = StreamFilter(Gate=gate_2, Stream0=stream_gate.Target0, Stream1=data_4)
data_5 = Data(stream_filter)
data_6 = ClusterOutput(data_5)

# ==== cluster FILTROWANIEDRZWIIPRZYPISANIEDOMIESZKANIA
drzwiwyszukane = ClusterInput()
drzwiwyszukane_2 = GraphicalElement(simplify(graft(drzwiwyszukane)))
element_location = ElementLocation(Element=flatten(drzwiwyszukane_2))  # -> Element, Location, Facing
crop_region = ClusterInput()
align_plane = AlignPlane(Plane=element_location.Location, Direction=element_location.Facing)  # -> Plane, Angle
plane = Plane(align_plane.Plane)
number_slider = Slider(100, range=0..1000)
door_planes = Plane(plane)
deconstruct_plane = DeconstructPlane(Plane=door_planes)  # -> Origin, XAxis, YAxis, ZAxis
negative = Negative(Value=number_slider)
merge = Merge(Data1=number_slider, Data2=negative)
crop_region_2 = Curve(crop_region)
unit_z = UnitZ(Factor=Slider(50, range=0..100))
line_sdl = LineSDL(Start=deconstruct_plane.Origin, Direction=deconstruct_plane.XAxis, Length=merge)  # -> graft(Line)
extrude = Extrude(Base=crop_region_2, Direction=unit_z)
end_points = EndPoints(Curve=line_sdl)  # -> Start, End
merge_2 = Merge(Data1=end_points.Start, Data2=end_points.End)  # -> simplify(graft(Result))
cap_holes = CapHoles(Brep=extrude)
mesh_sphere = MeshSphere(Base=merge_2, Radius=10, UCount=10, VCount=20)
mesh_brep = MeshBrep(
    Brep=cap_holes,
    Settings={GridMaxCount=0, GridMinCount=16, JaggedSeams=False, MaxEdgeLength=0, MinEdgeLength=0.0001, MinTolerance=0, Refine=True, RefineAngle=0, RelativeTolerance=0.65, SimplePlanes=True, Tolerance=0})
collision_one_many = CollisionOneMany(Collider=mesh_sphere, Obstacles=flatten(mesh_brep))  # -> Collision, Index
shift_paths = ShiftPaths(Data=collision_one_many.Index, Offset=-1)
sort_list = SortList(Keys=shift_paths)  # -> Keys, ValuesVaA
match_text = MatchText(Text=sort_list.Keys, Pattern="-1", Case=True)
mass_addition = MassAddition(Input=match_text)  # -> Result, PartialResults
list_item = ListItem(List=sort_list.Keys, Index=0, Wrap=True)  # -> Item, Item1
panel = Panel(sort_list.Keys)
door_planes_2 = Plane(graft(door_planes))
integer = Integer(list_item.Item1)
boolean = Boolean(mass_addition.Result)
panel_2 = Panel(list_item.Item1)
dispatch = Dispatch(List=drzwiwyszukane_2, DispatchPattern=boolean)  # -> ListA, ListB
dispatch_2 = Dispatch(List=integer, DispatchPattern=boolean)  # -> ListA, ListB
dispatch_3 = Dispatch(List=door_planes_2, DispatchPattern=boolean)  # -> ListA, ListB
panel_3 = Panel(match_text)
integer_2 = Integer(flatten(dispatch_2.ListA))
drzwiwyszukane_3 = GraphicalElement(flatten(dispatch.ListA))
plane_2 = Plane(flatten(dispatch_3.ListA))
panel_4 = Panel(mass_addition.Result)
sort_list_2 = SortList(Keys=integer_2, ValuesVaA=drzwiwyszukane_3, ValuesA=plane_2)  # -> Keys, ValuesVaA, ValuesA
panel_5 = Panel(boolean)
integer_3 = Integer(simplify(graft(sort_list_2.Keys)))
panel_6 = Panel(dispatch.ListA)
plane_3 = Plane(simplify(graft(sort_list_2.ValuesA)))
drzwiwyszukane_4 = GraphicalElement(simplify(graft(sort_list_2.ValuesVaA)))
construct_path = ConstructPath(Indices=integer_3)  # -> flatten(Branch)

mesh = Mesh(mesh_brep)
tree_statistics = TreeStatistics(Tree=mesh)  # -> Paths, Length, Count
text = Text(tree_statistics.Paths)
text_2 = Text(construct_path)
set_difference = SetDifference(SetA=text, SetB=text_2)
list_length = ListLength(List=set_difference)
text_3 = Text(set_difference)
null_placeholder = NullPlaceholder()
duplicate_data = DuplicateData(Data=null_placeholder, Number=list_length, Order=True)
data = Data(simplify(graft(duplicate_data)))
tree_statistics_2 = TreeStatistics(Tree=data)  # -> Paths, Length, Count
replace_paths = ReplacePaths(Data=data, Search=tree_statistics_2.Paths, Replace=text_3)
null_placeholder_2 = Data(replace_paths)

tree_statistics_3 = TreeStatistics(Tree=integer_3)  # -> Paths, Length, Count
panel_7 = Panel(construct_path)
panel_8 = Panel(dispatch_2.ListA)
replace_paths_2 = ReplacePaths(Data=plane_3, Search=tree_statistics_3.Paths, Replace=construct_path)
replace_paths_3 = ReplacePaths(Data=drzwiwyszukane_4, Search=tree_statistics_3.Paths, Replace=construct_path)
merge_3 = Merge(Data1=replace_paths_3, Data2=null_placeholder_2)
merge_4 = Merge(Data1=replace_paths_2, Data2=null_placeholder_2)
drzwiwyszukane_geofiltered = GraphicalElement(merge_3)
drzwiwyszukane_geofiltered_2 = Plane(merge_4)
tree_statistics_4 = TreeStatistics(Tree=drzwiwyszukane_geofiltered)  # -> Paths, Length, Count
panel_9 = Panel(drzwiwyszukane_geofiltered)
match_text_2 = MatchText(Text=tree_statistics_4.Paths, Pattern="{-1}", Case=True)
dispatch_4 = Dispatch(List=tree_statistics_4.Paths, DispatchPattern=match_text_2)  # -> ListA, ListB
split_tree = SplitTree(Data=drzwiwyszukane_geofiltered_2, Masks=flatten(dispatch_4.ListB))  # -> Positive, Negative
split_tree_2 = SplitTree(Data=drzwiwyszukane_geofiltered, Masks=flatten(dispatch_4.ListB))  # -> Positive, Negative
plane_drzwiwyszukane_geofiltered = Plane(split_tree.Positive)
drzwiwyszukane_geofiltered_3 = GraphicalElement(split_tree_2.Positive)
plane_drzwiwyszukane_geofiltered_2 = ClusterOutput(plane_drzwiwyszukane_geofiltered)
drzwiwyszukane_geofiltered_4 = ClusterOutput(drzwiwyszukane_geofiltered_3)

# ==== cluster METODANAPRAWIENIAKONTURUDOROZWINIECIA
surface = ClusterInput()

# ---- group: METODA NAPRAWIENIA KONTURU (DO ROZWINIECIA)
surface_2 = Surface(surface)  # disabled
list_length = ListLength(List=surface_2)  # disabled
panel = Panel("1")  # disabled
larger_than = LargerThan(FirstNumber=list_length, SecondNumber=panel)  # -> LargerThan, OrEqualTo; disabled
dispatch = Dispatch(List=surface_2, DispatchPattern=larger_than.LargerThan)  # -> ListA, ListB; disabled
clean_tree = CleanTree(RemoveNulls=True, RemoveInvalid=True, RemoveEmpty=True, Tree=dispatch.ListA)  # disabled
clean_tree_2 = CleanTree(RemoveNulls=True, RemoveInvalid=True, RemoveEmpty=True, Tree=dispatch.ListB)  # disabled
surface_3 = Surface(clean_tree_2)  # disabled
surface_4 = Surface(clean_tree)  # disabled

surface_5 = Surface(simplify(surface_4))  # disabled
area = Area(Geometry=surface_5)  # -> Area, Centroid; disabled
list_item = ListItem(List=area.Centroid, Index=0, Wrap=True)  # disabled
sort_list = SortList(Keys=area.Area, ValuesValuesA=surface_5)  # -> reverse(Keys), reverse(simplify(ValuesValuesA)); disabled
surface_6 = Surface(sort_list.ValuesValuesA)  # disabled
list_item_2 = ListItem(List=surface_6, Index=0, Wrap=True)  # disabled
panel_2 = Panel("0")  # disabled
cull_index = CullIndex(List=surface_6, Indices=panel_2, Wrap=True)  # disabled
najwiekszy_surface = Surface(list_item_2)  # disabled
deconstruct_brep = DeconstructBrep(Brep=cull_index)  # -> Faces, Edges, simplify(Vertices); disabled
panel_3 = Panel("1")  # disabled
shift_to_depth_native_cluster = ShiftToDepthNativeCluster(data=deconstruct_brep.Vertices, depth=panel_3)  # disabled
shift_paths = ShiftPaths(Data=deconstruct_brep.Vertices, Offset=-1)  # disabled
pull_point = PullPoint(Point=shift_to_depth_native_cluster, Geometry=najwiekszy_surface, ClosestOnly=True)  # -> ClosestPoint, Distance, Index; disabled
cull_duplicates = CullDuplicates(Points=pull_point.ClosestPoint, Tolerance=0.1, CullMode=3)  # -> simplify(Points), Indices, Valence; disabled
pull_point_2 = PullPoint(Point=cull_duplicates.Points, Geometry=graft(cull_index), ClosestOnly=True)  # -> simplify(ClosestPoint), Distance, Index; disabled
plane = Plane(list_item)  # disabled
panel_4 = Panel("1")  # disabled
shift_to_depth_native_cluster_2 = ShiftToDepthNativeCluster(data=pull_point_2.ClosestPoint, depth=panel_4)  # disabled
suirify = Suirify(cull_duplicates.Points)  # disabled
merge = Merge(Data1=suirify, Data2=shift_to_depth_native_cluster_2)  # disabled
convex_hull = ConvexHull(Points=merge, Plane=plane)  # -> Hull, HullZ, Indices; disabled
geometric_cell = GeometricCell(Curves=convex_hull.Hull)  # disabled
surface_7 = Surface(surface_6)  # disabled
surface_8 = Surface(geometric_cell)  # disabled
suirify_2 = Suirify(surface_7)  # disabled
suirify_3 = Suirify(surface_8)  # disabled
merge_2 = Merge(Data1=suirify_2, Data2=suirify_3)  # disabled
region_union = RegionUnion(Curves=merge_2, Plane=plane)  # disabled
plane_2 = Plane(plane)  # disabled
surface_9 = Surface(region_union)  # disabled

number_slider = Slider(4, range=-50..50)  # disabled
plane_3 = Plane(plane_2)  # disabled
surface_10 = Surface(surface_9)  # disabled
curve = Curve(surface_10)  # disabled
number_slider_2 = Slider(-2, range=-5..5)  # disabled
clipper2_offset = Clipper2Offset(Polylines=curve, Distance=number_slider, JoinType=0, EndType=0, MiterLimit=2, Precision=4)  # -> Holes, Outer, ClipperPaths; disabled
multiplication = Multiplication(A=number_slider, B=number_slider_2)  # disabled
list_item_3 = ListItem(List=clipper2_offset.Outer, Index=0, Wrap=True)  # disabled
clipper2_offset_2 = Clipper2Offset(Polylines=list_item_3, Distance=multiplication, JoinType=0, EndType=0, MiterLimit=2, Precision=4)  # -> Holes, Outer, ClipperPaths; disabled
list_item_4 = ListItem(List=clipper2_offset_2.Holes, Index=0, Wrap=True)  # disabled
project = Project(Geometry=list_item_4, Plane=plane_3)  # -> Geometry, Transform; disabled
suirify_4 = Suirify(curve)  # disabled
suirify_5 = Suirify(project.Geometry)  # disabled
curve_2 = Curve(suirify_5)  # disabled
curve_3 = Curve(suirify_4)  # disabled
merge_3 = Merge(Data1=simplify(curve_3), Data2=simplify(curve_2))  # disabled
geometric_cell_2 = GeometricCell(Curves=merge_3)  # disabled
tree_statistics = TreeStatistics(Tree=geometric_cell_2)  # -> Paths, Length, Count; disabled
split_tree = SplitTree(Data=merge_3, Masks=flatten(tree_statistics.Paths))  # -> Positive, Negative; disabled
merge_4 = Merge(Data1=split_tree.Negative, Data2=geometric_cell_2)  # disabled
region_union_2 = RegionUnion(Curves=merge_4, Plane=plane_3)  # disabled
panel_5 = Panel("1")  # disabled
shift_to_depth_native_cluster_3 = ShiftToDepthNativeCluster(data=region_union_2, depth=panel_5)  # disabled
surface_11 = Surface(shift_to_depth_native_cluster_3)  # disabled

explode_tree = ExplodeTree(Data=clean_tree)  # -> Branch0, Branch1, Branch2, Branch3, Branch4, Branch5, Branch6, Branch7, Branch8; disabled
entwine = Entwine(
    Branch00=explode_tree.Branch0,
    Branch01=explode_tree.Branch3,
    Branch02=explode_tree.Branch1,
    Branch04=explode_tree.Branch7,
    Branch05=explode_tree.Branch8,
    FlattenInputs=True)  # disabled
surface_12 = Surface(surface_3)  # disabled
clean_tree_3 = CleanTree(RemoveNulls=True, RemoveInvalid=True, RemoveEmpty=True, Tree=entwine)  # disabled
area_2 = Area(Geometry=surface_11)  # -> Area, Centroid; disabled
sort_list_2 = SortList(Keys=area_2.Area, ValuesValuesA=surface_11)  # -> Keys, ValuesValuesA; disabled
list_item_5 = ListItem(List=sort_list_2.ValuesValuesA, Index=0, Wrap=True)  # disabled
surface_13 = Surface(surface_12)  # disabled
surface_14 = Surface(list_item_5)  # disabled
suirify_6 = Suirify(surface_13)  # disabled
merge_5 = Merge(Data1=surface_14, Data2=suirify_6)  # disabled
crop_region = Curve(merge_5)  # disabled
