# Grasshopper definition karty_mieszkan_-_rhino_blocks_do_revita.gh (Grasshopper 1.0.8)
# plug-ins: Heteroptera, treesloth01, Pufferfish, Rhino.Inside for Autodesk Revit, Human, MetaHopper, Pancake, Wombat, Clipper2

panel = Panel("""M2
M3""")

concatenate = Concatenate(FragmentA="ROOMS::*")  # -> graft(Result)
query_model_objects = QueryModelObjects(Layer=concatenate, Locked=True, Hidden=True, AutoUpdateState=False)  # -> graft(Objects), graft(BlockInstances)

# ---- group: MARINA SOPOT / FILTR WSTEPNY
query_model_objects_2 = QueryModelObjects(Locked=True, Hidden=True, AutoUpdateState=False)  # -> graft(Objects), graft(BlockInstances)
model_object = ModelObject(query_model_objects.Objects)

# ---- group: MARINA SOPOT / WYODREBNIJ CZYNNIK SORTUJACY
user_text = UserText(Content=model_object, Keys="PIG_NR KOMERCYJNY", UserTextMode=1)  # -> Content, Keys, Values
czym_sortowac = Text(user_text.Values)

# ---- group: MARINA SOPOT / OCZYSC I ODFILTRUJ PONOWNIE
model_object_2 = ModelObject(model_object)
czym_sortowac_2 = Text(czym_sortowac)
text_length = TextLength(Text=czym_sortowac_2)
equality = Equality(FirstNumber=text_length, SecondNumber="0")  # -> Equality, Inequality
dispatch = Dispatch(List=model_object_2, DispatchPattern=equality.Equality)  # -> ListA, ListB
dispatch_2 = Dispatch(List=czym_sortowac_2, DispatchPattern=equality.Equality)  # -> ListA, ListB
czym_sortowac_3 = Text(dispatch_2.ListB)
model_object_3 = ModelObject(dispatch.ListB)
match_text = MatchText(Text=czym_sortowac_3, RegEx="^[0-9]+$", Case=False)
dispatch_3 = Dispatch(List=model_object_3, DispatchPattern=match_text)  # -> ListA, ListB
dispatch_4 = Dispatch(List=czym_sortowac_3, DispatchPattern=match_text)  # -> ListA, ListB
czym_sortowac_4 = Text(flatten(dispatch_4.ListA))
model_object_4 = ModelObject(flatten(dispatch_3.ListA))

# ---- group: MARINA SOPOT
series = Series(Start=1, Step=1, Count="500")
panel_2 = Panel("2")
format = Format(Format="{0:000}", Culture=127, Data0=series)
partition_list = PartitionList(List=format, Size="300")
tree_statistics = TreeStatistics(Tree=partition_list)  # -> Paths, Length, Count
list_item = ListItem(List=tree_statistics.Paths, Index=Slider(0, range=0..30), Wrap=False)
split_tree = SplitTree(Data=partition_list, Masks=flatten(list_item))  # -> Positive, Negative

panel_3 = Panel("^\d+$")
panel_4 = Panel(split_tree.Positive)

# ---- group: MARINA SOPOT / dodaj 0 do integerow
integer = Integer(czym_sortowac_4)
format_2 = Format(Format="{0:000}", Culture=127, Data0=integer)

# ---- group: MARINA SOPOT / SORT
model_object_5 = ModelObject(model_object_4)
python_3_script = Python3Script(Keys=format_2, Values=model_object_5)  # -> out, SortedKeys, SortedValues; inputs Keys: list, Values: list; same code as python_3_script
czym_sortowac_5 = Text(python_3_script.SortedKeys)
model_object_6 = ModelObject(python_3_script.SortedValues)

# ---- group: MARINA SOPOT
czym_sortowac_6 = Text(czym_sortowac_5)
text = Text(split_tree.Positive)
model_object_7 = ModelObject(model_object_6)
match_text_2 = MatchText(Text=czym_sortowac_6, Pattern=graft(text), Case=False)
dispatch_5 = Dispatch(List=czym_sortowac_6, DispatchPattern=match_text_2)  # -> ListA, ListB
dispatch_6 = Dispatch(List=model_object_7, DispatchPattern=match_text_2)  # -> ListA, ListB
czym_sortowac_7 = Text(flatten(dispatch_5.ListA))
model_object_8 = ModelObject(flatten(dispatch_6.ListA))

# ---- group: MARINA SOPOT / PRZYPORZADKOWANIE / RHINO
czym_sortowac_8 = Text(czym_sortowac_7)
model_object_9 = ModelObject(model_object_8)

# ---- group: MANKOWSKA SOPOT / FILTR WSTEPNY
# A1
panel_5 = Panel("REV_Department::")
panel_6 = Panel("""M2
M3""")

concatenate_2 = Concatenate(FragmentA=panel_5, FragmentB=panel_6)  # -> graft(Result)
query_model_objects_3 = QueryModelObjects(Layer=concatenate_2, Locked=True, Hidden=True, AutoUpdateState=False)  # -> flatten(Objects)
model_object_10 = ModelObject(graft(query_model_objects_3))

# ----
model_object_11 = ModelObject([<model object referenced from the Rhino model> x32])

# ---- group: MANKOWSKA SOPOT / WYODREBNIJ CZYNNIK SORTUJACY
user_text_2 = UserText(Content=model_object_10, Keys="PIG_Nr Zbiorczy", UserTextMode=1)  # -> Content, Keys, Values
czym_sortowac_9 = Text(user_text_2.Values)

# ---- group: MANKOWSKA SOPOT / OGRANICZ ZAKRES - METODA ( MARINA)
series_2 = Series(Start=1, Step=1, Count="500")
format_3 = Format(Format="{0:000}", Culture=127, Data0=series_2)
partition_list_2 = PartitionList(List=format_3, Size="300")
tree_statistics_2 = TreeStatistics(Tree=partition_list_2)  # -> Paths, Length, Count
list_item_2 = ListItem(List=tree_statistics_2.Paths, Index=Slider(0, range=0..30), Wrap=False)
split_tree_2 = SplitTree(Data=partition_list_2, Masks=flatten(list_item_2))  # -> Positive, Negative
panel_9 = Panel(split_tree_2.Positive)

# ----
query_revit_views_fast = QueryRevitViewsFast()

# ---- group: TEST (MANKOWSKA)
# INFO: specjalnie pomieszane wartosci, maja one odpowiadac wybiorczym widokom z Revita. Np. gdy chcemy poprawic tylko kilka widokow.
number_slider = Slider(0, range=0..500)
panel_10 = Panel("""A/A/0/1
A/A/0/2
A/A/0/3
A/A/0/4
A/A/0/5
A/A/0/6
A/A/0/7
A/A/0/8
A/A/0/9
A/A/0/10
A/A/1/1
A/A/1/2
A/A/1/3
A/A/1/4
A/A/1/5
A/A/1/6
A/A/1/7
A/A/1/8
A/A/1/9
A/A/1/10
A/A/1/11
A/A/1/12
A/A/1/13
A/A/2/1
A/A/2/2
A/A/2/3
A/A/2/4
A/A/2/5
A/A/2/6
A/A/2/7
A/A/2/8
A/A/2/9
A/A/2/10
A/A/2/11
A/A/2/12
A/A/2/13
A/B/0/1
A/B/0/2
A/B/0/3
A/B/0/4
A/B/0/5
A/B/0/6
A/B/0/7
A/B/0/8
A/B/0/9
A/B/0/10
A/B/0/11
A/B/0/12
A/B/1/1
A/B/1/2
A/B/1/3
A/B/1/4
A/B/1/5
A/B/1/6
A/B/1/7
A/B/1/8
A/B/1/9
A/B/1/10
A/B/1/11
A/B/1/12
A/B/1/13
A/B/2/1
A/B/2/2
A/B/2/3
A/B/2/4
A/B/2/5
A/B/2/6
A/B/2/7
A/B/2/8
A/B/2/9
A/B/2/10
A/B/2/11
A/B/2/12
A/B/2/13""")
random_reduce = RandomReduce(List=panel_10, Reduction=number_slider, Seed=1)
concatenate_3 = Concatenate(FragmentA="M_KAT-01_", FragmentB=random_reduce)
text_2 = Text(concatenate_3)
sort_text = SortText(Keys=random_reduce, Values=text_2, Culture=127)  # -> Keys, Values
text_3 = Text(sort_text.Keys)
data = Data(sort_text.Values)

# ----
data_2 = Data(text_2)
text_4 = Text(random_reduce)
panel_11 = Panel(text_3)

# ---- group: MANKOWSKA SOPOT / PRZYPORZADKOWANIE / REVIT
data_3 = Data(data_2)
text_5 = Text(text_4)

# ---- group: VIEWPORTS
internalised_viewports = GraphicalElement(Tree({0;0;0}: [<viewport referenced from the Revit model>], {1;0;0}: [<viewport referenced from the Revit model>], {2;0;0}: [<viewport referenced from the Revit model>], {3;0;0}: [<viewport referenced from the Revit model>], {4;0;0}: [<viewport referenced from the Revit model>], {5;0;0}: [<viewport referenced from the Revit model>]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))

# ---- group: SHEETS
internalised_sheets = Sheet(Tree({0;0}: [<sheet referenced from the Revit model>], {1;0}: [<sheet referenced from the Revit model>], {2;0}: [<sheet referenced from the Revit model>], {3;0}: [<sheet referenced from the Revit model>], {4;0}: [<sheet referenced from the Revit model>], {5;0}: [<sheet referenced from the Revit model>]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))

# ---- group: TITLEBLOCKS
internalised_titleblocks = GraphicalElement(Tree({0;0}: [<familyinstance referenced from the Revit model>], {1;0}: [<familyinstance referenced from the Revit model>], {2;0}: [<familyinstance referenced from the Revit model>], {3;0}: [<familyinstance referenced from the Revit model>], {4;0}: [<familyinstance referenced from the Revit model>], {5;0}: [<familyinstance referenced from the Revit model>]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))

# ----
panel_12 = Panel("*")
user_text_3 = UserText(Content=model_object_10, UserTextMode=1)  # -> Content, Keys, Values
query_views = QueryViews(ViewName=":M_KAT_???", IsDependent=False, IsTemplate=False)

groupcolor = CSharpScript(Str="_REVIT-FILTERED", Col=ColourSwatch(SwatchColor=RGBA(85, 51, 255, 150)))  # inputs Str: String, Col: Color
# ---------- groupcolor: C# usings ----------
using System.Drawing;
using Grasshopper.Kernel.Special;
# ---------- groupcolor: C# ----------
    GH_Document doc = owner.OnPingDocument();
    if (doc == null)
      return;

    foreach (var obj in doc.Objects)
    {
      GH_Group _group = obj as GH_Group;
      if( _group == null)
        continue;

      if(_group.NickName.Contains(Str))
      {
        _group.Colour = Col;
      }

    }
# ---------- end groupcolor ----------

groupcolor_2 = CSharpScript(Str="_RHINO", Col=ColourSwatch(SwatchColor=RGB(0, 162, 255)))  # inputs Str: String, Col: Color; same code as groupcolor

panel_13 = Panel(user_text_3.Values)

# ---- group: TITLEBLOCKS
internalised_titleblocks_2 = GraphicalElement(Tree({0;0}: [<familyinstance referenced from the Revit model>], {1;0}: [<familyinstance referenced from the Revit model>], {2;0}: [<familyinstance referenced from the Revit model>], {3;0}: [<familyinstance referenced from the Revit model>], {4;0}: [<familyinstance referenced from the Revit model>], {5;0}: [<familyinstance referenced from the Revit model>]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))  # disabled

# ---- group: dependent views
view = View(Tree({0}: [<floorplan referenced from the Revit model>], {1}: [<floorplan referenced from the Revit model>], {2}: [<floorplan referenced from the Revit model>], {3}: [<floorplan referenced from the Revit model>], {4}: [<floorplan referenced from the Revit model>], {5}: [<floorplan referenced from the Revit model>]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))  # disabled

# ---- group: VIEWPORTS
internalised_viewports_2 = GraphicalElement(Tree({0;0;0}: [<viewport referenced from the Revit model>], {1;0;0}: [<viewport referenced from the Revit model>], {2;0;0}: [<viewport referenced from the Revit model>], {3;0;0}: [<viewport referenced from the Revit model>], {4;0;0}: [<viewport referenced from the Revit model>], {5;0;0}: [<viewport referenced from the Revit model>]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))  # disabled

# ---- group: SHEETS
internalised_sheets_2 = Sheet(Tree({0;0}: [<sheet referenced from the Revit model>], {1;0}: [<sheet referenced from the Revit model>], {2;0}: [<sheet referenced from the Revit model>], {3;0}: [<sheet referenced from the Revit model>], {4;0}: [<sheet referenced from the Revit model>], {5;0}: [<sheet referenced from the Revit model>]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))  # disabled

# ---- group: VIEW M_KAT_01-
view_2 = View(Tree({0;0;0}: [<floorplan referenced from the Revit model>], {1;0;0}: [<floorplan referenced from the Revit model>], {2;0;0}: [<floorplan referenced from the Revit model>], {3;0;0}: [<floorplan referenced from the Revit model>], {4;0;0}: [<floorplan referenced from the Revit model>], {5;0;0}: [<floorplan referenced from the Revit model>]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))  # disabled

# ----
group_toggle = GroupToggle(ToggleActive=True, ToggleVisible=False)  # disabled

# ---- group: MAP FILTERS
element = Element(Tree({0}: [<parameterfilterelement referenced from the Revit model>], {1}: [<parameterfilterelement referenced from the Revit model>], {2}: [<parameterfilterelement referenced from the Revit model>], {3}: [<parameterfilterelement referenced from the Revit model>], {4}: [<parameterfilterelement referenced from the Revit model>], {5}: [<parameterfilterelement referenced from the Revit model>]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))  # disabled

# ---- group: VIEW M_MAP-01
view_3 = View(Tree({0;0}: [<floorplan referenced from the Revit model>], {1;0}: [<floorplan referenced from the Revit model>], {2;0}: [<floorplan referenced from the Revit model>], {3;0}: [<floorplan referenced from the Revit model>], {4;0}: [<floorplan referenced from the Revit model>], {5;0}: [<floorplan referenced from the Revit model>]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))  # disabled

# ----
element_name = ElementName(Element=query_views)  # -> Element, Name
view_4 = View(query_views)
sort_text_2 = SortText(Keys=element_name.Name, Values=view_4, Culture=127)  # -> Keys, Values
text_6 = Text(sort_text_2.Keys)
panel_14 = Panel(user_text_3.Keys)
text_split = TextSplit(Text=text_6, Separators="_")
list_item_3 = ListItem(List=text_split, Index=0, Wrap=True)  # -> Item, Item1, simplify(Item2)
text_7 = Text(list_item_3.Item2)
panel_15 = Panel(list_item_3.Item2)
panel_16 = Panel(text_6)

rodzaj_karty = Panel("""M_KAT-01_
M_MAP-01_
U_KAT-01_
U_MAP-01_""")
item_selector = ItemSelector(rodzaj_karty, {"M_KAT-01_", "M_MAP-01_", "U_KAT-01_", "U_MAP-01_"}, selected="M_KAT-01_")

value_list = ValueList({"One": 1, "Two": 2, "Three": 2² - 1, "Four": Sqrt(16)}, selected="One")
panel_17 = Panel(item_selector)
panel_18 = Panel("U_KAT-01_")

# ---- group: dependent views
view_5 = View(Tree({0}: [<floorplan referenced from the Revit model>], {1}: [<floorplan referenced from the Revit model>], {2}: [<floorplan referenced from the Revit model>], {3}: [<floorplan referenced from the Revit model>], {4}: [<floorplan referenced from the Revit model>], {5}: [<floorplan referenced from the Revit model>]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))  # disabled

# ----
type = Type(
    <familysymbol referenced from the Revit model>,
    SelectedBuiltInCategory="autodesk.revit.category.family:genericAnnotation")
type_filter = TypeFilter(Types=type, Inverted=False)
category = Category(<category referenced from the Revit model>)
built_in_categories = BuiltInCategories("autodesk.revit.category.family:titleBlocks-1.0.0", SearchPattern="title")

# ---- group: ADD TITLEBLOCK
title_block_family_name = Panel("_PIG_KARTA_KATALOGOWA")
title_block_type_name = Panel("297 x 420")

query_categories = QueryCategories(Type="Annotation", Name="Title Blocks", IsVisibleUI=True, IsSubcategory=False)
query_types = QueryTypes(Kind=3, Category=query_categories, FamilyName=title_block_family_name, TypeName=title_block_type_name)
list_item_4 = ListItem(List=query_types, Index=0, Wrap=True)

# ----
group_toggle_2 = GroupToggle(ToggleActive=True, ToggleVisible=False)  # disabled

title_block_family_name_2 = Panel("_PIG_KARTA_KATALOGOWA")
title_block_type_name_2 = Panel("297 x 420")

graphical_element = GraphicalElement(<familyinstance referenced from the Revit model>)
category_2 = Category(<category referenced from the Revit model>)
element_type = ElementType(Element=graphical_element)  # -> Element, Type

# ---- group: dependent views
view_6 = View(flatten(Tree({0}: [<floorplan referenced from the Revit model>], {1}: [<floorplan referenced from the Revit model>], {2}: [<floorplan referenced from the Revit model>], {3}: [<floorplan referenced from the Revit model>], {4}: [<floorplan referenced from the Revit model>], {5}: [<floorplan referenced from the Revit model>]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)))

# ----
plane = Plane(PlaneXY(0.25, 20.9, 0))
add_symbol = AddSymbol(TrackingMode=2)
graphical_element_2 = GraphicalElement([<curveelement referenced from the Revit model> x2])
boolean = Boolean(True)
point = Point()
construct_domain = ConstructDomain(DomainStart=0, DomainEnd=1)
unit_z = UnitZ(Factor="100")
query_categories_2 = QueryCategories(Type=1, Name="Walls", IsVisibleUI=True, IsSubcategory=False)
number_slider_2 = Slider(5000, range=0..10000)
number_slider_3 = Slider(50, range=0..100)
category_filter = CategoryFilter(Categories=query_categories_2, Inverted=False)

# ---- group: OBRACANIE WIDOKU / dependent views
view_7 = View(Tree({0}: [<floorplan referenced from the Revit model>], {1}: [<floorplan referenced from the Revit model>], {2}: [<floorplan referenced from the Revit model>], {3}: [<floorplan referenced from the Revit model>], {4}: [<floorplan referenced from the Revit model>], {5}: [<floorplan referenced from the Revit model>]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))

# ----
panel_19 = Panel("""PIG_SW_a2_tynk łazienki_1.5 przedscianki
PIG_SW_y_Płyta_gk_1.5 przerywana
PIG_SW_a2_tynk łazienki_1.5 przedscianki
PIG_SW_!_Płyta_OSB_1.5""")
query_types_2 = QueryTypes(Kind=3, Category=query_categories_2)
query_elements = QueryElements(Filter=category_filter, Limit=Slider(30000, range=0..100000))  # -> Elements, Count
query_elements_2 = QueryElements(Filter=category_filter, Limit=Slider(30000, range=0..100000))  # -> Elements, Count
element_name_2 = ElementName(Element=query_types_2)  # -> Element, Name

# ---- group: lokalizacja miniatury
# INFO: prostokat z detail curves raz referenced zeby wyznaczyc pole w ktore bedzie wstawiany viewport
graphical_element_3 = GraphicalElement([<curveelement referenced from the Revit model> x4])
curve = Curve(graphical_element_3)
data_dam = DataDam(DataDaA=curve, BufferDelay=10000000, BufferMode=0)

# ---- group: ADD VIEWPORT / lokalizacja rzutu mieszkania
# INFO: prostokat z detail curves raz referenced zeby wyznaczyc pole w ktore bedzie wstawiany viewport
graphical_element_4 = GraphicalElement([<curveelement referenced from the Revit model> x4])
curve_2 = Curve(graphical_element_4)
data_dam_2 = DataDam(DataDaA=curve_2, BufferDelay=10000000, BufferMode=0)

# ----
element_type_2 = ElementType(Element=query_elements_2.Elements)  # -> Element, Type
data_4 = Data(graft(query_types_2))
multiple_match_z_wildcards = MultipleMatchZWildcards(data=graft(element_name_2.Name), keys=panel_19)  # -> out, Match; inputs data: list of String, keys: list of String
# ---------- multiple_match_z_wildcards: C# ----------
using System;
using System.Collections;
using System.Collections.Generic;

using Rhino;
using Rhino.Geometry;

using Grasshopper;
using Grasshopper.Kernel;
using Grasshopper.Kernel.Data;
using Grasshopper.Kernel.Types;
using System.Text.RegularExpressions;
/// <summary>
/// This class will be instantiated on demand by the Script component.
/// </summary>
public class Script_Instance : GH_ScriptInstance
{
  /// <summary>Print a String to the [Out] Parameter of the Script component.</summary>
  /// <param name="text">String to print.</param>
  private void Print(string text) { /* Implementation hidden. */ }
  /// <summary>Print a formatted String to the [Out] Parameter of the Script component.</summary>
  /// <param name="format">String format.</param>
  /// <param name="args">Formatting parameters.</param>
  private void Print(string format, params object[] args) { /* Implementation hidden. */ }
  /// <summary>Print useful information about an object instance to the [Out] Parameter of the Script component. </summary>
  /// <param name="obj">Object instance to parse.</param>
  private void Reflect(object obj) { /* Implementation hidden. */ }
  /// <summary>Print the signatures of all the overloads of a specific method to the [Out] Parameter of the Script component. </summary>
  /// <param name="obj">Object instance to parse.</param>
  private void Reflect(object obj, string method_name) { /* Implementation hidden. */ }

  /// <summary>Gets the current Rhino document.</summary>
  private readonly RhinoDoc RhinoDocument;
  /// <summary>Gets the Grasshopper document that owns this script.</summary>
  private readonly GH_Document GrasshopperDocument;
  /// <summary>Gets the Grasshopper script component that owns this script.</summary>
  private readonly IGH_Component Component;
  /// <summary>
  /// Gets the current iteration count. The first call to RunScript() is associated with Iteration==0.
  /// Any subsequent call within the same solution will increment the Iteration count.
  /// </summary>
  private readonly int Iteration;

  /// <summary>
  /// This procedure contains the user code. Input parameters are provided as regular arguments,
  /// Output parameters as ref arguments. You don't have to assign output parameters,
  /// they will have a default value.
  /// </summary>
  private void RunScript(List<string> data, List<string> keys, ref object Match)
  {


    // ...

    bool match = false;
    string pattern;

    for (int i = 0; i < keys.Count; i++)
    {
      // Convert the wildcard pattern to a regex pattern
      pattern = "^" + Regex.Escape(keys[i]).Replace("\\*", ".*") + "$";

      if (Regex.IsMatch(data[0], pattern))
      {
        match = true;
        break;
      }
    }

    Match = match;
  }

  // <Custom additional code> 

  // </Custom additional code> 
}
# ---------- end multiple_match_z_wildcards ----------
cluster = Cluster_2()
graphical_element_5 = GraphicalElement([<curveelement referenced from the Revit model> x2])
dispatch_7 = Dispatch(List=data_4, DispatchPattern=multiple_match_z_wildcards.Match)  # -> flatten(ListA), ListB

# ---- group: OBRACANIE WIDOKU
_2nd_component_wip = Python3Script(RUN=Toggle(True), angles=Slider(45, range=-360..360))  # -> out, out_views
# ---------- _2nd_component_wip: Python ----------
# Second Component Code: Rotate Crop Region Curves

import clr
import math

clr.AddReference("RevitAPI")
clr.AddReference('RhinoInside.Revit')

from Autodesk.Revit.DB import *
from RhinoInside.Revit import Revit
from System.Collections.Generic import List

# Get the active Revit document
uiapp = Revit.ActiveUIDocument
doc = uiapp.Document

if RUN_:
    outViews = []  # Output variable for processed views

    # Input validation for 'views' and 'angles'
    if views is None or angles is None:
        print("Please provide valid inputs for 'views' and 'angles'.")
    else:
        # Ensure 'views' and 'angles' are lists
        if not isinstance(views, list):
            views = [views]
        if not isinstance(angles, list):
            angles = [angles]

        if len(views) != len(angles):
            print("The number of views and angles must be the same.")
        else:
            for v, angle_degrees in zip(views, angles):
                if v is not None and isinstance(v, View) and isinstance(angle_degrees, (int, float)):
                    # Rotate the crop region curves
                    t = Transaction(doc, "Rotate Crop Region")
                    try:
                        t.Start()

                        # Ensure the crop box is active
                        if not v.CropBoxActive:
                            v.CropBoxActive = True

                        # Get the crop shape manager
                        crop_shape_manager = v.GetCropRegionShapeManager()
                        if not crop_shape_manager.CanHaveShape:
                            print(f"View '{v.Name}' cannot have a custom crop region shape.")
                            t.RollBack()
                            continue

                        # Get the current crop shape
                        original_crop_shape = crop_shape_manager.GetCropShape()
                        if original_crop_shape is None or original_crop_shape.Count == 0:
                            print(f"No crop shape to rotate for view '{v.Name}'.")
                            t.RollBack()
                            continue

                        # Calculate rotation angle in radians
                        rotation_angle_radians = math.radians(angle_degrees)

                        # Define rotation center
                        # Use the center of the crop box as the rotation center
                        crop_box = v.CropBox
                        transform = crop_box.Transform
                        center = transform.Origin  # Center of rotation

                        rotation_transform = Transform.CreateRotationAtPoint(XYZ.BasisZ, rotation_angle_radians, center)

                        # Rotate the crop region curves
                        rotated_crop_shape = List[CurveLoop]()
                        for curve_loop in original_crop_shape:
                            # Rotate the CurveLoop using CreateViaTransform
                            rotated_curve_loop = CurveLoop.CreateViaTransform(curve_loop, rotation_transform)
                            rotated_crop_shape.Add(rotated_curve_loop)

                        # Set the rotated crop shape back to the view
                        if rotated_crop_shape.Count == 1:
                            crop_shape_manager.SetCropShape(rotated_crop_shape[0])
                        else:
                            # Attempt to combine multiple CurveLoops into a single one
                            try:
                                combined_curves = List[Curve]()
                                for cl in rotated_crop_shape:
                                    for c in cl:
                                        combined_curves.Add(c)
                                combined_curve_loop = CurveLoop.Create(combined_curves)
                                crop_shape_manager.SetCropShape(combined_curve_loop)
                            except Exception as ex:
                                print(f"Unable to set crop shape for view '{v.Name}': {ex}")
                                t.RollBack()
                                continue

                        t.Commit()
                        print(f"Rotated crop region for view '{v.Name}' by {angle_degrees} degrees.")
                        outViews.append(v)
                    except Exception as e:
                        t.RollBack()
                        print(f"An error occurred while rotating crop region for view '{v.Name}': {e}")
                    finally:
                        t.Dispose()
                else:
                    print(f"Invalid view or angle for view '{v.Name}'.")
else:
    print("Set 'RUN_' to True to execute the script.")
# ---------- end _2nd_component_wip ----------

# ----
panel_20 = Panel(multiple_match_z_wildcards.Match)
curve_3 = Curve(graphical_element_5)
type_filter_2 = TypeFilter(Types=dispatch_7.ListA, Inverted=False)
pod_mieszkania = Curve([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])
curve_4 = Curve([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])
pod_miniatury = Curve([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])
curve_5 = Curve()
list_item_5 = ListItem(List=curve_3, Index=0, Wrap=True)  # -> Item, Item1
filter_elements = FilterElements(Elements=query_elements_2.Elements, Filter=type_filter_2)
curve_curve = CurveCurve(CurveA=list_item_5.Item, CurveB=list_item_5.Item1)  # -> Points, ParamsA, ParamsB
plane_2 = Plane(curve_curve.Points)
dispatch_8 = Dispatch(List=query_elements_2.Elements, DispatchPattern=filter_elements)  # -> ListA, ListB
element_2 = Element(dispatch_8.ListB)
element_3 = Element(dispatch_8.ListA)
inspect_element = InspectElement(Element=element_2)
graphical_element_6 = GraphicalElement(element_3)
plane_3 = Plane(curve_curve.Points)
boolean_2 = Boolean(inspect_element)
dispatch_9 = Dispatch(List=element_2, DispatchPattern=boolean_2)  # -> ListA, ListB
data_5 = Data(dispatch_9.ListA)
element_geometry = ElementGeometry(Elements=data_5)  # -> flatten(Geometry)

# ---- group: USTAW SKALE STARTOWA RZUTU / mapa
skala_startowa_rzutu = Panel("1250")

# ---- group: USTAW SKALE STARTOWA RZUTU / mieszkanie
skala_startowa_rzutu_2 = Panel("100")

# ----
query_views_2 = QueryViews(IsDependent=False, IsTemplate=False)
clipper2_union = Clipper2Union(UnionRule=0, Precision=4)
graphical_element_7 = GraphicalElement(<group referenced from the Revit model>)  # disabled
integer_2 = Integer("2")
query_revit_views_fast_2 = QueryRevitViewsFast_3(views=query_views_2, view_name=item_selector)
element_type_3 = ElementType(Element=graphical_element_7)  # -> Element, Type; disabled
type_2 = Type(element_type_3.Type)  # disabled

# ---- group: MINIATURY
karty_katalogowe = Panel("M_KAT-01_")  # disabled
karty_mapa = Panel("M_MAP-01_")  # disabled

# ----
graphical_element_8 = GraphicalElement(<group referenced from the Revit model>)  # disabled
type_filter_3 = TypeFilter(Types=type_2, Inverted=False)  # disabled
element_location = ElementLocation(Element=graphical_element_8)  # -> Element, Location, Hand, Facing, WorkPlane; disabled
type_3 = Type(graphical_element_8)  # disabled
geometry = Geometry(graphical_element_6)
panel_21 = Panel(element_location.Location)  # disabled
type_4 = Type(<elementtype referenced from the Revit model>)  # disabled
plane_4 = Plane(PlaneXY(7879.008923, -4378.019775, 186))  # disabled
type_5 = Type(
    <familysymbol referenced from the Revit model>,
    SelectedBuiltInCategory="autodesk.revit.category.family:genericAnnotation")
plane_5 = Plane(PlaneXY(-10.74184608, 8.428915343, 0))
number_slider_4 = Slider(4, range=0..10)
colour_swatch = ColourSwatch(SwatchColor=RGB(0, 0, 0))
inspect_element_2 = InspectElement()
custom_preview = CustomPreview(Geometry=geometry, Material=ColourSwatch(SwatchColor=RGBA(0, 123, 255, 12)))
panel_22 = Panel("RHI_rotacja (clockwise) wejscia do mieskzania wzgledem Project North")
titleblock_bounds = Curve([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])
dostepne_skale = Panel("""500
1000
1250
1500
1750
2000""")
join_curves = JoinCurves(Curves=titleblock_bounds, Preserve=False)
query_categories_3 = QueryCategories(Type=1, Name="Rooms", IsVisibleUI=True, IsSubcategory=False)

# ---- group: rooms
category_3 = Category(query_categories_3)

# ---- group: solid fill
foreground_pattern_surface_patterns = ForegroundPatternSurfacePatterns(<foreground pattern : surface patterns referenced from the Revit model>)

# ----
panel_23 = Panel("PW_KARTY_MIESZKAŃ_MAPA - WIP")
filter_graphic_overrides = FilterGraphicOverrides()  # -> View, Filter, Hidden, Overrides

# ---- group: MARINA SOPOT / TEST
series_3 = Series(Start=0, Step=1, Count="500")
random_reduce_2 = RandomReduce(List=series_3, Reduction=Slider(0, range=0..500), Seed=1)

# ---- group: MARINA SOPOT / TEST / dodaj 0 do integerow
integer_3 = Integer(random_reduce_2)
format_4 = Format(Format="{0:000}", Culture=127, Data0=integer_3)

# ---- group: MARINA SOPOT / TEST (continued)
concatenate_4 = Concatenate(FragmentA="M_KAT-01_", FragmentB=format_4)
text_8 = Text(concatenate_4)
sort_text_3 = SortText(Keys=format_4, Values=text_8, Culture=127)  # -> Keys, Values

# ---- group: MARINA SOPOT / PRZYPORZADKOWANIE / REVIT
data_6 = Data(sort_text_3.Values)
text_9 = Text(sort_text_3.Keys)

# ---- group: MARINA SOPOT / PRZYPORZADKOWANIE
match_text_3 = MatchText(Text=graft(text_9), Pattern=czym_sortowac_8, Case=True)
dispatch_10 = Dispatch(List=czym_sortowac_8, DispatchPattern=match_text_3)  # -> flatten(ListA), ListB
dispatch_11 = Dispatch(List=model_object_9, DispatchPattern=match_text_3)  # -> flatten(ListA), ListB
data_7 = Data(dispatch_10.ListA)
match_text_4 = MatchText(Text=graft(data_7), Pattern=text_9, Case=True)
dispatch_12 = Dispatch(List=data_6, DispatchPattern=match_text_4)  # -> ListA, ListB
dispatch_13 = Dispatch(List=text_9, DispatchPattern=match_text_4)  # -> ListA, ListB

# ---- group: MARINA SOPOT / PRZYPORZADKOWANIE / _RHINO
czym_sortowac_10 = Text(simplify(graft(data_7)))
model_objects_odpowiadajace_wskazanym_wi = ModelObject(simplify(graft(dispatch_11.ListA)))  # "MODEL OBJECTS ODPOWIADAJACE WSKAZANYM WIDOKOM"

# ---- group: MARINA SOPOT / PRZYPORZADKOWANIE / REVIT
nazwy_widokow_sheetow = Text(simplify(dispatch_13.ListA))
widoki_sheety = Data(simplify(dispatch_12.ListA))

# ----
model_object_12 = ModelObject(dispatch_11.ListA)  # disabled
text_10 = Text(dispatch_10.ListA)  # disabled
create_set = CreateSet(List=text_10)  # -> Set, Map; disabled
member_index = MemberIndex(Set=text_10, Member=create_set.Set)  # -> Index, Count; disabled
list_item_6 = ListItem(List=text_10, Index=member_index.Index, Wrap=True)  # disabled
list_item_7 = ListItem(List=model_object_12, Index=member_index.Index, Wrap=True)  # disabled

list_item_8 = ListItem(List=flatten(dispatch_12.ListA), Index=member_index.Index, Wrap=True)  # disabled
list_item_9 = ListItem(List=flatten(dispatch_13.ListA), Index=member_index.Index, Wrap=True)  # disabled

widoki_sheety_2 = Data(simplify(list_item_8))  # disabled
nazwy_widokow_sheetow_2 = Text(simplify(list_item_9))  # disabled

text_11 = Text(simplify(list_item_6))  # disabled
model_object_13 = ModelObject(simplify(list_item_7))  # disabled

model_objects_odpowiadajace_wskazanym_wi_2 = Data(model_objects_odpowiadajace_wskazanym_wi)  # "MODEL OBJECTS ODPOWIADAJACE WSKAZANYM WIDOKOM"
model_object_14 = ModelObject(model_objects_odpowiadajace_wskazanym_wi_2)
user_text_4 = UserText(Content=model_object_14, UserTextMode=1)  # -> Content, Keys, Values
panel_24 = Panel(user_text_4.Values)
czym_sortowac_11 = Data(czym_sortowac_10)
panel_25 = Panel(model_objects_odpowiadajace_wskazanym_wi_2)

# ---- group: ADD VIEWS / _RHINO
text_12 = Text(czym_sortowac_11)  # disabled
model_object_15 = ModelObject(model_objects_odpowiadajace_wskazanym_wi_2)  # disabled

# ---- group: ADD VIEWS
# A2
panel_26 = Panel("Flat Floor Plan")
# VIEWS
rodzaj_karty_2 = Panel(item_selector)
user_text_5 = UserText(Content=model_object_15, Keys=panel_26, UserTextMode=1)  # -> Content, Keys, Values

# ----
user_text_6 = UserText(Content=model_objects_odpowiadajace_wskazanym_wi_2, UserTextMode=1)  # -> Content, Keys, Values

# ---- group: ADD DEPENDENT VIEW
model_object_16 = ModelObject(model_objects_odpowiadajace_wskazanym_wi_2)
text_13 = Text(czym_sortowac_11)
user_text_7 = UserText(Content=model_object_16, Keys="Flat Floor Plan", UserTextMode=1)  # -> Content, Keys, Values
text_split_2 = TextSplit(Text=user_text_7.Values, Separators=":")
list_item_10 = ListItem(List=text_split_2, Index=0, Wrap=True)  # -> Item, Item1, Item2
text_trim = TextTrim(Text=list_item_10.Item2, Start=True, End=True)
text_split_3 = TextSplit(Text=text_trim, Separators="id")
replace_members = ReplaceMembers(Set=text_split_3)
integer_4 = Integer(replace_members)
query_element = QueryElement(Id=integer_4)  # -> simplify(Element)
karty_katalogowe_2 = Panel("M_KAT-01-dep_")
duplicate_element = DuplicateElement(Elements=query_element)  # disabled
concatenate_5 = Concatenate(FragmentA=karty_katalogowe_2, FragmentB=text_13)
add_dependent_view = AddDependentView(View=query_element, TrackingMode=2)  # -> View, Dependent; disabled
element_name_3 = ElementName(Element=duplicate_element, Name=concatenate_5)  # -> Element, Name; disabled
element_name_4 = ElementName(Element=add_dependent_view.Dependent, Name=concatenate_5)  # -> Element, Name; disabled
view_8 = View(element_name_3.Element)  # disabled
panel_27 = Panel(query_element)  # disabled

# ----
panel_28 = Panel(user_text_6.Keys)
model_objects_odpowiadajace_wskazanym_wi_3 = ModelObject(model_objects_odpowiadajace_wskazanym_wi_2)  # "MODEL OBJECTS ODPOWIADAJACE WSKAZANYM WIDOKOM"

# ---- group: OBRACANIE WIDOKU / _RHINO
model_object_17 = ModelObject(model_objects_odpowiadajace_wskazanym_wi_2)
text_14 = Text(czym_sortowac_11)

# ---- group: OBRACANIE WIDOKU
rodzaj_karty_3 = Panel(item_selector)
concatenate_6 = Concatenate(FragmentA=rodzaj_karty_3, FragmentB=text_14)
query_revit_views_fast_3 = QueryRevitViewsFast_2(view_name=concatenate_6)
view_9 = View(query_revit_views_fast_3)

# ---- group: MINIATURY
concatenate_7 = Concatenate(FragmentA=karty_katalogowe, FragmentB=model_objects_odpowiadajace_wskazanym_wi_2)  # disabled
query_views_3 = QueryViews(ViewName=concatenate_7, IsDependent=False, IsTemplate=False)  # disabled

# ----
number_slider_5 = Slider(118, range=0..1000)  # disabled
model_object_18 = ModelObject(model_objects_odpowiadajace_wskazanym_wi_2)
view_10 = View(simplify(graft(sort_text_2.Values)))
model_object_19 = ModelObject(Object=model_object_18)  # -> Object, Name; disabled
smaller_than = SmallerThan(FirstNumber=model_object_19.Name, SecondNumber=number_slider_5)  # -> SmallerThan, OrEqualTo; disabled
dispatch_14 = Dispatch(List=view_10, DispatchPattern=smaller_than.SmallerThan)  # -> ListA, ListB; disabled
dispatch_15 = Dispatch(List=model_object_19.Object, DispatchPattern=smaller_than.SmallerThan)  # -> ListA, ListB; disabled
clean_tree = CleanTree(RemoveNulls=True, RemoveInvalid=True, RemoveEmpty=True, Tree=dispatch_14.ListA)  # disabled
model_object_20 = ModelObject(dispatch_15.ListA)  # disabled
clean_tree_2 = CleanTree(RemoveNulls=True, RemoveInvalid=True, RemoveEmpty=True, Tree=model_object_20)  # disabled
view_11 = View(clean_tree)  # disabled
panel_29 = Panel("RHI_Lista pomieszczen wewnetrznych")  # disabled
model_object_21 = ModelObject(clean_tree_2)  # disabled
user_text_8 = UserText(Content=model_object_21, Keys=panel_29, UserTextMode=1)  # -> Content, Keys, Values; disabled
explode_object = ExplodeObject(Object=model_object_21, Recursive=False)  # disabled
text_split_4 = TextSplit(Text=user_text_8.Values, Separators=";")  # disabled
panel_30 = Panel("Surfaces")  # disabled
equality_filter = EqualityFilter(Value=panel_30)  # -> Equal, Unequal; disabled
filter_content = FilterContent(Content=explode_object, Filter=equality_filter.Equal)  # disabled
panel_31 = Panel("Grupa pomieszczen")  # disabled
panel_32 = Panel("wewnetrzne")  # disabled
panel_33 = Panel("zewnetrzne")  # disabled
equality_filter_2 = EqualityFilter(Key=panel_31, Value=panel_33)  # -> Equal, Unequal; disabled
filter_content_2 = FilterContent(Content=filter_content, Filter=equality_filter_2.Equal)  # disabled
panel_34 = Panel("REV_Unique ID")  # disabled
user_text_9 = UserText(Content=filter_content_2, Keys=panel_34, UserTextMode=1)  # -> Content, Keys, simplify(Values); disabled
query_element_2 = QueryElement(Id=user_text_9.Values)  # disabled
shift_paths = ShiftPaths(Data=query_element_2, Offset=-1)  # disabled
type_6 = Type(<familysymbol referenced from the Revit model>)  # disabled
tag_room = TagRoom(View=view_11, Room=shift_paths, Type=type_6, TrackingMode=2)  # disabled
tag_room_2 = TagRoom(View=view_11, Room=shift_paths, Type=type_6)  # disabled

user_text_10 = UserText(Content=model_objects_odpowiadajace_wskazanym_wi_2, Keys=panel_22, UserTextMode=1)  # -> Content, Keys, Values
integer_5 = Integer(user_text_10.Values)
integer_6 = Integer(integer_5)
panel_35 = Panel(shift_paths)

# ---- group: NIE WIEM CZY TO POTRZEBNE
input_method = ValueList({"Query at start": 1, "Stream from the previous step": 0, "DISABLE": 2}, selected="Query at start")
option_number = Integer(input_method)
query_sheets = QuerySheets(Placeholder=False, AppearsInSheetList=True, Assembly=null)  # disabled

# ---- group: NIE WIEM CZY TO POTRZEBNE / query by name
rodzaj_karty_4 = Text(item_selector)
view_names = Text(czym_sortowac_11)
stream_gate = StreamGate(Stream=view_names, Gate=option_number)  # -> Target0, Target1, Target2
rodzaj_karty_5 = Panel("M_KAT-01_")
text_15 = Text(stream_gate.Target1)
concatenate_8 = Concatenate(FragmentA=rodzaj_karty_4, FragmentB=text_15)
query_views_4 = QueryViews(ViewName=concatenate_8, IsDependent=False, IsTemplate=False)  # disabled

# ---- group: NIE WIEM CZY TO POTRZEBNE
view_name = Text(concatenate_8)
query_views_5 = QueryViews(IsDependent=False, IsTemplate=False)
element_name_5 = ElementName(Element=query_views_5)  # -> Element, Name
match_text_5 = MatchText(Text=element_name_5.Name, Pattern=view_name, Case=True)
dispatch_16 = Dispatch(List=query_views_5, DispatchPattern=match_text_5)  # -> ListA, ListB
views = View(dispatch_16.ListA)

# ---- group: NIE WIEM CZY TO POTRZEBNE / query by name (continued)
view_12 = View(views)

# ---- group: NIE WIEM CZY TO POTRZEBNE
null_placeholder = NullPlaceholder()
null_placeholder_2 = NullPlaceholder()

boolean_toggle = BooleanToggle(True)  # disabled
group_toggle_3 = GroupToggle(ToggleActive=True, ToggleVisible=False)  # disabled

# ---- group: FILTROWANIE I SORTOWANIE
czym_sortowac_12 = Text(czym_sortowac_9)
model_object_22 = ModelObject(model_object_10)
value_list_2 = ValueList({"PONOWNIE FILTRUJ": 0, "NIE FILTRUJ PONOWNIE": 1}, selected="PONOWNIE FILTRUJ")

# ---- group: FILTROWANIE I SORTOWANIE / OCZYSC WSTEPNIE
text_length_2 = TextLength(Text=czym_sortowac_12)
equality_2 = Equality(FirstNumber=text_length_2, SecondNumber="0")  # -> Equality, Inequality
dispatch_17 = Dispatch(List=czym_sortowac_12, DispatchPattern=equality_2.Equality)  # -> ListA, ListB
dispatch_18 = Dispatch(List=model_object_22, DispatchPattern=equality_2.Equality)  # -> ListA, ListB
czym_sortowac_13 = Text(dispatch_17.ListB)
model_object_23 = ModelObject(dispatch_18.ListB)

# ---- group: FILTROWANIE I SORTOWANIE / METODA
panel_36 = Panel("^[A-Za-z]/[A-Za-z]/\d+/\d+$")
sortuj_metoda_mankowska = SORTUJMETODAMANKOWSKA(model_object=flatten(model_object_23), czym_sortowac=flatten(czym_sortowac_13))  # -> natural_sort_4, zero_padded_strings_2, model_object_5

# ---- group: FILTROWANIE I SORTOWANIE
sortuj_metoda_marina = SORTUJMETODAMARINA(model_object=model_object_23, czym_sortowac=czym_sortowac_13, regex="^[0-9]+$")  # -> czym_sortowac_5, model_object_5; disabled

# ---- group: FILTROWANIE I SORTOWANIE / NIE SORTUJ
model_object_24 = ModelObject(model_object_23)
czym_sortowac_14 = Text(czym_sortowac_13)

# ---- group: FILTROWANIE I SORTOWANIE (continued)
stream_filter = StreamFilter(Gate=value_list_2, Stream0=sortuj_metoda_mankowska.natural_sort_4, Stream1=czym_sortowac_14)
stream_filter_2 = StreamFilter(Gate=value_list_2, Stream0=sortuj_metoda_mankowska.model_object_5, Stream1=model_object_24)
po_sortowaniu = Text(stream_filter)
po_sortowaniu_2 = ModelObject(stream_filter_2)

# ---- group: MANKOWSKA SOPOT / OGRANICZ ZAKRES - METODA (MANKOWSKA)
partition_list_3 = PartitionList(List=flatten(po_sortowaniu), Size="20")
tree_statistics_3 = TreeStatistics(Tree=partition_list_3)  # -> Paths, Length, Count
list_item_11 = ListItem(List=tree_statistics_3.Paths, Index=Slider(3, range=0..30), Wrap=False)
split_tree_3 = SplitTree(Data=partition_list_3, Masks=flatten(list_item_11))  # -> Positive, Negative
panel_37 = Panel(split_tree_3.Positive)

# ---- group: MANKOWSKA SOPOT / TEST (MARINA)
series_4 = Series(Start=0, Step=1, Count="500")
random_reduce_3 = RandomReduce(List=series_4, Reduction=Slider(0, range=0..500), Seed=1)

# ---- group: MANKOWSKA SOPOT / TEST (MARINA) / dodaj 0 do integerow
integer_7 = Integer(random_reduce_3)
format_5 = Format(Format="{0:000}", Culture=127, Data0=integer_7)

# ---- group: MANKOWSKA SOPOT / TEST (MARINA) (continued)
concatenate_9 = Concatenate(FragmentA="M_KAT-01_", FragmentB=format_5)
text_16 = Text(concatenate_9)
sort_text_4 = SortText(Keys=format_5, Values=text_16, Culture=127)  # -> Keys, Values
data_8 = Data(sort_text_4.Values)
text_17 = Text(sort_text_4.Keys)

# ----
value_list_3 = ValueList({"OGRANICZ ZAKRES": 0, "NIE OGRANICZAJ ZAKRESU": 1}, selected="NIE OGRANICZAJ ZAKRESU")
po_sortowaniu_3 = Text(po_sortowaniu)
po_sortowaniu_4 = ModelObject(po_sortowaniu_2)

# ---- group: OGRANICZ ZAKRES
text_18 = Text(split_tree_3.Positive)
match_text_6 = MatchText(Text=po_sortowaniu_3, Pattern=graft(text_18), Case=False)
dispatch_19 = Dispatch(List=po_sortowaniu_4, DispatchPattern=match_text_6)  # -> ListA, ListB
dispatch_20 = Dispatch(List=po_sortowaniu_3, DispatchPattern=match_text_6)  # -> ListA, ListB
model_object_25 = ModelObject(flatten(dispatch_19.ListA))
czym_sortowac_15 = Text(flatten(dispatch_20.ListA))

# ---- group: NIE OGRANICZAJ ZAKRESU
czym_sortowac_16 = Text(po_sortowaniu_3)
model_object_26 = ModelObject(po_sortowaniu_4)

# ----
stream_filter_3 = StreamFilter(Gate=value_list_3, Stream0=czym_sortowac_15, Stream1=czym_sortowac_16)
stream_filter_4 = StreamFilter(Gate=value_list_3, Stream0=model_object_25, Stream1=model_object_26)
po_sortowaniu_5 = Text(stream_filter_3)
po_sortowaniu_6 = ModelObject(stream_filter_4)

# ---- group: MANKOWSKA SOPOT / PRZYPORZADKOWANIE / RHINO
po_sortowaniu_7 = Text(po_sortowaniu_5)
po_sortowaniu_8 = ModelObject(po_sortowaniu_6)

# ---- group: MANKOWSKA SOPOT / PRZYPORZADKOWANIE
value_list_4 = ValueList({"OGRANICZ DO PRZYPORZADKOWANYCH": 1, "NIE OGRANICZAJ DO PRZYPORZADKOWANYCH": 0}, selected="NIE OGRANICZAJ DO PRZYPORZADKOWANYCH")
dispatch_21 = Dispatch(List=po_sortowaniu_7, DispatchPattern=value_list_4)  # -> ListA, ListB
dispatch_22 = Dispatch(List=po_sortowaniu_8, DispatchPattern=value_list_4)  # -> ListA, ListB
match_text_7 = MatchText(Text=graft(text_5), Pattern=po_sortowaniu_7, Case=True)
dispatch_23 = Dispatch(List=dispatch_21.ListA, DispatchPattern=match_text_7)  # -> flatten(ListA), ListB
dispatch_24 = Dispatch(List=dispatch_22.ListA, DispatchPattern=match_text_7)  # -> flatten(ListA), ListB
data_9 = Data(dispatch_23.ListA)
match_text_8 = MatchText(Text=graft(data_9), Pattern=text_5, Case=True)
dispatch_25 = Dispatch(List=data_3, DispatchPattern=match_text_8)  # -> ListA, ListB
dispatch_26 = Dispatch(List=text_5, DispatchPattern=match_text_8)  # -> ListA, ListB

# ---- group: MANKOWSKA SOPOT / PRZYPORZADKOWANIE / _RHINO
model_objects_odpowiadajace_wskazanym_wi_4 = ModelObject(simplify(graft(dispatch_22.ListB)))  # "MODEL OBJECTS ODPOWIADAJACE WSKAZANYM WIDOKOM"; disabled
czym_sortowac_17 = Text(simplify(graft(dispatch_21.ListB)))  # disabled

# ---- group: MANKOWSKA SOPOT / PRZYPORZADKOWANIE / REVIT
nazwy_widokow_sheetow_3 = Text(simplify(dispatch_26.ListA))
widoki_sheety_3 = Data(simplify(dispatch_25.ListA))

# ----
data_10 = Data(dispatch_23.ListA)
data_11 = Data(internalised_sheets_2)
sheet_identity = SheetIdentity(Sheet=data_11)
text_19 = Text(Tree({0;0}: ["SHT_M_KAT-01_001"], {1;0}: ["SHT_M_KAT-01_002"], {2;0}: ["SHT_M_KAT-01_003"], {3;0}: ["SHT_M_KAT-01_004"], {4;0}: ["SHT_M_KAT-01_005"], {5;0}: ["SHT_M_KAT-01_006"]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))
text_split_5 = TextSplit(Text=text_19, Separators="_")
list_item_12 = ListItem(List=text_split_5, Index=0, Wrap=True)  # -> Item1, Item
match_text_9 = MatchText(Text=graft(data_10), Pattern=flatten(list_item_12.Item1), Case=True)
dispatch_27 = Dispatch(List=flatten(view_3), DispatchPattern=match_text_9)  # -> ListA, ListB
dispatch_28 = Dispatch(List=flatten(element), DispatchPattern=match_text_9)  # -> ListA, ListB
dispatch_29 = Dispatch(List=flatten(view_2), DispatchPattern=match_text_9)  # -> ListA, ListB
dispatch_30 = Dispatch(List=flatten(internalised_viewports_2), DispatchPattern=match_text_9)  # -> ListA, ListB
dispatch_31 = Dispatch(List=flatten(internalised_titleblocks_2), DispatchPattern=match_text_9)  # -> ListA, ListB
dispatch_32 = Dispatch(List=flatten(data_11), DispatchPattern=match_text_9)  # -> ListA, ListB

data_12 = Data(nazwy_widokow_sheetow_3)
data_13 = Data(widoki_sheety_3)

# ---- group: _REVIT-FILTERED / VIEW M_MAP-01
view_13 = View(dispatch_27.ListA)

# ---- group: _REVIT-FILTERED / SHEETS
internalised_sheets_3 = Sheet(dispatch_32.ListA)

# ---- group: _REVIT-FILTERED / VIEW M_KAT_01-
view_14 = View(dispatch_29.ListA)

# ---- group: _REVIT-FILTERED / VIEWPORTS
internalised_viewports_3 = GraphicalElement(dispatch_30.ListA)

# ---- group: _REVIT-FILTERED / TITLEBLOCKS
internalised_titleblocks_3 = GraphicalElement(dispatch_31.ListA)

# ---- group: _REVIT-FILTERED / MAP FILTERS
element_4 = Element(dispatch_28.ListA)

# ----
data_dam_3 = DataDam(DataDataA=view_13, BufferDelay=10000000, BufferMode=0)
data_dam_4 = DataDam(DataDataA=element_4, BufferDelay=10000000, BufferMode=0)
data_dam_5 = DataDam(DataDataA=view_14, BufferDelay=10000000, BufferMode=0)
data_dam_6 = DataDam(DataDataA=internalised_viewports_3, BufferDelay=10000000, BufferMode=0)
data_dam_7 = DataDam(DataDataA=internalised_titleblocks_3, BufferDelay=10000000, BufferMode=0)
data_dam_8 = DataDam(DataDataA=internalised_sheets_3, BufferDelay=10000000, BufferMode=0)

# ---- group: VIEW M_KAT_01-
view_15 = View(data_dam_5)  # disabled

# ----
view_crop_region = ViewCropRegion(View=flatten(view_15))  # -> View, CropView, CropRegionVisible, CropRegion; disabled
view_crop_region_2 = ViewCropRegion(View=flatten(view_5), CropRegion=view_crop_region.CropRegion)  # -> View, CropView, CropRegionVisible, CropRegion; disabled

view_16 = View(data_dam_5)
query_view_elements = QueryViewElements(View=view_16, Categories=category, Filter=type_filter)  # disabled
element_type_4 = ElementType(Element=query_view_elements)  # -> Element, flatten(Type)
element_location_2 = ElementLocation(Element=query_view_elements)  # -> Element, Location, Hand, Facing, WorkPlane
list_item_13 = ListItem(List=element_type_4.Type, Index=0, Wrap=True)
element_location_3 = ElementLocation(Element=data_dam_6)  # -> Element, Location, Hand, Facing, WorkPlane; disabled
clone_element = CloneElement(Element=flatten(query_view_elements), Location=flatten(element_location_2.Location), View=view_6, TrackingMode=2)  # disabled

# ---- group: _REVIT-FILTERED
view_17 = View(data_dam_3)  # disabled

# ----
list_item_14 = ListItem(List=flatten(view_17), Index=0, Wrap=True)  # disabled
boolean_toggle_2 = BooleanToggle(False)  # disabled
view_crop_region_3 = ViewCropRegion(View=list_item_14)  # -> View, CropView, CropRegionVisible, CropRegion; disabled
boolean_toggle_3 = BooleanToggle(True)  # disabled
view_crop_region_4 = ViewCropRegion(View=view_17, CropView=boolean_toggle_3, CropRegionVisible=boolean_toggle_2, CropRegion=view_crop_region_3.CropRegion)  # -> View, CropView, CropRegionVisible, CropRegion; disabled
panel_38 = Panel(view_crop_region_3.CropRegion)  # disabled

# ---- group: TITLEBLOCKS
internalised_titleblocks_4 = GraphicalElement(data_dam_7)  # disabled

# ---- group: VIEWPORTS
internalised_viewports_4 = GraphicalElement(data_dam_6)  # disabled

# ----
list_item_15 = ListItem(List=flatten(internalised_viewports_4), Index=0, Wrap=True)

# ---- group: _REVIT-FILTERED
view_18 = View(data_dam_3)

# ----
inspect_element_3 = InspectElement(Element=list_item_15)  # -> GraphicsScaleValue1, GraphicsViewScale
list_item_16 = ListItem(List=flatten(internalised_viewports_4), Index=0, Wrap=True)  # -> Item, Item1, Item2, Item3, Item4
internalised_viewports_5 = GraphicalElement(list_item_15)
list_item_17 = ListItem(List=flatten(internalised_viewports_4), Index=0, Wrap=True)  # -> Item, Item1, Item2
query_view_elements_2 = QueryViewElements(View=view_18, Filter=type_filter_3)  # disabled
surface = Surface(internalised_viewports_5)
merge = Merge(Data1=list_item_17.Item, Data2=list_item_17.Item1, Data3=list_item_17.Item2)
merge_2 = Merge(
    Data1=list_item_16.Item,
    Data2=list_item_16.Item1,
    Data3=list_item_16.Item2,
    Data4=list_item_16.Item3,
    Data5=list_item_16.Item4)
internalised_sheets_4 = Sheet(data_dam_8)
data_14 = Data(inspect_element_3.GraphicsScaleValue1)
data_15 = Data(inspect_element_3.GraphicsViewScale)
add_symbol_2 = AddSymbol(View=internalised_sheets_4, Point=plane_5, Type=type_5, TrackingMode=2)  # disabled
add_detail_group = AddDetailGroup(View=view_18, Point=plane_4, Type=type_4, TrackingMode=2)  # disabled
panel_39 = Panel(query_view_elements_2)  # disabled

graphical_element_9 = GraphicalElement(add_symbol_2)  # disabled
element_location_4 = ElementLocation(Element=graphical_element_9)  # -> Element, Location, Hand, Facing, WorkPlane
xy_plane = XYPlane(Origin=element_location_4.Location)
element_location_5 = ElementLocation(Element=graphical_element_9, Location=xy_plane)  # -> Element, Location, Hand, Facing, WorkPlane
rotate = Rotate(Geometry=xy_plane, Angle=degrees(Slider(4.25, range=0..10)), Plane=xy_plane)  # -> Geometry, Transform
plane_6 = Plane(xy_plane)
number_slider_6 = Slider(270, range=0..360)
rotate_2 = Rotate(Geometry=rotate.Geometry, Angle=degrees(integer_6), Plane=rotate.Geometry)  # -> Geometry, Transform
merge_3 = Merge(Data1=rotate.Transform, Data2=rotate_2.Transform)
compound = Compound(Transforms=merge_3)
transform = Transform(Geometry=plane_6, Transform=compound)
element_location_6 = ElementLocation(Element=element_location_5.Element, Location=transform)  # -> Element, Location, Hand, Facing, WorkPlane

panel_40 = Panel(add_detail_group)
panel_41 = Panel(view_18)

# ---- group: stream gate
input_method_2 = ValueList({"Query at start": 1, "Stream from the previous step": 0, "DISABLE": 2}, selected="Query at start")
rodzaj_karty_6 = Text(item_selector)
view_names_2 = Text(czym_sortowac_11)
query_views_6 = QueryViews(IsDependent=False, IsTemplate=False)

# ---- group: ADD VIEWS / ASSIGN STARTING VIEWS
# INFO: id view element ktore jest w modelu Rhino może się zdezaktualizować, dlatego alternatywną wersją query jest query by View Name
text_20 = Text(user_text_5.Values)
value_list_5 = ValueList({"Query by View Name": 0, "Query by View El ID": 1}, selected="Query by View Name")
text_split_6 = TextSplit(Text=text_20, Separators=":")
text_trim_2 = TextTrim(Text=text_split_6, Start=True, End=True)
stream_gate_2 = StreamGate(Stream=text_trim_2, Gate=value_list_5)  # -> Target0, Target1
concatenate_check_lists = ConcatenateCheckLists(czlon_1=rodzaj_karty_2, czlon_2=text_12)

# ---- group: ADD VIEWS / ASSIGN STARTING VIEWS / by ID
list_item_18 = ListItem(List=text_trim_2, Index=0, Wrap=True)  # -> Item, Item1, Item2
text_trim_3 = TextTrim(Text=list_item_18.Item2, Start=True, End=True)
text_split_7 = TextSplit(Text=text_trim_3, Separators="id")
member_index_2 = MemberIndex(Set=text_split_7)  # -> Index, Count
cull_index = CullIndex(List=text_split_7, Indices=member_index_2.Index, Wrap=True)  # -> simplify(List)
integer_8 = Integer(cull_index)
query_element_3 = QueryElement(Id=integer_8)  # -> simplify(Element)

# ---- group: ADD VIEWS / ASSIGN STARTING VIEWS / by name
list_item_19 = ListItem(List=stream_gate_2.Target0, Index=0, Wrap=True)  # -> Item, Item1, Item2
query_views_7 = QueryViews(IsDependent=False, IsTemplate=False)
text_21 = Text(list_item_19.Item1)
query_revit_views_fast_4 = QueryRevitViewsFast(views=query_views_7, view_name=list_item_19.Item1)

# ----
panel_42 = Panel(query_revit_views_fast_4)
nazwa_widoku = Text(concatenate_check_lists)

# ---- group: ADD VIEWS / ASSIGN STARTING VIEWS (continued)
stream_filter_5 = StreamFilter(Gate=value_list_5, Stream0=query_revit_views_fast_4, Stream1=query_element_3)
view_19 = View(simplify(stream_filter_5))

# ----
panel_43 = Panel(nazwa_widoku)

# ---- group: NIE WIEM CZY TO POTRZEBNE (continued)
query_views_8 = QueryViews(ViewName=nazwa_widoku, IsDependent=False, IsTemplate=False)  # disabled
query_revit_views_fast_5 = QueryRevitViewsFast(view_name=nazwa_widoku)
nazwa_widoku_2 = Text(nazwa_widoku)
widok_startowy = View(view_19)

replace_items = ReplaceItems(List=query_revit_views_fast_5, Item=Toggle(True), Indices="0", Wrap=False)

nulls_in_empty_branches = NullsInEmptyBranches(DataWithEmptyBranches=replace_items)
replace_nulls = ReplaceNulls(Items=nulls_in_empty_branches, Replacements=Toggle(False))  # -> Items, Count

pick_n_choose = PickNChoose(Pattern=replace_nulls.Items, Stream0=nazwa_widoku_2, Stream1=null_placeholder)
pick_n_choose_2 = PickNChoose(Pattern=replace_nulls.Items, Stream0=widok_startowy, Stream1=null_placeholder_2)
widok_startowy_2 = View(pick_n_choose_2)
nazwa_widoku_3 = Text(pick_n_choose)

duplicate_element_2 = DuplicateElement(Elements=widok_startowy_2, TrackingMode=2)  # disabled
nazwa_widoku_4 = Text(nazwa_widoku_3)  # disabled
clean_tree_3 = CleanTree(RemoveNulls=True, RemoveInvalid=True, RemoveEmpty=True, Tree=duplicate_element_2, SynchronousTree1=nazwa_widoku_4)  # -> Tree, SynchronousTree1; disabled
release_element = ReleaseElement(Elements=clean_tree_3.Tree, Released=boolean_toggle, FailureProcessingMode=1)  # -> Elements, Released; disabled
element_name_6 = ElementName(Element=release_element.Elements, Name=clean_tree_3.SynchronousTree1)  # -> Element, Name; disabled

# ---- group: query sheets
query_sheets_2 = QuerySheets(Placeholder=False, AppearsInSheetList=True, Assembly=null)
element_name_7 = ElementName(Element=query_sheets_2)  # -> Element, Name

# ----
panel_44 = Panel(element_name_7.Name)

# ---- group: ADD VIEWS / CHECK IF THE VIEW ALREADY EXISTS
query_views_9 = QueryViews(IsDependent=False, IsTemplate=False)
nazwa_widoku_5 = Text(nazwa_widoku)
widok_startowy_3 = View(view_19)
query_revit_views_fast_6 = QueryRevitViewsFast(views=query_views_9, view_name=nazwa_widoku)
null_placeholder_3 = NullPlaceholder()
null_placeholder_4 = NullPlaceholder()

replace_items_2 = ReplaceItems(List=query_revit_views_fast_6, Item=Toggle(True), Indices="0", Wrap=False)

nulls_in_empty_branches_2 = NullsInEmptyBranches(DataWithEmptyBranches=replace_items_2)
replace_nulls_2 = ReplaceNulls(Items=nulls_in_empty_branches_2, Replacements=Toggle(False))  # -> Items, Count

pick_n_choose_3 = PickNChoose(Pattern=replace_nulls_2.Items, Stream0=widok_startowy_3, Stream1=null_placeholder_4)
pick_n_choose_4 = PickNChoose(Pattern=replace_nulls_2.Items, Stream0=nazwa_widoku_5, Stream1=null_placeholder_3)
widok_startowy_4 = View(pick_n_choose_3)
nazwa_widoku_6 = Text(pick_n_choose_4)

# ---- group: ADD VIEWS / CREATE VIEWS
duplicate_element_3 = DuplicateElement(Elements=widok_startowy_4, TrackingMode=2)
nazwa_widoku_7 = Text(nazwa_widoku_6)
clean_tree_4 = CleanTree(RemoveNulls=True, RemoveInvalid=True, RemoveEmpty=True, Tree=duplicate_element_3, SynchronousTree1=nazwa_widoku_7)  # -> Tree, SynchronousTree1
release_element_2 = ReleaseElement(Elements=clean_tree_4.Tree, Released=Toggle(True), FailureProcessingMode=1)  # -> Elements, Released
element_name_8 = ElementName(Element=release_element_2.Elements, Name=clean_tree_4.SynchronousTree1)  # -> Element, Name
group_toggle_4 = GroupToggle(ToggleActive=True, ToggleVisible=False)  # disabled

# ----
panel_45 = Panel(duplicate_element_3)
panel_46 = Panel(nazwa_widoku_7)
panel_47 = Panel(element_name_8.Element)

# ---- group: ADD VIEWS / grupa widokow
dodaj_do_folderu = BooleanToggle(True)
view_20 = View(element_name_8.Element)
folder = Panel("CZAJA-TEST")
inspect_element_4 = InspectElement(Element=view_20)
empty = Panel("")
stream_filter_6 = StreamFilter(Gate=dodaj_do_folderu, Stream0=empty, Stream1=folder)
element_parameter = ElementParameter(Element=view_20, Parameter=inspect_element_4, Value=stream_filter_6)  # -> Element, Value
view_generated = View(element_parameter.Element)

# ---- group: stream from the previous step
views_created = View(view_generated)
views_created_2 = View(views_created)

# ---- group: ASSOC EXPERIMENT
data_dam_9 = DataDam(DataDaA=view_generated, BufferDelay=10000000, BufferMode=0)
view_21 = View(data_dam_9)
element_passport = ElementPassport(Element=view_21)  # -> DocumentGUID, Document, UniqueID, Id
element_name_9 = ElementName(Element=view_21)  # -> Element, Name
construct_assoc = ConstructAssoc(
    ViewName=element_name_9.Name,
    ViewElement=view_21,
    ViewStartElZrodlo=view_19,
    ViewStartName=text_21,
    LastSaveLocalization="neutral,N")
construct_assoc_2 = ConstructAssoc(ViewName=element_name_9.Name, UniqueID=element_passport.UniqueID, LastSaveLocalization="neutral,N")
deconstruct_assoc = DeconstructAssoc(Assoc=construct_assoc, AllowAutoFill=False, LastSaveLocalization="neutral,N")  # -> ViewName, ViewElement, ViewStartElZrodlo, ViewStartName
deconstruct_assoc_2 = DeconstructAssoc(Assoc=construct_assoc_2, AllowAutoFill=False, LastSaveLocalization="neutral,N")  # -> ViewName, UniqueID

# ---- group: OBRACANIE WIDOKU / stream gate
input_method_3 = ValueList({"Query at start": 1, "Stream from the previous step": 0, "DISABLE": 2}, selected="Query at start")
view_names_3 = Text(czym_sortowac_11)
view_generated_2 = View(view_generated)
rodzaj_karty_7 = Text(item_selector)
query_views_10 = QueryViews(IsDependent=False, IsTemplate=False)
cluster_2 = Cluster(
    option_number=input_method_3,
    previous_step_views=view_generated_2,
    rodzaj_karty=rodzaj_karty_7,
    view_names=view_names_3,
    views=query_views_10)  # -> simplify(view_3)
view_22 = View(cluster_2)

# ----
run = BooleanToggle(True)
get_view_rotation_angles = Python3Script(RUN=run, view=view_22)  # -> out, outAngles, outCenters, outViews; inputs view: list
# ---------- get_view_rotation_angles: Python ----------
import clr
import math

# Add references to Revit API and RhinoInside.Revit
clr.AddReference("RevitAPI")
clr.AddReference('RhinoInside.Revit')

from Autodesk.Revit.DB import *
from RhinoInside.Revit import Revit

# Get the active Revit document
uiapp = Revit.ActiveUIDocument
doc = uiapp.Document

# Output variables
outViews = []
outAngles = []
outCenters = []

def get_cropbox_element(the_view):
    """
    Retrieves the CropBox element associated with the given view.
    This is done by temporarily hiding the CropBox and collecting elements to identify it.
    """
    cropBoxElement = None

    try:
        # Transaction to hide the CropBox
        t = Transaction(doc, "Hide CropBox")
        t.Start()
        the_view.CropBoxVisible = False
        t.Commit()
        t.Dispose()

        # Collect elements currently shown in the view
        shown_elements = FilteredElementCollector(doc, the_view.Id).ToElementIds()

        # Transaction to unhide the CropBox
        t = Transaction(doc, "Unhide CropBox")
        t.Start()
        the_view.CropBoxVisible = True
        t.Commit()
        t.Dispose()

        # Collect elements again, excluding previously collected ones
        collector = FilteredElementCollector(doc, the_view.Id).Excluding(shown_elements)
        cropBoxElement = collector.FirstElement()

        if cropBoxElement:
            print(f"Retrieved CropBox element for view '{the_view.Name}'.")
        else:
            print(f"CropBox element could not be found for view '{the_view.Name}'.")

    except Exception as e:
        print(f"An error occurred in get_cropbox_element for view '{the_view.Name}': {e}")

    return cropBoxElement

def get_current_rotation(view):
    """
    Calculates and returns the current rotation angle of the view in degrees.
    The rotation is determined based on the CropBox's transform.
    """
    try:
        crop_box = view.CropBox
        transform = crop_box.Transform
        basisX = transform.BasisX.Normalize()
        angle_current_radians = math.atan2(basisX.Y, basisX.X)
        angle_current_degrees = math.degrees(angle_current_radians)
        return angle_current_degrees
    except Exception as e:
        print(f"Error getting current rotation for view '{view.Name}': {e}")
        return None

if RUN_:
    # Input validation for 'view'
    if view is None:
        print("The 'view' input is None. Please provide a valid Revit View.")
    else:
        # Ensure 'view' is a list
        if isinstance(view, list):
            views = view
        elif isinstance(view, View):
            views = [view]
        else:
            print("Invalid input: 'view' must be a Revit View or a list of Revit Views.")
            views = []

        # Iterate through each view and get rotation
        for v in views:
            if v is not None:
                angle = get_current_rotation(v)
                if angle is not None:
                    outViews.append(v)
                    outAngles.append(angle)
                    outCenters.append(v.CropBox.Transform.Origin)
            else:
                print("One of the provided views is None and will be skipped.")
else:
    print("Set 'RUN_' to True to execute the script.")
# ---------- end get_view_rotation_angles ----------
rotation_of_views = Panel(get_view_rotation_angles.outAngles)

# ---- group: stream gate
input_method_4 = ValueList({"Query at start": 1, "Stream from the previous step": 0, "DISABLE": 2}, selected="Query at start")

# ----
model_objects_odpowiadajace_wskazanym_wi_5 = ModelObject(model_objects_odpowiadajace_wskazanym_wi_2)  # "MODEL OBJECTS ODPOWIADAJACE WSKAZANYM WIDOKOM"

model_object_27 = ModelObject(model_objects_odpowiadajace_wskazanym_wi_5)
user_text_11 = UserText(Content=model_object_27, Keys="PIG_Nr Piętra", UserTextMode=1)  # -> Content, Keys, Values

panel_48 = Panel(user_text_11.Values)

model_object_28 = ModelObject(model_objects_odpowiadajace_wskazanym_wi_3)
user_text_12 = UserText(Content=model_object_28, Keys="RHI_Lista pomieszczen wewnetrznych Unique ID", UserTextMode=1)  # -> Content, Keys, Values
text_split_8 = TextSplit(Text=user_text_12.Values, Separators=";")
list_item_20 = ListItem(List=text_split_8, Index=0, Wrap=True)
list_length = ListLength(List=text_split_8)
query_element_4 = QueryElement(Id=list_item_20)
inspect_element_5 = InspectElement(Element=query_element_4)  # -> DataPIG_PowLokalu, DataPIG_PowBrutto
division = Division(A=inspect_element_5.DataPIG_PowBrutto, B="10000")
replace_text = ReplaceText(Text=division, Find=".", Replace=",", RecursiveReplace=False)
panel_49 = Panel(" m²")  # disabled
concatenate_10 = Concatenate(FragmentA=replace_text, FragmentB=panel_49)

query_element_5 = QueryElement(Id=text_split_8)
panel_50 = Panel(query_element_5)
spatial_element_identity = SpatialElementIdentity(SpatialElement=query_element_5)  # -> Name, Area
panel_51 = Panel(spatial_element_identity.Name)
multiple_match_z_wildcards_2 = MultipleMatchZWildcards(data=graft(spatial_element_identity.Name), keys="Łazienka")  # -> out, Match; inputs data: list of String, keys: list of String; same code as multiple_match_z_wildcards
data_16 = Data(graft(query_element_5))
division_2 = Number(expr("X/10000", spatial_element_identity.Area))
dispatch_33 = Dispatch(List=data_16, DispatchPattern=multiple_match_z_wildcards_2.Match)  # -> ListA, ListB
round_to_decimal_place = RoundToDecimalPlace(NumberX=division_2, DecimalPlace=2, RoundType=0)  # -> Rounded, Difference
shift_paths_2 = ShiftPaths(Data=dispatch_33.ListA, Offset=-1)
shift_paths_3 = ShiftPaths(Data=multiple_match_z_wildcards_2.Match, Offset=-1)
number = Number(round_to_decimal_place.Rounded)
nulls_in_empty_branches_3 = NullsInEmptyBranches(DataWithEmptyBranches=shift_paths_2)
panel_52 = Panel(number)
member_index_3 = MemberIndex(Set=shift_paths_3, Member=boolean)  # -> Index, Count
spatial_element_boundary = SpatialElementBoundary(SpatialElement=nulls_in_empty_branches_3, BoundaryLocation=0)
pole_of_inaccessibility = CSharpScript(Poly=spatial_element_boundary, precision="10")  # -> out, A; inputs Poly: list of Polyline, precision: Double
# ---------- pole_of_inaccessibility: C# usings ----------
using System.Linq;
# ---------- pole_of_inaccessibility: C# ----------
    //C# implementation of polylabel
    //Taken from:
    //https://github.com/mapbox/polylabel/issues/26

    float[][][] polygon = new float[Poly.Count][][];

    for(int i = 0;i < Poly.Count;i++)
    {
      var polygonA = new float[Poly[i].Count][];
      var pointCount = 0;
      for(int j = 0;j < Poly[i].Count;j++)
      {
        polygonA[pointCount] = new float[2];
        polygonA[pointCount][0] = (float) Poly[i][j].X;
        polygonA[pointCount][1] = (float) Poly[i][j].Y;
        pointCount++;
      }
      polygon[i] = polygonA;
    }


    float[] centre = GetPolyLabel(polygon, (float) precision);
    A = new Point3d(centre[0], centre[1], 0);
# ---------- pole_of_inaccessibility: C# additional code ----------
  private const float EPSILON = 1e-8F;

  public static float[] GetPolyLabel(float[][][] polygon, float precision = 1.0F)
  {
    //Find the bounding box of the outer ring
    float minX = 0, minY = 0, maxX = 0, maxY = 0;
    for (int i = 0; i < polygon[0].Length; i++) {
      float[] p = polygon[0][i];
      if (i == 0 || p[0] < minX)
        minX = p[0];
      if (i == 0 || p[1] < minY)
        minY = p[1];
      if (i == 0 || p[0] > maxX)
        maxX = p[0];
      if (i == 0 || p[1] > maxY)
        maxY = p[1];
    }

    float width = maxX - minX;
    float height = maxY - minY;
    float cellSize = Math.Min(width, height);
    float h = cellSize / 2;

    //A priority queue of cells in order of their "potential" (max distance to polygon)
    PriorityQueue<float,Cell> cellQueue = new PriorityQueue<float, Cell>();

    if (FloatEquals(cellSize, 0))
      return new[] { minX, minY };

    //Cover polygon with initial cells
    for (float x = minX; x < maxX; x += cellSize) {
      for (float y = minY; y < maxY; y += cellSize) {
        Cell cell = new Cell(x + h, y + h, h, polygon);
        cellQueue.Enqueue(cell.Max, cell);
      }
    }

    //Take centroid as the first best guess
    Cell bestCell = GetCentroidCell(polygon);

    //Special case for rectangular polygons
    Cell bboxCell = new Cell(minX + width / 2, minY + height / 2, 0, polygon);
    if (bboxCell.D > bestCell.D)
      bestCell = bboxCell;

    int numProbes = cellQueue.Count;

    while (cellQueue.Count > 0) {
      //Pick the most promising cell from the queue
      Cell cell = cellQueue.Dequeue();

      //Update the best cell if we found a better one
      if (cell.D > bestCell.D) {
        bestCell = cell;
      }

      //Do not drill down further if there's no chance of a better solution
      if (cell.Max - bestCell.D <= precision)
        continue;

      //Split the cell into four cells
      h = cell.H / 2;
      Cell cell1 = new Cell(cell.X - h, cell.Y - h, h, polygon);
      cellQueue.Enqueue(cell1.Max, cell1);
      Cell cell2 = new Cell(cell.X + h, cell.Y - h, h, polygon);
      cellQueue.Enqueue(cell2.Max, cell2);
      Cell cell3 = new Cell(cell.X - h, cell.Y + h, h, polygon);
      cellQueue.Enqueue(cell3.Max, cell3);
      Cell cell4 = new Cell(cell.X + h, cell.Y + h, h, polygon);
      cellQueue.Enqueue(cell4.Max, cell4);
      numProbes += 4;
    }

    return (new[] { bestCell.X, bestCell.Y });
  }

  //Signed distance from point to polygon outline (negative if point is outside)
  private static float PointToPolygonDist(float x, float y, float[][][] polygon)
  {
    bool inside = false;
    float minDistSq = float.PositiveInfinity;

    for (int k = 0; k < polygon.Length; k++) {
      float[][] ring = polygon[k];

      for (int i = 0, len = ring.Length, j = len - 1; i < len; j = i++) {
        float[] a = ring[i];
        float[] b = ring[j];

        if ((a[1] > y != b[1] > y) && (x < (b[0] - a[0]) * (y - a[1]) / (b[1] - a[1]) + a[0]))
          inside = !inside;

        minDistSq = Math.Min(minDistSq, GetSegDistSq(x, y, a, b));
      }
    }

    return ((inside ? 1 : -1) * (float) Math.Sqrt(minDistSq));
  }

  //Get squared distance from a point to a segment
  private static float GetSegDistSq(float px, float py, float[] a, float[] b)
  {
    float x = a[0];
    float y = a[1];
    float dx = b[0] - x;
    float dy = b[1] - y;

    if (!FloatEquals(dx, 0) || !FloatEquals(dy, 0)) {
      float t = ((px - x) * dx + (py - y) * dy) / (dx * dx + dy * dy);
      if (t > 1) {
        x = b[0];
        y = b[1];
      } else if (t > 0) {
        x += dx * t;
        y += dy * t;
      }
    }
    dx = px - x;
    dy = py - y;
    return (dx * dx + dy * dy);
  }

  //Get polygon centroid
  private static Cell GetCentroidCell(float[][][] polygon)
  {
    float area = 0;
    float x = 0;
    float y = 0;
    float[][] ring = polygon[0];

    for (int i = 0, len = ring.Length, j = len - 1; i < len; j = i++) {
      float[] a = ring[i];
      float[] b = ring[j];
      float f = a[0] * b[1] - b[0] * a[1];
      x += (a[0] + b[0]) * f;
      y += (a[1] + b[1]) * f;
      area += f * 3;
    }
    if (FloatEquals(area, 0))
      return (new Cell(ring[0][0], ring[0][1], 0, polygon));
    return (new Cell(x / area, y / area, 0, polygon));
  }

  private static bool FloatEquals(float a, float b)
  {
    return (Math.Abs(a - b) < EPSILON);
  }

  private class Cell
  {
    public float X { get; private set; }
    public float Y { get; private set; }
    public float H { get; private set; }
    public float D { get; private set; }
    public float Max { get; private set; }

    public Cell(float x, float y, float h, float[][][] polygon)
    {
      X = x;
      Y = y;
      H = h;
      D = PointToPolygonDist(X, Y, polygon);
      Max = D + H * (float) Math.Sqrt(2);
    }
  }

  public class PriorityQueue<TPriority, TItem>
  {
    readonly SortedDictionary<TPriority, Queue<TItem>> _subqueues;

    public PriorityQueue(IComparer<TPriority> priorityComparer)
    {
      _subqueues = new SortedDictionary<TPriority, Queue<TItem>>(priorityComparer);
    }

    public PriorityQueue() : this(Comparer<TPriority>.Default) { }

    public void Enqueue(TPriority priority, TItem item)
    {
      if (!_subqueues.ContainsKey(priority))
      {
        AddQueueOfPriority(priority);
      }

      _subqueues[priority].Enqueue(item);
    }

    private void AddQueueOfPriority(TPriority priority)
    {
      _subqueues.Add(priority, new Queue<TItem>());
    }

    public TItem Peek()
    {
      if (HasItems)
        return _subqueues.First().Value.Peek();
      else
        throw new InvalidOperationException("The queue is empty");
    }

    public bool HasItems
    {
      get { return _subqueues.Any(); }
    }

    public TItem Dequeue()
    {
      if (_subqueues.Any())
        return DequeueFromHighPriorityQueue();
      else
        throw new InvalidOperationException("The queue is empty");
    }

    private TItem DequeueFromHighPriorityQueue()
    {
      KeyValuePair<TPriority, Queue<TItem>> first = _subqueues.First();
      TItem nextItem = first.Value.Dequeue();
      if (!first.Value.Any())
      {
        _subqueues.Remove(first.Key);
      }
      return nextItem;
    }

    public int Count
    {
      get { return _subqueues.Sum(q => q.Value.Count); }
    }
  }
# ---------- end pole_of_inaccessibility ----------
bounding_rectangle = BoundingRectangle(Geometry=spatial_element_boundary, Plane=PlaneXY(0, 0, 0), Axis=0, Slide=0, Union=True)  # -> Bounding, DimensionX, DimensionY
panel_53 = Panel(shift_paths_3)
panel_54 = Panel(member_index_3.Index)
clipper2_offset = Clipper2Offset(
    Polylines=bounding_rectangle.Bounding,
    Distance=Slider(50, range=0..100),
    JoinType=0,
    EndType=0,
    MiterLimit=2,
    Precision=4)  # -> Holes, Outer, ClipperPaths
plane_7 = Plane(pole_of_inaccessibility.A)
plane_8 = Plane(bounding_rectangle.Bounding)
curve_6 = Curve(clipper2_offset.Outer)
rectangle = Rectangle(Plane=plane_7, XSize=Slider(500, range=0..1000), YSize=Slider(500, range=0..1000), Radius=0)  # -> Rectangle, Length
area = Area(Geometry=curve_6)  # -> Area, Centroid
plane_9 = Plane(area.Centroid)
boundary_surfaces = BoundarySurfaces(Edges=curve_6)
inspect_element_6 = InspectElement(Element=query_element_4)  # -> OtherNMG_Długość, OtherNMG_Szerokość, OtherNMG_Wysokość, ConstraintsLevel, ConstraintsBaseOffset, ConstraintsUpperLimit, ConstraintsLimitOffset, DataFireRating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
orient = Orient(Geometry=boundary_surfaces, Source=plane_9, Target=plane_8)  # -> Geometry, Transform
move = Move(Geometry=orient.Geometry, Motion=unit_z)  # -> Geometry, Transform
panel_55 = Panel(pole_of_inaccessibility.A)
point_2 = Point(simplify(pole_of_inaccessibility.A))
surface_2 = Surface(simplify(move.Geometry))
tree_statistics_4 = TreeStatistics(Tree=surface_2)  # -> Paths, Length, Count
partition_list_4 = PartitionList(List=tree_statistics_4.Paths, Size=Slider(490, range=0..1000))
explode_tree = ExplodeTree(Data=partition_list_4)  # -> Branch0, Branch1
split_tree_4 = SplitTree(Data=point_2, Masks=flatten(explode_tree.Branch0))  # -> Positive, Negative
split_tree_5 = SplitTree(Data=surface_2, Masks=flatten(explode_tree.Branch0))  # -> Positive, Negative
geometry_2 = Geometry(split_tree_5.Positive)
point_3 = Point(split_tree_4.Positive)
collision_one_many = CollisionOneMany(Collider=element_geometry, Obstacles=geometry_2)  # -> Collision, Index
panel_56 = Panel(geometry_2)
dispatch_34 = Dispatch(List=element_geometry, DispatchPattern=collision_one_many.Collision)  # -> ListA, ListB
geometry_3 = Geometry(dispatch_34.ListA)
deconstruct_brep = DeconstructBrep(Brep=geometry_3)  # -> Faces, Edges, Vertices
clean_tree_5 = CleanTree(RemoveNulls=True, RemoveInvalid=True, RemoveEmpty=False, Tree=split_tree_5.Positive)  # -> flatten(Tree)
deconstruct_brep_2 = DeconstructBrep(Brep=deconstruct_brep.Faces)  # -> Faces, Edges, Vertices
deconstruct = Deconstruct(Point=deconstruct_brep_2.Vertices)  # -> XComponent, YComponent, ZComponent
number_2 = Number(deconstruct.ZComponent)
create_set_2 = CreateSet(List=number_2)  # -> Set, Map
geometry_4 = Geometry(geometry_2)
member_index_4 = MemberIndex(Set=number_2, Member=create_set_2.Set)  # -> Index, Count
plane_10 = Plane(simplify(geometry_4))
list_item_21 = ListItem(List=number_2, Index=member_index_4.Index, Wrap=True)
list_item_22 = ListItem(List=list_item_21, Index=0, Wrap=True)
shift_paths_4 = ShiftPaths(Data=list_item_22, Offset=-1)
list_length_2 = ListLength(List=shift_paths_4)
equality_3 = Equality(FirstNumber=list_length_2, SecondNumber="1")  # -> Equality, Inequality
geometry_5 = Geometry(graft(deconstruct_brep_2.Faces))
panel_58 = Panel(list_item_22)
dispatch_35 = Dispatch(List=geometry_5, DispatchPattern=equality_3.Equality)  # -> ListA, ListB
geometry_6 = Geometry(dispatch_35.ListB)
geometry_7 = Geometry(dispatch_35.ListA)
project = Project(Geometry=geometry_7, Plane=plane_10)  # -> Geometry, Transform
panel_59 = Panel(geometry_5)
surface_3 = Surface(project.Geometry)
curve_7 = Curve(project.Geometry)
shift_paths_5 = ShiftPaths(Data=surface_3, Offset="-3")
explode = Explode(Curve=curve_7, Recursive=True)  # -> Segments, Vertices
shatter = Shatter(Curve=curve_7)
geometry_8 = Geometry(geometry_4)
shift_paths_6 = ShiftPaths(Data=explode.Segments, Offset=-1)
brep_edges = BrepEdges(Brep=geometry_8)  # -> Naked, Interior, NonManifold
clean_tree_6 = CleanTree(RemoveNulls=True, RemoveInvalid=True, RemoveEmpty=False, Tree=shift_paths_5)
deconstruct_brep_3 = DeconstructBrep(Brep=geometry_8)  # -> Faces, Edges, Vertices
panel_60 = Panel(curve_7)
clipper2_union_2 = Clipper2Union(Polylines=clean_tree_6, UnionRule=2, Precision=4)
geometric_regions = GeometricRegions(Curves=surface_3)
join_curves_2 = JoinCurves(Curves=deconstruct_brep_3.Edges, Preserve=False)
clipper2_boolean = Clipper2Boolean(PolylinesA=join_curves_2, PolylinesB=clipper2_union_2, Operation=1, Precision=4)
curve_8 = Curve(surface_3)
point_4 = Point(point_3)
point_in_curve = PointInCurve(Point=point_4, Curve=clipper2_boolean)  # -> Relationship, Point
integer_9 = Integer(point_in_curve.Relationship)
member_index_5 = MemberIndex(Set=integer_9, Member=integer_2)  # -> Index, Count
list_item_23 = ListItem(List=clipper2_boolean, Index=member_index_5.Index, Wrap=True)
geometry_9 = Geometry(list_item_23)
geometry_10 = Geometry(list_item_23)
project_2 = Project(Geometry=geometry_9, Plane=plane_10)  # -> Geometry, Transform
boundary_surfaces_2 = BoundarySurfaces(Edges=project_2.Geometry)
panel_61 = Panel(boundary_surfaces_2)
geometry_11 = Geometry(geometry_3)
geometry_12 = Geometry(boundary_surfaces_2)

area_2 = Area(Geometry=geometry_12)  # -> Area, Centroid
division_3 = Division(A=area_2.Area, B="10000")
round_to_decimal_place_2 = RoundToDecimalPlace(NumberX=division_3, DecimalPlace="2", RoundType=0)  # -> Rounded, Difference

deconstruct_brep_4 = DeconstructBrep(Brep=geometry_12)  # -> Faces, Edges, Vertices
custom_preview_2 = CustomPreview(Geometry=geometry_12, Material=ColourSwatch(SwatchColor=RGBA(255, 0, 0, 220)))
custom_preview_3 = CustomPreview(Geometry=geometry_11, Material=ColourSwatch(SwatchColor=RGB(255, 153, 0)))
number_3 = Number(number)
replace_items_3 = ReplaceItems(List=number_3, Item=round_to_decimal_place_2.Rounded, Indices=member_index_3.Index, Wrap=False)
format_6 = Format(Format="{0:0.00}", Culture=127, Data0=replace_items_3)
custom_curve_preview = CustomCurvePreview(Curve=deconstruct_brep_4.Edges, Linetype={Path="(Continuous)", Segments=[]}, Colour=colour_swatch)
custom_preview_4 = CustomPreview(Geometry=deconstruct_brep_4.Edges, Material=colour_swatch)
panel_62 = Panel(round_to_decimal_place_2.Rounded)
panel_63 = Panel(format_6)
panel_64 = Panel(replace_items_3)

model_object_29 = ModelObject(model_objects_odpowiadajace_wskazanym_wi_5)
user_text_13 = UserText(Content=model_object_29, Keys="PIG_Nr Budynku", UserTextMode=1)  # -> Content, Keys, Values

panel_65 = Panel(model_object_29)

model_object_30 = ModelObject(model_objects_odpowiadajace_wskazanym_wi_5)
user_text_14 = UserText(Content=model_object_30, Keys="PIG_Nr Klatki", UserTextMode=1)  # -> Content, Keys, Values

model_object_31 = ModelObject(model_objects_odpowiadajace_wskazanym_wi_5)
user_text_15 = UserText(Content=model_object_31, Keys="RHI_Lista pomieszczen wewnetrznych Unique ID", UserTextMode=1)  # -> Content, Keys, Values
text_split_9 = TextSplit(Text=user_text_15.Values, Separators=";")
list_item_24 = ListItem(List=text_split_9, Index=0, Wrap=True)
list_length_3 = ListLength(List=text_split_9)
query_element_6 = QueryElement(Id=list_item_24)
inspect_element_7 = InspectElement(Element=query_element_6)  # -> DataPIG_PowLokalu, DataPIG_PowBrutto
panel_66 = Panel("10000")
division_4 = Division(A=inspect_element_7.DataPIG_PowBrutto, B="10000")
replace_text_2 = ReplaceText(Text=division_4, Find=".", Replace=",", RecursiveReplace=False)
panel_67 = Panel(" m²")  # disabled
concatenate_11 = Concatenate(FragmentA=replace_text_2, FragmentB=panel_67)

number_4 = Number(inspect_element_7.DataPIG_PowLokalu)

list_item_25 = ListItem(List=text_split_9, Index=0, Wrap=True)  # -> Item, Item1, Item2
query_element_7 = QueryElement(Id=list_item_25.Item)
inspect_element_8 = InspectElement(Element=query_element_7)

model_object_32 = ModelObject(model_objects_odpowiadajace_wskazanym_wi_5)
user_text_16 = UserText(Content=model_object_32, Keys="RHI_Lista pokojow", UserTextMode=1)  # -> Content, Keys, Values
text_split_10 = TextSplit(Text=user_text_16.Values, Separators=";")
list_length_4 = ListLength(List=text_split_10)

panel_68 = Panel(model_object_32)

model_object_33 = ModelObject(model_objects_odpowiadajace_wskazanym_wi_5)
list_item_26 = ListItem(List=text_split_9, Index=0, Wrap=True)  # -> Item, Item1, Item2
user_text_17 = UserText(Content=model_object_33, Keys="RHI_Lista pokojow", UserTextMode=1)  # -> Content, Keys, Values
query_element_8 = QueryElement(Id=list_item_26.Item)
inspect_element_9 = InspectElement(Element=query_element_8)

# ----
# SHEET PARAMETERS
panel_69 = Panel("PIG_Nr Komercyjny")
user_text_18 = UserText(Content=model_object_33, Keys=panel_69, UserTextMode=1)  # -> Content, Keys, Values

panel_70 = Panel(inspect_element_9)

# ---- group: ADD TITLEBLOCK
# B2
type_7 = Type(list_item_4, SelectedBuiltInCategory="autodesk.revit.category.family:titleBlocks")
graphical_element_10 = GraphicalElement([<curveelement referenced from the Revit model> x2])
curve_9 = Curve(graphical_element_2)
plane_11 = Plane(Tree({0;0;0}: [PlaneXY(41.33740683, 10.5, 0)], {1;0;0}: [PlaneXY(41.33740683, 10.5, 0)], {2;0;0}: [PlaneXY(41.33740683, 10.5, 0)], {3;0;0}: [PlaneXY(41.33740683, 10.5, 0)], {4;0;0}: [PlaneXY(41.33740683, 10.5, 0)], {5;0;0}: [PlaneXY(41.33740683, 10.5, 0)]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))  # disabled
list_item_27 = ListItem(List=curve_9, Index=0, Wrap=True)  # -> Item, Item1
curve_curve_2 = CurveCurve(CurveA=list_item_27.Item, CurveB=list_item_27.Item1)  # -> Points, ParamsA, ParamsB
xy_plane_2 = XYPlane(Origin=Point(0, 0, 0))
line = Line(StartPoint=curve_curve_2.Points, EndPoint=xy_plane_2)
graphical_element_11 = GraphicalElement(<curveelement referenced from the Revit model>)
unit_x = UnitX(Factor=1)
curve_10 = Curve(graphical_element_11)
end_points = EndPoints(Curve=curve_10)  # -> Start, End
line_sdl = LineSDL(Start=end_points.Start, Direction=unit_x, Length=Slider(2, range=0..10))

# ----
input_method_5 = ValueList({"Query at start": 1, "Stream from the previous step": 0}, selected="Stream from the previous step")

# ---- group: query by name
view_names_4 = Text(czym_sortowac_11)
stream_gate_3 = StreamGate(Stream=view_names_4, Gate=input_method_5)  # -> Target0, Target1
text_22 = Text(stream_gate_3.Target1)
rodzaj_karty_8 = Panel(item_selector)
concatenate_12 = Concatenate(FragmentA=rodzaj_karty_8, FragmentB=text_22)
query_views_11 = QueryViews(ViewName=concatenate_12, IsDependent=False, IsTemplate=False)
view_23 = View(query_views_11)

# ----
stream_filter_7 = StreamFilter(Gate=input_method_5, Stream0=views_created_2, Stream1=view_23)
view_24 = View(stream_filter_7)

division_5 = Division(A=number_4, B="1000000")
replace_text_3 = ReplaceText(Text=division_5, Find=".", Replace=",", RecursiveReplace=False)
concatenate_13 = Concatenate(FragmentA=replace_text_3, FragmentB=panel_67)

panel_71 = Panel(concatenate_13)

# ---- group: OBRACANIE WIDOKU
# A3
panel_72 = Panel("RHI_rotacja (clockwise) wejscia do mieskzania wzgledem Project North")
user_text_19 = UserText(Content=model_object_17, Keys=panel_72, UserTextMode=1)  # -> Content, Keys, Values
number_5 = Number(user_text_19.Values)
subtraction = Subtraction(A="360", B=number_5)
rotation_angle = Number(subtraction)

run_2 = BooleanToggle(False)
working_6 = Python3Script(RUN=run_2, angle=rotation_angle, reset_before_rotate=Toggle(True), view=view_22)  # -> out, outAngles, outCenters, outViews; inputs view: list
# ---------- working_6: Python ----------
# First Component Code: Rotate View

import clr
import math

clr.AddReference("RevitAPI")
clr.AddReference('RhinoInside.Revit')

from Autodesk.Revit.DB import *
from RhinoInside.Revit import Revit

# Get the active Revit document
uiapp = Revit.ActiveUIDocument
doc = uiapp.Document

# Output variables
outViews = []
outAngles = []
outCenters = []

def get_cropbox_element(the_view):
    """
    Retrieves the CropBox element associated with the given view.
    This is done by temporarily hiding the CropBox and collecting elements to identify it.
    """
    cropBoxElement = None

    # Hide the crop box to collect elements
    t = Transaction(doc, "Hide CropBox")
    t.Start()
    the_view.CropBoxVisible = False
    t.Commit()
    t.Dispose()

    # Collect elements currently shown in the view
    shown_elements = FilteredElementCollector(doc, the_view.Id).ToElementIds()

    # Unhide the crop box
    t = Transaction(doc, "Unhide CropBox")
    t.Start()
    the_view.CropBoxVisible = True
    t.Commit()
    t.Dispose()

    # Collect elements again, excluding previously collected ones
    collector = FilteredElementCollector(doc, the_view.Id).Excluding(shown_elements)
    cropBoxElement = collector.FirstElement()

    return cropBoxElement

def get_current_rotation(view):
    """
    Calculates and returns the current rotation angle of the view in degrees.
    """
    try:
        crop_box = view.CropBox
        transform = crop_box.Transform
        basisX = transform.BasisX
        angle_current_radians = math.atan2(basisX.Y, basisX.X)
        angle_current_degrees = math.degrees(angle_current_radians)
        return angle_current_degrees
    except Exception as e:
        print(f"Error getting current rotation for view '{view.Name}': {e}")
        return None

def rotate_view(view, angle_degrees, reset_before_rotate=False):
    """
    Rotates the view by the specified angle, optionally resetting the current rotation to 0 degrees first.
    Returns a tuple (success, total_rotation_degrees, center_point).
    """
    if not isinstance(view, View):
        print("Invalid input: 'view' must be a Revit View.")
        return False, 0.0, None

    if not isinstance(angle_degrees, (int, float)):
        print("Invalid input: 'angle_degrees' must be a number representing degrees.")
        return False, 0.0, None

    if not isinstance(reset_before_rotate, bool):
        print("Invalid input: 'reset_before_rotate' must be a boolean.")
        return False, 0.0, None

    try:
        # Get the crop box element
        cropBoxElement = get_cropbox_element(view)
        if cropBoxElement is None:
            print(f"Could not retrieve crop box element for view '{view.Name}'.")
            return False, 0.0, None

        # Get the current rotation angle
        angle_current_degrees = get_current_rotation(view)
        if angle_current_degrees is None:
            print(f"Could not determine current rotation angle for view '{view.Name}'.")
            return False, 0.0, None
        print(f"Current rotation angle of view '{view.Name}' is {angle_current_degrees} degrees.")

        # Define the rotation axis through the center of the crop box
        crop_box = view.CropBox
        center = crop_box.Transform.Origin
        p1 = center
        p2 = center + XYZ(0, 0, 1)
        axis = Line.CreateBound(p1, p2)

        # Start a transaction
        t = Transaction(doc, "Rotate View")
        t.Start()

        total_rotation_degrees = 0.0

        # If reset_before_rotate is True, rotate back to 0 degrees
        if reset_before_rotate:
            rotate_reset_radians = -math.radians(angle_current_degrees)
            ElementTransformUtils.RotateElement(doc, cropBoxElement.Id, axis, rotate_reset_radians)
            print(f"Reset rotation of view '{view.Name}' to 0 degrees.")
            total_rotation_degrees += -angle_current_degrees

        # Rotate the crop box element by angle_degrees
        rotate_radians = math.radians(angle_degrees)
        ElementTransformUtils.RotateElement(doc, cropBoxElement.Id, axis, rotate_radians)
        print(f"Rotated view '{view.Name}' by {angle_degrees} degrees.")
        total_rotation_degrees += angle_degrees

        t.Commit()
        print(f"Successfully rotated view '{view.Name}'.")
        return True, total_rotation_degrees, center
    except Exception as e:
        t.RollBack()
        print(f"An error occurred while rotating view '{view.Name}': {e}")
        return False, 0.0, None
    finally:
        t.Dispose()

if RUN_:
    # Input validation for 'view'
    if view is None:
        print("The 'view' input is None. Please provide a valid Revit View.")
    else:
        # Ensure 'view' is a list
        if isinstance(view, list):
            views = view
        elif isinstance(view, View):
            views = [view]
        else:
            print("Invalid input: 'view' must be a Revit View or a list of Revit Views.")
            views = []

        # Input validation for 'angle'
        if not isinstance(angle, (int, float)):
            print("Invalid input: 'angle' must be a number representing degrees.")
        else:
            # Input validation for 'reset_before_rotate'
            if 'reset_before_rotate' not in globals():
                reset_before_rotate = False  # Default value if not provided
            elif not isinstance(reset_before_rotate, bool):
                print("Invalid input: 'reset_before_rotate' must be a boolean.")
                reset_before_rotate = False

            for v in views:
                if v is not None:
                    success, total_rotation, center_point = rotate_view(v, angle, reset_before_rotate)
                    if success:
                        outViews.append(v)
                        outAngles.append(total_rotation)
                        outCenters.append(center_point)
                else:
                    print("One of the provided views is None and will be skipped.")
else:
    print("Set 'RUN_' to True to execute the script.")
# ---------- end working_6 ----------

views_rotated = View(working_6.outViews)
views_rotated_2 = View(views_rotated)

views_rotated_3 = View(views_rotated)
view_crop_region_5 = ViewCropRegion(View=views_rotated_3)  # -> View, CropRegion
rotation_angle_2 = Number(rotation_angle)
curve_11 = Curve(view_crop_region_5.CropRegion)
rotate_3 = Rotate(Geometry=curve_11, Angle=degrees(rotation_angle_2), Plane=PlaneXY(0, 0, 0))  # -> Geometry, Transform
view_crop_region_6 = ViewCropRegion(View=view_crop_region_5.View, CropRegion=rotate_3.Geometry)  # -> View, CropView, CropRegionVisible, CropRegion

# ---- group: CROP REGION / stream gate
input_method_6 = ValueList({"Query at start": 1, "Stream from the previous step": 0, "DISABLE": 2}, selected="Query at start")
view_names_5 = Text(czym_sortowac_11)
views_rotated_4 = View(views_rotated_2)
rodzaj_karty_9 = Text(item_selector)
query_views_12 = QueryViews(IsDependent=False, IsTemplate=False)
cluster_3 = Cluster(
    option_number=input_method_6,
    previous_step_views=views_rotated_4,
    rodzaj_karty=rodzaj_karty_9,
    view_names=view_names_5,
    views=query_views_12)  # -> simplify(view_3)
view_25 = View(cluster_3)

# ---- group: CROP REGION
# A4
model_objects_odpowiadajace_wskazanym_wi_6 = ModelObject(model_objects_odpowiadajace_wskazanym_wi_2)  # "MODEL OBJECTS ODPOWIADAJACE WSKAZANYM WIDOKOM"
explode_object_2 = ExplodeObject(Object=model_objects_odpowiadajace_wskazanym_wi_6, Recursive=False)
equality_filter_3 = EqualityFilter(Value="Crop Region")  # -> Equal, Unequal
filter_content_3 = FilterContent(Content=explode_object_2, Filter=equality_filter_3.Equal)  # -> simplify(Content)
view_26 = View(view_25)
curve_12 = Curve(filter_content_3)
view_crop_region_7 = ViewCropRegion(View=view_26, CropView=Toggle(True), CropRegionVisible=Toggle(True), CropRegion=curve_12)  # -> View, CropView, CropRegionVisible, CropRegion; disabled
view_27 = View(view_crop_region_7.View)

# ---- group: NIE WIEM CZY TO POTRZEBNE / stream from the previous step
previous_step_views = View(view_27)
views_created_3 = View(previous_step_views)

# ---- group: NIE WIEM CZY TO POTRZEBNE (continued)
stream_filter_8 = StreamFilter(Gate=option_number, Stream0=views_created_3, Stream1=view_12)
view_28 = View(stream_filter_8)
view_29 = View(view_28)

# ---- group: stream gate (continued)
views_rotated_5 = View(view_27)
cluster_4 = Cluster(
    option_number=input_method_2,
    previous_step_views=views_rotated_5,
    rodzaj_karty=rodzaj_karty_6,
    view_names=view_names_2,
    views=query_views_6)  # -> simplify(view_3)
view_30 = View(cluster_4)

# ----
clean_tree_7 = CleanTree(RemoveNulls=True, RemoveInvalid=True, RemoveEmpty=True, Tree=view_30)
panel_73 = Panel(clean_tree_7)

# ---- group: stream gate
input_method_7 = ValueList({"Query at start": 1, "Stream from the previous step": 0, "DISABLE": 2}, selected="Query at start")
rodzaj_karty_10 = Text(item_selector)
view_names_6 = Text(czym_sortowac_11)
views_rotated_6 = View(view_27)
query_views_13 = QueryViews(IsDependent=False, IsTemplate=False)
cluster_5 = Cluster(
    option_number=input_method_7,
    previous_step_views=views_rotated_6,
    rodzaj_karty=rodzaj_karty_10,
    view_names=view_names_6,
    views=query_views_13)  # -> simplify(view_3)
view_31 = View(cluster_5)

# ----
panel_74 = Panel(view_31)

# ---- group: MINIATURY / _REVIT-FILTERED
view_32 = View(view_31)

# ----
# B1
panel_75 = Panel(view_30)
element_name_10 = ElementName(Element=clean_tree_7)  # -> Element, Name
replace_text_4 = ReplaceText(Text=element_name_10.Name, Find=rodzaj_karty_6, RecursiveReplace=False)
text_23 = Text(replace_text_4)

panel_76 = Panel(element_name_10.Name)
concatenate_14 = Concatenate(FragmentA="SHT_", FragmentB=item_selector, FragmentC=text_23)
panel_77 = Panel(text_23)

# ---- group: query sheets (continued)
sheet_name = Text(concatenate_14)

# ----
concatenate_15 = Concatenate(FragmentA="*", FragmentB=sheet_name)
panel_78 = Panel(sheet_name)

# ---- group: query sheets (continued)
match_text_10 = MatchText(Text=element_name_7.Name, Pattern=concatenate_15, Case=True)
mass_addition = MassAddition(Input=match_text_10)  # -> Result, PartialResults
dispatch_36 = Dispatch(List=query_sheets_2, DispatchPattern=match_text_10)  # -> ListA, ListB
boolean_3 = Boolean(mass_addition.PartialResults)
dispatch_37 = Dispatch(List=sheet_name, DispatchPattern=boolean_3)  # -> ListA, ListB
list_length_5 = ListLength(List=flatten(dispatch_37.ListB))
series_5 = Series(Start=1, Step=1, Count=list_length_5)
format_7 = Format(Format="{0:000}", Culture=127, Data0=series_5)
concatenate_16 = Concatenate(FragmentA="SHT_", FragmentC="KM_1-", FragmentB=format_7)  # -> graft(Result)

# ----
nulls_in_empty_branches_4 = NullsInEmptyBranches(DataWithEmptyBranches=dispatch_37.ListB)

# ---- group: query sheets
list_length_6 = ListLength(List=sheet_name)
equality_4 = Equality(FirstNumber=list_length_6, SecondNumber="0")  # -> Equality, Inequality
pick_n_choose_5 = PickNChoose(Pattern=equality_4.Inequality, Stream0=graft(sheet_name), Stream1=graft(dispatch_36.ListA))
clean_tree_8 = CleanTree(RemoveNulls=True, RemoveInvalid=True, RemoveEmpty=True, Tree=pick_n_choose_5)

# ----
panel_79 = Panel(dispatch_37.ListB)
panel_80 = Panel(concatenate_16)
unflatten_tree = UnflattenTree(Tree=format_7, Guide=dispatch_37.ListB)

# ---- group: ADD SHEET
add_sheet = AddSheet(SheetNumber=concatenate_16, SheetName=dispatch_37.ListB, FailureProcessingMode=1)  # disabled

# ---- group: query sheets (continued)
sheet = Sheet(clean_tree_8)

# ---- group: stream gate (continued)
sheet_2 = Sheet(add_sheet)
sheet_3 = Sheet(sheet)
stream_filter_9 = StreamFilter(Gate=input_method_4, Stream0=sheet_2, Stream1=sheet_3)
sheet_4 = Sheet(stream_filter_9)

# ----
panel_82 = Panel(sheet_4)

panel_83 = Panel(sheet)
sheet_5 = Sheet(simplify(sheet_4))

sheet_6 = Sheet(simplify(sheet_4))

sheet_7 = Sheet(sheet_6)
element_parameter_2 = ElementParameter(Element=sheet_7, Parameter=inspect_element_8, Value=user_text_11.Values)  # -> Element, Value; disabled

sheet_8 = Sheet(sheet_6)
inspect_element_10 = InspectElement(Element=sheet_8)
element_parameter_3 = ElementParameter(Element=sheet_8, Parameter=inspect_element_10, Value=user_text_14.Values)  # -> Element, Value; disabled

sheet_9 = Sheet(sheet_6)
inspect_element_11 = InspectElement(Element=sheet_9)
element_parameter_4 = ElementParameter(Element=sheet_9, Parameter=inspect_element_11, Value=user_text_13.Values)  # -> Element, Value; disabled

sheet_10 = Sheet(sheet_6)
inspect_element_12 = InspectElement(Element=sheet_10)
element_parameter_5 = ElementParameter(Element=sheet_10, Parameter=inspect_element_12, Value=list_length_4)  # -> Element, Value; disabled

sheet_11 = Sheet(sheet_6)
element_parameter_6 = ElementParameter(Element=sheet_11, Parameter=inspect_element_9, Value=user_text_18.Values)  # -> Element, Value; disabled

sheet_12 = Sheet(sheet_6)
inspect_element_13 = InspectElement(Element=sheet_12)
inspect_element_14 = InspectElement(Element=sheet_12)
element_parameter_7 = ElementParameter(Element=sheet_12, Parameter=inspect_element_14, Value=inspect_element_7.DataPIG_PowBrutto)  # -> Element, Value; disabled
element_parameter_8 = ElementParameter(Element=sheet_12, Parameter=inspect_element_13, Value=inspect_element_7.DataPIG_PowLokalu)  # -> Element, Value; disabled

panel_84 = Panel(sheet_10)

# ---- group: ADD VIEWPORT
# B3 - a
view_33 = View(clean_tree_7)
sheet_13 = Sheet(sheet_4)
miejsce_na_rzut = Curve([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])
join_curves_3 = JoinCurves(Curves=pod_mieszkania, Preserve=False)
area_3 = Area(Geometry=join_curves_3)  # -> Area, Centroid
plane_12 = Plane(area_3.Centroid)
add_viewport = AddViewport(Sheet=sheet_13, View=view_33, Point=plane_12)
miejsce_na_rzut_2 = Curve(join_curves_3)
viewport = GraphicalElement(add_viewport)

# ---- group: reference viewport
# B3 - b
cluster_6 = Cluster_2()
category_filter_2 = CategoryFilter(Categories=cluster_6, Inverted=False)
element_dependents = ElementDependents(Element=sheet_13, Filter=category_filter_2)
rodzaj_karty_prefix = Text(item_selector)
concatenate_17 = Concatenate(Fragment_A="*", Fragment_B=rodzaj_karty_prefix, A="*")
element_name_11 = ElementName(Element=element_dependents)  # -> Element, Name
rodzaj_karty_pattern = Text(concatenate_17)
panel_85 = Panel("*m_kat*")
panel_86 = Panel("*m_map*")
match_text_11 = MatchText(Text=element_name_11.Name, Pattern=rodzaj_karty_pattern, Case=False)
dispatch_38 = Dispatch(List=element_dependents, DispatchPattern=match_text_11)  # -> ListA, ListB
rodzaj_karty_pattern_2 = Text(rodzaj_karty_pattern)
viewport_2 = Data(dispatch_38.ListA)

# ----
panel_87 = Panel(sheet_13)
graphical_element_12 = GraphicalElement(element_dependents)
panel_88 = Panel(viewport)
panel_89 = Panel(view_33)
element_location_7 = ElementLocation(Element=viewport, Location=plane_3)  # -> Element, Location, Hand, Facing, WorkPlane; disabled

# ----
# SHEETS
view_34 = View(viewport)

# ----
# SKALA RZUTU (VIEWPORT NA SHEECIE)
# B4
viewport_3 = GraphicalElement(viewport_2)

cluster_7 = Cluster_2()
sheet_14 = Sheet(sheet_13)
rodzaj_karty_pattern_3 = Text(rodzaj_karty_pattern_2)
category_filter_3 = CategoryFilter(Categories=cluster_7, Inverted=False)
element_dependents_2 = ElementDependents(Element=sheet_14, Filter=category_filter_3)
element_name_12 = ElementName(Element=element_dependents_2)  # -> Element, Name
match_text_12 = MatchText(Text=element_name_12.Name, Pattern=rodzaj_karty_pattern_3, Case=False)
dispatch_39 = Dispatch(List=element_dependents_2, DispatchPattern=match_text_12)  # -> ListA, ListB
data_17 = Data(dispatch_39.ListA)
surface_4 = Surface(dispatch_39.ListA)
curve_13 = Curve(surface_4)
bounding_rectangle_2 = BoundingRectangle(Geometry=curve_13, Plane=PlaneXY(0, 0, 0), Axis=0, Slide=0, Union=True)  # -> Bounding, DimensionX, DimensionY
rectangle_2 = Rectangle(bounding_rectangle_2.Bounding)

inspect_element_15 = InspectElement(Element=viewport_3)
element_parameter_9 = ElementParameter(Element=viewport_3, Parameter=inspect_element_15, Value=Toggle(True))  # -> Element, Value

# ---- group: USTAW SKALE STARTOWA RZUTU
miejsce_na_rzut_3 = Curve(miejsce_na_rzut_2)
element_5 = Element(element_parameter_9.Element)
inspect_element_16 = InspectElement(Element=element_5)
skala_startowa = Integer(graft(skala_startowa_rzutu_2))
offset_curve = OffsetCurve(Curve=miejsce_na_rzut_3, Plane=PlaneXY(0, 0, 0), Distance=Slider(-0.3, range=-2..2), BothSides=0, Kinks=0, CapType=1)
data_18 = Data(inspect_element_16)
area_4 = Area(Geometry=offset_curve)  # -> Area, Centroid
element_parameter_10 = ElementParameter(Element=element_5, Parameter=data_18, Value=skala_startowa)  # -> Element, Value
miejsce_na_rzut_4 = Curve(offset_curve)
punkt_wstawienia_rzutu = Point(area_4.Centroid)
skala_startowa_2 = Integer(element_parameter_10.Value)

# ----
panel_90 = Panel(rodzaj_karty_pattern_3)

punkt_wstawienia_rzutu_2 = Point(punkt_wstawienia_rzutu)
view_35 = View(view_30)
miejsce_na_rzut_5 = Curve(miejsce_na_rzut_4)
graphical_element_13 = GraphicalElement(element_parameter_10.Element)
viewport_4 = Element(viewport_2)
skala_startowa_3 = Integer(skala_startowa_2)

run_3 = BooleanToggle(True)  # disabled
view_36 = View(view_35)  # disabled
get_view_rotation_angles_2 = Python3Script(RUN=run_3, view=view_36)  # -> out, outAngles, outCenters, outViews; inputs view: list; disabled; same code as get_view_rotation_angles
panel_91 = Panel("360")  # disabled
subtraction_2 = Subtraction(A=panel_91, B=get_view_rotation_angles_2.outAngles)  # disabled
angle = Number(subtraction_2)  # disabled

rectangle_3 = Rectangle(rectangle_2)

group_toggle_5 = GroupToggle(ToggleActive=True, ToggleVisible=False)  # disabled
viewport_5 = View(viewport_4)  # disabled
surface_5 = Surface(viewport_5)  # disabled
area_5 = Area(Geometry=rectangle_3)  # -> Area, Centroid; disabled
bounding_rectangle_3 = BoundingRectangle(Geometry=surface_5, Plane=PlaneXY(0, 0, 0), Axis=0, Slide=0, Union=True)  # -> Bounding, DimensionX, DimensionY; disabled
plane_13 = Plane(area_5.Centroid)  # disabled
view_crop_region_8 = ViewCropRegion(View=viewport_5)  # -> View, CropView, CropRegionVisible, CropRegion; disabled
curve_14 = Curve(view_crop_region_8.CropRegion)  # disabled
explode_2 = Explode(Curve=curve_14, Recursive=True)  # -> Segments, Vertices; disabled
join_curves_4 = JoinCurves(Curves=explode_2.Segments, Preserve=False)  # disabled
bounding_rectangle_4 = BoundingRectangle(Geometry=join_curves_4, Plane=PlaneXY(0, 0, 0), Axis=0, Slide=0, Union=True)  # -> Bounding, DimensionX, DimensionY; disabled
area_6 = Area(Geometry=bounding_rectangle_4.Bounding)  # -> Area, Centroid; disabled
skala_startowa_4 = Integer(skala_startowa_3)  # disabled
plane_14 = Plane(area_6.Centroid)  # disabled
scale = Scale(Geometry=bounding_rectangle_4.Bounding, Center=plane_14, Factor=expr("1/x", skala_startowa_4))  # -> Geometry, Transform; disabled
skala_startowa_5 = Integer(skala_startowa_3)  # disabled
scale_2 = Scale(Geometry=join_curves_4, Center=plane_14, Factor=expr("1/x", skala_startowa_5))  # -> Geometry, Transform; disabled
rotate_4 = Rotate(Geometry=scale.Geometry, Angle=degrees(angle), Plane=plane_14)  # -> Geometry, Transform; disabled
plane_15 = Plane(plane_13)  # disabled
line_2 = Line(StartPoint=plane_14, EndPoint=plane_15)  # disabled
rotate_5 = Rotate(Geometry=scale_2.Geometry, Angle=degrees(angle), Plane=plane_14)  # -> Geometry, Transform; disabled
move_2 = Move(Geometry=rotate_4.Geometry, Motion=line_2)  # -> Geometry, Transform; disabled
move_3 = Move(Geometry=rotate_5.Geometry, Motion=line_2)  # -> Geometry, Transform; disabled
bounding_rectangle_na_sheecie = Curve(move_2.Geometry)  # disabled
area_7 = Area(Geometry=bounding_rectangle_na_sheecie)  # -> Area, Centroid; disabled
crop_region_na_sheecie = Curve(move_3.Geometry)  # disabled
punkt_wstawienia_rzutu_3 = Point(area_7.Centroid)  # disabled

panel_92 = Panel(punkt_wstawienia_rzutu_3)
panel_93 = Panel(angle)

# ---- group: ADD TITLEBLOCK (continued)
sheet_15 = Sheet(sheet_4)  # disabled
add_title_block = AddTitleBlock(Sheet=sheet_15, Type=element_type.Type)  # disabled

# ----
query_view_elements_3 = QueryViewElements(View=sheet_15, Categories=built_in_categories)

# ---- group: ADD TITLEBLOCK (continued)
element_location_8 = ElementLocation(Element=query_view_elements_3, Location=plane_2)  # -> Element, Location, Hand, Facing, WorkPlane; disabled
move_4 = Move(Geometry=element_location_8.Location, Motion=line)  # -> Geometry, Transform
move_5 = Move(Geometry=move_4.Geometry, Motion=line_sdl)  # -> Geometry, Transform
element_location_9 = ElementLocation(Element=element_location_8.Element, Location=move_5.Geometry)  # -> Element, Location, Hand, Facing, WorkPlane

# ----
panel_94 = Panel(query_view_elements_3)
panel_95 = Panel(element_location_8.Location)

sheet_16 = Sheet(sheet_5)
inspect_element_17 = InspectElement(Element=sheet_16)
inspect_element_18 = InspectElement(Element=sheet_16)
element_parameter_11 = ElementParameter(Element=sheet_16, Parameter=inspect_element_17, Value=inspect_element_5.DataPIG_PowBrutto)  # -> Element, Value; disabled

number_6 = Number(inspect_element_18)

division_6 = Division(A=number_6, B="100")
replace_text_5 = ReplaceText(Text=division_6, Find=".", Replace=",", RecursiveReplace=False)
concatenate_18 = Concatenate(FragmentA=replace_text_5, FragmentB=panel_49)
element_parameter_12 = ElementParameter(Element=sheet_16, Parameter=inspect_element_18, Value=concatenate_18)  # -> Element, Value; disabled

panel_96 = Panel(concatenate_18)
format_8 = Format(Format="{0:0.00}", Culture=127, Data0=concatenate_18)
panel_97 = Panel(format_8)

# ---- group: MINIATURY
model_objects_odpowiadajace_wskazanym_wi_7 = ModelObject(model_objects_odpowiadajace_wskazanym_wi_2)  # "MODEL OBJECTS ODPOWIADAJACE WSKAZANYM WIDOKOM"
element_name_13 = ElementName(Element=view_32)  # -> Element, Name
text_split_11 = TextSplit(Text=element_name_13.Name, Separators="_")
list_item_28 = ListItem(List=text_split_11, Index=0, Wrap=True)  # -> Item, Item1, Item2
concatenate_19 = Concatenate(FragmentA="ZZ_MAP_", FragmentB=list_item_28.Item2)
view_37 = View(view_32)
panel_98 = Panel(":ZZ*")  # disabled

# ---- group: MINIATURY / _RHINO
model_objects_odpowiadajace_wskazanym_wi_8 = ModelObject(simplify(graft(model_objects_odpowiadajace_wskazanym_wi_7)))  # "MODEL OBJECTS ODPOWIADAJACE WSKAZANYM WIDOKOM"

# ---- group: MINIATURY (continued)
user_text_20 = UserText(Content=model_objects_odpowiadajace_wskazanym_wi_8, Keys="PIG_Nr Komercyjny", UserTextMode=1)  # -> Content, Keys, Values

# ----
panel_99 = Panel(element_name_13.Name)

# ---- group: MINIATURY / ADD FILTER DEFINITIONS / _RHINO
model_objects_odpowiadajace_wskazanym_wi_9 = ModelObject(simplify(graft(model_objects_odpowiadajace_wskazanym_wi_7)))  # "MODEL OBJECTS ODPOWIADAJACE WSKAZANYM WIDOKOM"

# ---- group: MINIATURY / ADD FILTER DEFINITIONS
filter_name = Text(concatenate_19)
user_text_21 = UserText(Content=model_objects_odpowiadajace_wskazanym_wi_9, Keys="PIG_Nr Zbiorczy", UserTextMode=1)  # -> Content, Keys, Values
pig_nr_zbiorczy = Text(user_text_21.Values)
query_parameters = QueryParameters(Name="PIG_Nr Komercyjny")
query_parameters_2 = QueryParameters(Name="PIG_Nr Zbiorczy")
text_24 = Text(user_text_20.Values)
equals_rule = EqualsRule(Parameter=query_parameters_2, Value=pig_nr_zbiorczy)
equals_rule_2 = EqualsRule(Parameter=query_parameters, Value=text_24)  # disabled
merge_4 = Merge(Data1=equals_rule, Data2=equals_rule_2)
parameter_filter = ParameterFilter(Rules=merge_4, Inverted=False)
category_4 = Category(<category referenced from the Revit model>)
add_rule_based_filter = AddRuleBasedFilter(Name=filter_name, Categories=category_3, Filter=parameter_filter, FailureProcessingMode=1, TrackingMode=2)  # disabled
category_5 = Category(<category referenced from the Revit model>)
rule_based_filter_definiton = RuleBasedFilterDefiniton(RuleBasedFilter=add_rule_based_filter, Categories=category_3)  # -> RuleBasedFilter, Categories, Filter

# ---- group: MINIATURY
explode_object_3 = ExplodeObject(Object=model_objects_odpowiadajace_wskazanym_wi_9, Recursive=False)
equality_filter_4 = EqualityFilter(Value="Surfaces")  # -> Equal, Unequal
filter_content_4 = FilterContent(Content=explode_object_3, Filter=equality_filter_4.Equal)
user_text_22 = UserText(Content=filter_content_4, Keys="REV_Unique ID", UserTextMode=1)  # -> Content, Keys, Values
query_element_9 = QueryElement(Id=user_text_22.Values)

# ----
panel_100 = Panel(concatenate_19)  # disabled
panel_101 = Panel(category_4)
panel_102 = Panel(rule_based_filter_definiton.RuleBasedFilter)

# ---- group: MINIATURY / MAP FILTERS_REVIT-FILTERED
element_6 = Element(rule_based_filter_definiton.RuleBasedFilter)

# ---- group: MINIATURY / APPLY VIEW TEMPLATE
view_38 = View(view_37)
panel_103 = Panel(":*pw_karta_mapa*")
inspect_element_19 = InspectElement(Element=view_38)
query_views_14 = QueryViews(ViewName="PW_KARTY_MIESZKAŃ_MAPA", IsDependent=False, IsTemplate=True)
element_parameter_13 = ElementParameter(Element=view_38, Parameter=inspect_element_19, Value=query_views_14)  # -> Element, Value; disabled

# ----
panel_104 = Panel(query_views_14)
panel_105 = Panel(element_parameter_13.Value)

dostepne_skale_2 = Panel("""50
70
90
110
120
125
135""")  # disabled
miejsce_na_rzut_6 = Curve(miejsce_na_rzut_5)  # disabled
crop_region_na_sheecie_2 = Curve(crop_region_na_sheecie)  # disabled
element_7 = Element(viewport_4)  # disabled
punkt_wstawienia_rzutu_4 = Point(punkt_wstawienia_rzutu_3)  # disabled
punkt_wstawienia_rzutu_5 = Point(punkt_wstawienia_rzutu_2)  # disabled
group_toggle_6 = GroupToggle(ToggleActive=True, ToggleVisible=False)  # disabled
dostepne_skale_3 = Text(dostepne_skale_2)  # disabled
skala_startowa_6 = Integer(skala_startowa_3)  # disabled
division_7 = Division(A=skala_startowa_6, B=dostepne_skale_3)  # disabled
scale_3 = Scale(Geometry=crop_region_na_sheecie_2, Center=punkt_wstawienia_rzutu_4, Factor=division_7)  # -> Geometry, Transform; disabled
miejsce_na_rzut_7 = Curve(miejsce_na_rzut_6)  # disabled
area_8 = Area(Geometry=miejsce_na_rzut_7)  # -> Area, Centroid; disabled
plane_16 = Plane(area_8.Centroid)  # disabled
line_3 = Line(StartPoint=punkt_wstawienia_rzutu_4, EndPoint=plane_16)  # disabled
move_6 = Move(Geometry=scale_3.Geometry, Motion=line_3)  # -> simplify(Geometry), Transform; disabled
collision_one_many_2 = CollisionOneMany(Collider=move_6.Geometry, Obstacles=miejsce_na_rzut_7)  # -> Collision, Index; disabled
dispatch_40 = Dispatch(List=dostepne_skale_3, DispatchPattern=collision_one_many_2.Collision)  # -> ListA, ListB; disabled
element_8 = Element(element_7)  # disabled
inspect_element_20 = InspectElement(Element=element_8)  # disabled
list_item_29 = ListItem(List=dispatch_40.ListB, Index=0, Wrap=True)  # disabled
data_19 = Data(inspect_element_20)  # disabled
punkt_wstawienia_rzutu_6 = Point(punkt_wstawienia_rzutu_5)  # disabled
skala = Integer()  # disabled

curve_15 = Curve(simplify(move_6.Geometry))  # disabled
xy_plane_3 = XYPlane(Origin=Point(0, 0, 0))  # disabled
miejsce_na_rzut_8 = Curve(simplify(miejsce_na_rzut_6))  # disabled
region_intersection = RegionIntersection(CurvesA=curve_15, CurvesB=miejsce_na_rzut_8, Plane=xy_plane_3)  # disabled
data_20 = Data(curve_15)  # disabled
curve_16 = Curve(region_intersection)  # disabled
area_9 = Area(Geometry=data_20)  # -> Area, Centroid; disabled
area_10 = Area(Geometry=curve_16)  # -> Area, Centroid; disabled
similarity = Similarity(FirstNumber=area_9.Area, SecondNumber=area_10.Area, Threshold=0.1)  # -> Similarity, AbsoluteDifference; disabled
dispatch_41 = Dispatch(List=dostepne_skale_3, DispatchPattern=similarity.Similarity)  # -> ListA, ListB; disabled
list_item_30 = ListItem(List=dispatch_41.ListA, Index=0, Wrap=True)  # disabled

element_parameter_14 = ElementParameter(Element=element_8, Parameter=data_19, Value=list_item_30)  # -> Element, Value; disabled
element_location_10 = ElementLocation(Element=element_parameter_14.Element, Location=punkt_wstawienia_rzutu_6)  # -> Element, Location, Hand, Facing, WorkPlane; disabled

# ---- group: MINIATURY
colour_swatch_2 = ColourSwatch(SwatchColor=RGB(84, 107, 156))
graphic_overrides = GraphicOverrides(ForegroundColorSurfacePatterns=colour_swatch_2)
view_39 = View(view_37)
view_filters = ViewFilters(View=view_39, Filters=element_6)  # -> View, Filters; disabled

# ----
panel_106 = Panel(view_39)
graphic_overrides_2 = GraphicOverrides(ForegroundPatternSurfacePatterns=foreground_pattern_surface_patterns, ForegroundColorSurfacePatterns=colour_swatch_2)

# ---- group: MINIATURY (continued)
filter_graphic_overrides_2 = FilterGraphicOverrides(View=view_filters.View, Filter=view_filters.Filters, Overrides=graphic_overrides_2)  # -> View, Filter, Hidden, Overrides; disabled

# ----
panel_107 = Panel(filter_graphic_overrides_2.Hidden)

# ==== cluster SORTUJMETODAMARINA: Sortowanie dla mariny
czym_sortowac = ClusterInput()
model_object = ClusterInput()
regex = ClusterInput()

# ---- group: SORTUJ - METODA (MARINA) / OCZYSC PONOWNIE
regex_2 = Text(regex)
model_object_2 = ModelObject(model_object)
czym_sortowac_2 = Text(czym_sortowac)
panel = Panel(regex_2)
match_text = MatchText(Text=czym_sortowac_2, RegEx=panel, Case=False)
dispatch = Dispatch(List=model_object_2, DispatchPattern=match_text)  # -> ListA, ListB
dispatch_2 = Dispatch(List=czym_sortowac_2, DispatchPattern=match_text)  # -> ListA, ListB
model_object_3 = ModelObject(flatten(dispatch.ListA))
czym_sortowac_3 = Text(flatten(dispatch_2.ListA))

# ---- group: SORTUJ - METODA (MARINA)
integer = Integer(czym_sortowac_3)
format = Format(Format="{0:000}", Culture=127, Data0=integer)
python_3_script = Python3Script(Keys=format, Values=model_object_3)  # -> out, SortedKeys, SortedValues; inputs Keys: list, Values: list
# ---------- python_3_script: Python ----------
"""Sorts a list of key strings containing numeric elements 
    (Strings contain none or more numeric characters, followed
    by none or more non-numeric characters).
    
    Inputs:
        Keys: A list of keys to be sorted. Keys need not be unique,
            but must not be longer than 2048 characters.
        Values: A list of associated values to be sorted using keys
    Output:
        SortedKeys: Keys sorted using an intelligent interpretation
        of numbers.
        SortedValues: Values reordered according to sorted Keys"""

__author__ = "Jeremy Swift"
__version__ = "2023.10.14"

import re

sentinel = "aaaaaaaaaaaaaaaa"

pattern = re.compile("(\d*)(\D*)")
ksplits = [pattern.match(k).groups() for k in Keys]
paddedNums = []
for i in range(len(Keys)):
    if not ksplits[i][0]:
        paddedNums.append(sentinel + ksplits[i][1].ljust(2048) + str(i).rjust(16))
    else:
        paddedNums.append(ksplits[i][0].rjust(16) + ksplits[i][1].ljust(2048) + str(i).rjust(16))

dic = dict(zip(paddedNums, range(len(Keys))))

SortedKeys = []
SortedValues = []
for k in sorted(paddedNums):
    i = dic[k]
    SortedKeys.append(Keys[i])
    SortedValues.append(Values[i])

if len(SortedKeys) != len(Keys):
    out = "Sort error (Value(s) probably not conforming to expected pattern)."
# ---------- end python_3_script ----------
model_object_4 = ModelObject(python_3_script.SortedValues)
czym_sortowac_4 = Text(python_3_script.SortedKeys)

# ----
czym_sortowac_5 = ClusterOutput(czym_sortowac_4)
model_object_5 = ClusterOutput(model_object_4)

# ==== cluster SORTUJMETODAMANKOWSKA: Sortowanie dla mariny
czym_sortowac = ClusterInput()
model_object = ClusterInput()
regex_test = ClusterInput()  # Sprawdz czy nazwy do sortowania spelniaja kryteria nazewnictwa.

# ---- group: SORTUJ - METODA (MARINA) / OCZYSC PONOWNIE
model_object_2 = ModelObject(model_object)
regex_test_2 = Text(regex_test)
czym_sortowac_2 = Text(czym_sortowac)
panel = Panel(regex_test_2)
regex_test_3 = Python3Script(text_list=czym_sortowac_2, regex_pattern=panel)  # -> out, matches; inputs text_list: list of String, regex_pattern: String
# ---------- regex_test_3: Python ----------
import re

def check_regex(pattern, strings):
    """Check if strings match the regex pattern."""
    try:
        compiled_pattern = re.compile(pattern)
    except re.error as e:
        return [f"Invalid regex: {e}"], False

    results = [bool(compiled_pattern.match(s)) for s in strings]
    return results, True

# Inputs
regex_pattern = regex_pattern  # Regex pattern (string)
text_list = text_list          # List of strings to validate

# Output
matches, success = check_regex(regex_pattern, text_list)

if not success:
    matches = ["Invalid regex pattern provided. Please correct it."]
# ---------- end regex_test_3 ----------
dispatch = Dispatch(List=model_object_2, DispatchPattern=regex_test_3.matches)  # -> ListA, ListB
dispatch_2 = Dispatch(List=czym_sortowac_2, DispatchPattern=regex_test_3.matches)  # -> ListA, ListB
model_object_3 = ModelObject(dispatch.ListA)
czym_sortowac_3 = Text(dispatch_2.ListA)

# ----
panel_2 = Panel(czym_sortowac_2)

# ---- group: cos nie dziala
match_text = MatchText(Text=czym_sortowac_2, RegEx=panel, Case=False)  # disabled

# ---- group: SORTUJ - METODA (MARINA) / vanilla Python
natural_sort = Python3Script(strings=czym_sortowac_3, values=model_object_3, min_padding=Slider(1, range=0..10))  # -> result, zero_padded, sorted_values_output; inputs strings: list, values: list, min_padding: Int32
# ---------- natural_sort: Python ----------
import re

# Inputs
# IN[0]: strings (List of strings to be sorted)
# IN[1]: values (List of values corresponding to the strings)
# IN[2]: min_padding (Integer specifying the minimum number of zeros to pad)

def natural_sort_key(s):
    """
    Key function for natural sorting: split the string into parts
    of digits and non-digits and process numbers as integers.
    """
    return [int(text) if text.isdigit() else text for text in re.split(r'(\d+)', s)]

def calculate_group_padding(strings, min_padding=0):
    """
    Calculates the necessary padding for each numeric group in the strings.
    """
    # Find the maximum number of digits for each numeric group across all strings
    group_max_lengths = []
    for s in strings:
        parts = re.split(r'(\d+)', s)
        for i, part in enumerate(parts):
            if part.isdigit():
                # Ensure group_max_lengths has enough entries for all groups
                while len(group_max_lengths) <= i:
                    group_max_lengths.append(0)
                # Update the maximum length for this group
                group_max_lengths[i] = max(group_max_lengths[i], len(part))
    
    # Apply the minimum padding constraint
    group_max_lengths = [max(length, min_padding) for length in group_max_lengths]
    
    return group_max_lengths

def add_group_specific_zeros(strings, group_max_lengths):
    """
    Adds group-specific padding to numeric parts of the strings.
    """
    padded_strings = []
    for s in strings:
        parts = re.split(r'(\d+)', s)
        padded_string = ''.join(
            part.zfill(group_max_lengths[i]) if part.isdigit() else part
            for i, part in enumerate(parts)
        )
        padded_strings.append(padded_string)
    return padded_strings

if "strings" in globals():
    try:
        # Perform natural sort and get sorting indices
        sorting_indices = sorted(range(len(strings)), key=lambda i: natural_sort_key(strings[i]))
        
        # Naturally sorted strings
        sorted_strings = [strings[i] for i in sorting_indices]
        
        # Determine padding lengths for each numeric group
        group_max_lengths = calculate_group_padding(sorted_strings, min_padding=min_padding)
        
        # Zero-padded strings for regular sorting
        zero_padded_strings = add_group_specific_zeros(sorted_strings, group_max_lengths)

        # Sort values to follow the order of sorted strings
        sorted_values = [values[i] for i in sorting_indices] if values else None

        # Outputs
        result = sorted_strings          # Naturally sorted strings
        zero_padded = zero_padded_strings # Strings with custom leading zeros
        sorted_values_output = sorted_values  # Values sorted to match strings

    except Exception as e:
        # Error handling
        result = None
        zero_padded = f"An error occurred: {str(e)}"
        sorted_values_output = None
else:
    result = None
    zero_padded = None
    sorted_values_output = None
# ---------- end natural_sort ----------

# ----
panel_3 = Panel(dispatch_2.ListA)

# ---- group: SORTUJ - METODA (MARINA)
model_object_4 = ModelObject(natural_sort.sorted_values_output)
zero_padded_strings = Text(natural_sort.zero_padded)
natural_sort_2 = Text(natural_sort.result)

# ---- group: old
python_3_script = Python3Script(Keys=czym_sortowac_3, Values=model_object_3)  # -> out, SortedKeys, SortedValues; inputs Keys: list, Values: list; disabled; same code as python_3_script

# ---- group: natural sort library
natural_sort_3 = Python3Script(strings=czym_sortowac_3)  # -> result; inputs strings: list; disabled
# ---------- natural_sort_3: Python ----------
# requirements: natsort
import ghpythonlib.components as gh
from natsort import natsorted

# Inputs
# IN[0]: strings (List of strings to be sorted)

if "strings" in globals():
    try:
        # Perform natural sort
        sorted_strings = natsorted(strings)

        # Output the result
        result = sorted_strings

    except Exception as e:
        # Error handling
        error_message = f"An error occurred: {str(e)}"
        result = None
else:
    result = None
# ---------- end natural_sort_3 ----------

# ----
zero_padded_strings_2 = ClusterOutput(zero_padded_strings)
natural_sort_4 = ClusterOutput(natural_sort_2)
model_object_5 = ClusterOutput(model_object_4)
panel_4 = Panel(natural_sort_2)

# ==== cluster Cluster
previous_step_views = ClusterInput()
view_names = ClusterInput()
rodzaj_karty = ClusterInput()
option_number = ClusterInput()
views = ClusterInput()

# ---- group: stream from the previous step
previous_step_views_2 = View(previous_step_views)
views_created = View(previous_step_views_2)

# ----
option_number_2 = Integer(option_number)

# ---- group: query by name
view_names_2 = Text(view_names)
rodzaj_karty_2 = Text(rodzaj_karty)
stream_gate = StreamGate(Stream=view_names_2, Gate=option_number_2)  # -> Target0, Target1, Target2
rodzaj_karty_3 = Panel("M_KAT-01_")
text = Text(stream_gate.Target1)
concatenate = Concatenate(FragmentA=rodzaj_karty_2, FragmentB=text)
query_views = QueryViews(ViewName=concatenate, IsDependent=False, IsTemplate=False)  # disabled

# ----
view_name = Text(concatenate)
views_2 = View(views)
element_name = ElementName(Element=views_2)  # -> Element, Name
match_text = MatchText(Text=element_name.Name, Pattern=view_name, Case=True)
dispatch = Dispatch(List=views_2, DispatchPattern=match_text)  # -> ListA, ListB
views_3 = View(dispatch.ListA)

# ---- group: query by name (continued)
view = View(views_3)

# ----
stream_filter = StreamFilter(Gate=option_number_2, Stream0=views_created, Stream1=view)
view_2 = View(stream_filter)

view_3 = ClusterOutput(view_2)

# ==== cluster QueryRevitViewsFast
view_name = ClusterInput()
views = ClusterInput()
view_name_2 = Text(view_name)

empty_object_to_empty_branch = EmptyObjectToEmptyBranch(DataIn=view_name_2)
list_length = ListLength(List=empty_object_to_empty_branch)
equality = Equality(FirstNumber=list_length, SecondNumber="0")  # -> Equality, Inequality

views_2 = View(views)
element_name = ElementName(Element=views_2)  # -> Element, Name
match_text = MatchText(Text=element_name.Name, Pattern=view_name_2, Case=True)
dispatch = Dispatch(List=views_2, DispatchPattern=match_text)  # -> ListA, ListB
views_3 = View(dispatch.ListA)

stream_filter = StreamFilter(Gate=equality.Equality, Stream0=views_3)
s_1 = ClusterOutput(stream_filter)

# ==== cluster QueryRevitViewsFast_2
view_name = ClusterInput()
views = ClusterInput()
view_name_2 = Text(view_name)

empty_object_to_empty_branch = EmptyObjectToEmptyBranch(DataIn=view_name_2)
list_length = ListLength(List=empty_object_to_empty_branch)
equality = Equality(FirstNumber=list_length, SecondNumber="0")  # -> Equality, Inequality

views_2 = View(views)
element_name = ElementName(Element=views_2)  # -> Element, Name
match_text = MatchText(Text=element_name.Name, Pattern=view_name_2, Case=True)
dispatch = Dispatch(List=views_2, DispatchPattern=match_text)  # -> ListA, ListB
views_3 = View(dispatch.ListA)

stream_filter = StreamFilter(Gate=equality.Equality, Stream0=views_3)
stream = ClusterOutput(stream_filter)

# ==== cluster ConcatenateCheckLists
czlon_2 = ClusterInput()
czlon_1 = ClusterInput()
czlon_2_2 = Text(czlon_2)
czlon_1_2 = Text(czlon_1)

# ---- group: czy lista jest pusta?
empty_object_to_empty_branch = EmptyObjectToEmptyBranch(DataIn=czlon_2_2)
list_length = ListLength(List=empty_object_to_empty_branch)
equality = Equality(FirstNumber=list_length, SecondNumber="0")  # -> Equality, Inequality

empty_object_to_empty_branch_2 = EmptyObjectToEmptyBranch(DataIn=czlon_1_2)
list_length_2 = ListLength(List=empty_object_to_empty_branch_2)
# INFO: sprawdz czy ktoras lista nie jest pusta
panel = Panel("0")
equality_2 = Equality(FirstNumber=list_length_2, SecondNumber=panel)  # -> Equality, Inequality

# ----
panel_2 = Panel(czlon_2_2)
panel_3 = Panel(czlon_1_2)
panel_4 = Panel(equality.Equality)
panel_5 = Panel(equality_2.Equality)
concatenate = Concatenate(FragmentA=czlon_1_2, FragmentB=czlon_2_2)
gate_or = GateOr(A=equality_2.Equality, B=equality.Equality)
data = Data(flatten(gate_or))
create_set = CreateSet(List=data)  # -> Set, Map
list_item = ListItem(List=create_set.Set, Index=0, Wrap=True)
stream_filter = StreamFilter(Gate=list_item, Stream0=concatenate)
s_1 = ClusterOutput(stream_filter)

# ==== cluster Cluster_2
built_in_categories = BuiltInCategories("autodesk.revit.category.local:viewports-1.0.0", SearchPattern="viewports")
viewports_category = Category(built_in_categories)
viewports_category_2 = ClusterOutput(viewports_category)

# ==== cluster QueryRevitViewsFast_3
view_name = ClusterInput()
views = ClusterInput()
view_name_2 = Text(view_name)

empty_object_to_empty_branch = EmptyObjectToEmptyBranch(DataIn=view_name_2)
list_length = ListLength(List=empty_object_to_empty_branch)
equality = Equality(FirstNumber=list_length, SecondNumber="0")  # -> Equality, Inequality

views_2 = View(views)
element_name = ElementName(Element=views_2)  # -> Element, Name
match_text = MatchText(Text=element_name.Name, Pattern=view_name_2, Case=True)
dispatch = Dispatch(List=views_2, DispatchPattern=match_text)  # -> ListA, ListB
views_3 = View(dispatch.ListA)

stream_filter = StreamFilter(Gate=equality.Equality, Stream0=views_3)
s_0 = ClusterOutput(stream_filter)
