# Grasshopper definition loop.gh (Grasshopper 1.0.8)
# plug-ins: Anemone

data_1 = Data()
data_2 = Data()
data_3 = Data()
criteria_1 = Text()  # disabled
object = Data()
criteria_2 = Text()  # disabled
criteria_3 = Text()
list_length = ListLength(List=criteria_3)
fast_loop_start = FastLoopStart(Iterations=list_length)  # -> port, Counter, Data
cluster = Cluster(
    counter=fast_loop_start.Counter,
    data_1=data_1,
    data_2=data_2,
    data_3=data_3,
    criteria_1=criteria_1,
    criteria_2=criteria_2,
    criteria_3=criteria_3,
    object=object)
fast_loop_end = FastLoopEnd(port=fast_loop_start.port, Exit=False, Data=cluster, RecordData=True, TimeOutVal=0)
filtered = Data(fast_loop_end)

# ==== cluster Cluster
number_slider = Slider(3, range=0..10)
criteria_1 = ClusterInput()
data_1 = ClusterInput()
data_3 = ClusterInput()
criteria_3 = ClusterInput()
data_2 = ClusterInput()
criteria_2 = ClusterInput()
object = ClusterInput()
counter = ClusterInput()
criteria_1_2 = Text(criteria_1)
data_1_2 = Data(data_1)
data_3_2 = Data(data_3)
criteria_3_2 = Text(criteria_3)
data_2_2 = Data(data_2)
criteria_2_2 = Text(criteria_2)
object_2 = Data(object)
counter_2 = Integer(counter)
list_item = ListItem(List=criteria_3_2, Index=counter_2, Wrap=True)
list_item_2 = ListItem(List=criteria_2_2, Index=counter_2, Wrap=True)
list_item_3 = ListItem(List=criteria_1_2, Index=counter_2, Wrap=True)
panel = Panel(list_item)
match_text = MatchText(Text=data_2_2, Pattern=graft(list_item_2), Case=True)
match_text_2 = MatchText(Text=data_1_2, Pattern=graft(list_item_3), Case=True)
match_text_3 = MatchText(Text=data_3_2, Pattern=graft(list_item), Case=False)
gate_and = GateAnd(A=match_text_2, B=match_text, C=match_text_3)
mass_addition = MassAddition(Input=gate_and)  # -> Result, PartialResults
data = Data(flatten(mass_addition.Result))
dispatch = Dispatch(List=object_2, DispatchPattern=mass_addition.Result)  # -> ListA, ListB
data_4 = Data(flatten(match_text_3))
object_3 = Data(dispatch.ListA)
panel_2 = Panel(data)
object_4 = ClusterOutput(object_3)
panel_3 = Panel(data_4)
