# Grasshopper definition nazwa_testowa.gh (Grasshopper 1.0.8)

geometry = Geometry()

# ----
# MOVE TEST
unit_z = UnitZ(Factor=Slider(13, range=0..100))
move = Move(Geometry=geometry, Motion=unit_z)  # -> Geometry, Transform

python_3_script = Python3Script()  # -> out, a
# ---------- python_3_script: Python ----------
"""Grasshopper Script"""
a = "Hello Python 3 in Grasshopper!"
print(a)

a = "ty debilu ty gnoju 2"
# ---------- end python_3_script ----------
panel = Panel(python_3_script.a)
geometry_2 = Geometry(move.Geometry)
