# Grasshopper definition przenoszenie_parametrow_01.gh (Grasshopper 1.0.8)
# plug-ins: Rhino.Inside for Autodesk Revit

query_rooms = QueryRooms(Placed=True)

# ----
# PIG_Wysokosc Space
panel = Panel("Unbounded Height")
element = Element(query_rooms)
list_item = ListItem(List=element, Index=0, Wrap=True)
query_element_parameters = QueryElementParameters(Element=list_item, Name=panel)
query_parameters = QueryParameters(Name="PIG_Wysokosc Space")
element_parameter = ElementParameter(Element=element, Parameter=query_element_parameters)  # -> Element, Value
panel_2 = Panel(element_parameter.Value)
element_parameter_2 = ElementParameter(Element=element, Parameter=query_parameters, Value=element_parameter.Value)  # -> Element, Value; disabled

# ----
# PIG_Numer Space
panel_3 = Panel("Number")
element_2 = Element(query_rooms)
list_item_2 = ListItem(List=element_2, Index=0, Wrap=True)
query_element_parameters_2 = QueryElementParameters(Element=list_item_2, Name=panel_3)
query_parameters_2 = QueryParameters(Name="PIG_Numer Space")
element_parameter_3 = ElementParameter(Element=element_2, Parameter=query_element_parameters_2)  # -> Element, Value
panel_4 = Panel(element_parameter_3.Value)
element_parameter_4 = ElementParameter(Element=element_2, Parameter=query_parameters_2, Value=element_parameter_3.Value)  # -> Element, Value; disabled
panel_5 = Panel(query_parameters_2)

# ----
# PIG_Nazwa Pomieszczenia
# PARAMETR NAZWA NIEWLASCIWY DLA ROOMOW - TRZEBABY DODAC
panel_6 = Panel("Name")
element_3 = Element(query_rooms)
list_item_3 = ListItem(List=element_3, Index=0, Wrap=True)
query_element_parameters_3 = QueryElementParameters(Element=list_item_3, Name=panel_6)
query_parameters_3 = QueryParameters(Name="PIG_Nazwa Pomieszczenia")
element_parameter_5 = ElementParameter(Element=element_3, Parameter=query_element_parameters_3)  # -> Element, Value
panel_7 = Panel(element_parameter_5.Value)
element_parameter_6 = ElementParameter(Element=element_3, Parameter=query_parameters_3, Value=element_parameter_5.Value)  # -> Element, Value; disabled
panel_8 = Panel(query_parameters_3)

# ----
# Nazwa
panel_9 = Panel("")
element_4 = Element(query_rooms)
list_item_4 = ListItem(List=element_4, Index=0, Wrap=True)
query_element_parameters_4 = QueryElementParameters(Element=list_item_4, Name=panel_9)
query_parameters_4 = QueryParameters()  # disabled
element_parameter_7 = ElementParameter(Element=element_4, Parameter=query_element_parameters_4)  # -> Element, Value
panel_10 = Panel(element_parameter_7.Value)
element_parameter_8 = ElementParameter(Element=element_4, Parameter=query_parameters_4, Value=element_parameter_7.Value)  # -> Element, Value; disabled
panel_11 = Panel(query_parameters_4)
