# Grasshopper definition snip_-_dede.gh (Grasshopper 1.0.8)
# plug-ins: PythonEmbeddedPlugin

data = Data()
data_2 = Data(data)

# ---- group: snip test
number_slider = Slider(300, range=0..1000)
read_xl_table_values = Python3Script()  # -> out, FilteredData, FullData, VisibleIndices, HiddenIndices, Headers, CellAddresses, Status
# ---------- read_xl_table_values: Python ----------
# requirements: xlwings

# --- inputs ---
# FilePath       : str    # full path to the Excel file
# SheetName      : str    # name of the worksheet (falls back to first sheet)
# TableName      : str    # name of the Excel Table (ListObject) or named/A1 range
# Refresh        : bool   # trigger to (re)read the data

# --- outputs ---
# FilteredData    : Grasshopper DataTree[object]  # each column → one branch of visible values
# FullData        : Grasshopper DataTree[object]  # each column → one branch of ALL values
# VisibleIndices  : Grasshopper DataTree[object]  # each column → one branch of visible row-indices
# HiddenIndices   : Grasshopper DataTree[object]  # each column → one branch of hidden row-indices
# Headers         : Grasshopper DataTree[object]  # each column → one branch with its header
# CellAddresses   : Grasshopper DataTree[object]  # each column → one branch of cell addresses for FullData
# Status          : str

import xlwings as xw
from win32com.client import constants
from Grasshopper import DataTree
from Grasshopper.Kernel.Data import GH_Path

def col_letter(n):
    """Convert 1-based column index to letter, e.g. 1->A, 27->AA."""
    letters = ''
    while n > 0:
        n, rem = divmod(n-1, 26)
        letters = chr(65 + rem) + letters
    return letters

def ReadTableInfo(fp, sheet, tbl_name):
    """
    Returns:
      all_rows     : List[List]    # all data body rows
      all_addrs    : List[List]    # matching cell addresses (A1) per row
      vis_rows     : List[List]    # only visible rows
      vis_inds     : List[int]     # 1-based indices of visible rows within data body
      headers      : List[str]     # column headers
    """
    global _xl_app, _xl_wb
    # reopen if filepath changed
    if '_xl_wb' not in globals() or _xl_wb.fullname.lower() != fp.lower():
        if '_xl_wb' in globals():
            try: _xl_wb.close()
            except: pass
        _xl_app = xw.apps.active or (xw.App(visible=False) if not xw.apps else xw.apps[0])
        _xl_wb  = _xl_app.books.open(fp)

    names = [s.name for s in _xl_wb.sheets]
    sht   = _xl_wb.sheets[sheet] if sheet in names else _xl_wb.sheets[0]

    try:
        # Excel Table path
        tbl          = sht.api.ListObjects(tbl_name)
        header_rng   = tbl.HeaderRowRange
        data_body    = tbl.DataBodyRange
        total_rows   = data_body.Rows.Count
        n_cols       = data_body.Columns.Count

        # headers
        hdr_vals = header_rng.Value
        headers  = list(hdr_vals[0]) if isinstance(hdr_vals, tuple) else [hdr_vals]

        # compute absolute start row/col
        start_row = data_body.Row
        start_col = data_body.Column

        all_rows, all_addrs, vis_rows, vis_inds = [], [], [], []
        for i in range(total_rows):
            # COM row object
            row_obj = data_body.Rows(i+1)
            raw     = row_obj.Value
            # normalize values
            if isinstance(raw, tuple):
                first = raw[0]
                vals  = list(first) if isinstance(first, (list, tuple)) else [first]
            else:
                vals = [raw]
            # pad
            if len(vals) < n_cols:
                vals += [None] * (n_cols - len(vals))
            all_rows.append(vals)
            # addresses
            row_addrs = [
                f"{col_letter(start_col + j)}{start_row + i}"
                for j in range(n_cols)
            ]
            all_addrs.append(row_addrs)
            # visibility
            if not bool(row_obj.EntireRow.Hidden):
                vis_rows.append(vals)
                vis_inds.append(i+1)

        return all_rows, all_addrs, vis_rows, vis_inds, headers

    except Exception:
        # fallback named/A1 range
        rng      = sht.range(tbl_name)
        com_rng  = rng.api
        hdr_vals = rng.options(expand='table').value or rng.value
        if hdr_vals is None:
            return [], [], [], [], []
        # normalize to list-of-lists
        if not isinstance(hdr_vals, (list, tuple)):
            hdr_vals = [[hdr_vals]]
        else:
            if isinstance(hdr_vals, tuple):
                hdr_vals = [list(r) if isinstance(r, (tuple,list)) else [r] for r in hdr_vals]
            elif not any(isinstance(e, (list,tuple)) for e in hdr_vals):
                hdr_vals = [[v] for v in hdr_vals]
            else:
                hdr_vals = [list(r) if isinstance(r,(tuple,list)) else [r] for r in hdr_vals]

        headers    = [str(h) for h in hdr_vals[0]]
        all_data   = hdr_vals[1:]
        total_rows = len(all_data)
        n_cols     = len(headers)

        # absolute start (skip header)
        start_row = com_rng.Row + 1
        start_col = com_rng.Column

        all_addrs = [
            [
                f"{col_letter(start_col + j)}{start_row + i}"
                for j in range(n_cols)
            ]
            for i in range(total_rows)
        ]
        vis_rows = all_data[:]
        vis_inds = list(range(1, total_rows+1))
        return all_data, all_addrs, vis_rows, vis_inds, headers

# main
if not Refresh:
    Status          = "Idle (Refresh=False)"
    FilteredData    = DataTree[object]()
    FullData        = DataTree[object]()
    VisibleIndices  = DataTree[object]()
    HiddenIndices   = DataTree[object]()
    Headers         = DataTree[object]()
    CellAddresses   = DataTree[object]()
else:
    try:
        all_rows, all_addrs, vis_rows, vis_inds, headers = ReadTableInfo(
            FilePath, SheetName, TableName
        )
        hidden_inds = [
            i for i in range(1, len(all_rows)+1)
            if i not in vis_inds
        ]

        if not all_rows:
            Status = "No data found"
            FilteredData = FullData = VisibleIndices = HiddenIndices = Headers = CellAddresses = DataTree[object]()
        else:
            max_cols   = max(len(r) for r in all_rows)
            f_tree     = DataTree[object]()
            full_tree  = DataTree[object]()
            vis_tree   = DataTree[object]()
            hidden_tree= DataTree[object]()
            hdr_tree   = DataTree[object]()
            addr_tree  = DataTree[object]()

            for col in range(max_cols):
                path = GH_Path(col)
                # header
                hdr_tree.Add(headers[col] if col < len(headers) else "", path)
                # full data & addresses
                for vals, addrs in zip(all_rows, all_addrs):
                    full_tree.Add(vals[col] if col < len(vals) else None, path)
                    addr_tree.Add(addrs[col] if col < len(addrs) else "", path)
                # filtered data & visible indices
                for idx, vals in zip(vis_inds, vis_rows):
                    f_tree.Add(vals[col] if col < len(vals) else None, path)
                    vis_tree.Add(idx, path)
                # hidden indices
                for hid in hidden_inds:
                    hidden_tree.Add(hid, path)

            FilteredData   = f_tree
            FullData       = full_tree
            VisibleIndices = vis_tree
            HiddenIndices  = hidden_tree
            Headers        = hdr_tree
            CellAddresses  = addr_tree
            Status = (
                f"Read {len(vis_rows)} visible, "
                f"{len(hidden_inds)} hidden of {len(all_rows)} total rows "
                f"across {max_cols} columns"
            )

    except Exception as e:
        Status = f"Error: {e}"
        FilteredData = FullData = VisibleIndices = HiddenIndices = Headers = CellAddresses = DataTree[object]()
# ---------- end read_xl_table_values ----------
unit_z = UnitZ(Factor=number_slider)
data_3 = Data(read_xl_table_values.Headers)
extrude = Extrude(Base=data_3, Direction=unit_z)
move = Move(Geometry=extrude, Motion=Vector(0, 0, 10))  # -> Geometry, Transform
wrap_unwrap_components = WrapUnwrapComponents(
    AutoWidth=False,
    ComponentHeight=30,
    ComponentWidth=200,
    CurrentState="Unwrapped",
    InheritGroupColor=False,
    OffsetDistance=200,
    OffsetGuid_17=data,
    OffsetGuid_18=data_2,
    OffsetGuid_2=data_3,
    OffsetGuid_3=read_xl_table_values,
    OffsetGuid_4=move,
    OffsetGuid_5=extrude,
    OffsetGuid_6=number_slider,
    OffsetGuid_7=unit_z,
    OffsetGuid_8=data_4,
    OffsetX_0=-2275.5,
    OffsetX_1=-2275.5,
    OffsetX_10=-94.44262695,
    OffsetX_11=-256.5,
    OffsetX_12=121.5,
    OffsetX_13=3.5,
    OffsetX_14=-348.286499,
    OffsetX_15=-97.5,
    OffsetX_16=324.713623,
    OffsetX_17=-306.1470947,
    OffsetX_18=-129.347168,
    OffsetX_19=-2275.5,
    OffsetX_2=-93.12744141,
    OffsetX_3=-251.5,
    OffsetX_4=126.5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)
data_4 = Data(move.Geometry)

read_xl_table_values_2 = Python3Script()  # -> out, FilteredData, FullData, VisibleIndices, HiddenIndices, Headers, CellAddresses, Status; same code as read_xl_table_values
data_5 = Data(read_xl_table_values_2.Headers)
unit_z_2 = UnitZ(Factor=Slider(300, range=0..1000))
extrude_2 = Extrude(Base=data_5, Direction=unit_z_2)
move_2 = Move(Geometry=extrude_2, Motion=Vector(0, 0, 10))  # -> Geometry, Transform
wrap_unwrap_components_2 = WrapUnwrapComponents(
    AutoWidth=False,
    ComponentHeight=60,
    ComponentWidth=150,
    CurrentState="Unwrapped",
    InheritGroupColor=False,
    OffsetDistance=200,
    OffsetX_0=-83.93200684,
    OffsetX_1=-247.5,
    OffsetX_2=185.5,
    OffsetX_3=36.5,
    OffsetX_4=-333.9320068,
    OffsetX_5=-30.5,
    OffsetX_6=194.2521973,
    OffsetX_7=310.1700439,
    OffsetY_0=-13.68200684,
    OffsetY_1=-28.5,
    OffsetY_2=33.5,
    OffsetY_3=-18.5,
    OffsetY_4=87.31799316,
    OffsetY_5=96.5,
    OffsetY_6=-59.35424805,
    OffsetY_7=24.96228027,
    OffsetZ_0=0,
    OffsetZ_1=0,
    OffsetZ_2=0,
    OffsetZ_3=0,
    OffsetZ_4=0,
    OffsetZ_5=0,
    OffsetZ_6=0,
    OffsetZ_7=0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)
data_6 = Data(move_2.Geometry)

# ----
move_3 = Move(Motion=Vector(0, 0, 10))  # -> Geometry, Transform
