# Grasshopper definition test_hops_2.gh (Grasshopper 1.0.8)

get_number = GetNumber(AtLeast=1, AtMost=1, Maximum=1.797693135e+308, Minimum=-1.797693135e+308, TreeAccess=False)
get_line = GetLine(AtLeast=1, AtMost=1, Realtime=True, TreeAccess=False)
divide_curve = DivideCurve(Curve=get_line, Count=get_number, Kinks=False)  # -> Points, Tangents, Parameters
context_bake = ContextBake(Content=divide_curve.Points)
